# Grasshopper definition SEC_[dev]_ghGenericToolbox_01.gh (Grasshopper 1.0.7)
# Copyright: prslvtsv
# plug-ins: Human, Telepathy, Fologram For Grasshopper Utilities, Pancake

panel = Panel("""saveSettings
remotePy
forceUpdate
globalModules
expireTimer
autoPins
autoRemote""")
list = ItemSelector(
    panel,
    {"saveSettings", "remotePy", "forceUpdate", "globalModules", "expireTimer", "autoPins", "autoRemote"}, selected=["saveSettings", "autoPins"])
truebutton = TrueOnlyButton(LastSaveLocalization="neutral,N")
data = Data(list)
unset = RemoteSender()
python = GhPythonScript(settings=list)  # -> out, a; inputs settings: list
# ---------- python: Python ----------
# -*- coding: utf-8 -*-
"""
@author: prslvtsv
"""
##############################################################
import ghdev.devcon as dev
reload(dev)

dev.init_dev_tools(locals(), verbose=False)
##############################################################

#dev.clean_presistant_storage(locals())
print vault.content()

#ypin = ghenv.Component.Params.Input[1]
#print ypin.InstanceGuid
#ghenv.Component.Params.Input.Remove()
# ---------- end python ----------
python_2 = GhPythonScript(settings=list)  # -> out, a; inputs settings: list
# ---------- python_2: Python ----------
# -*- coding: utf-8 -*-
"""
@author: prslvtsv
"""
##############################################################
import ghdev.ghdev as dev
reload(dev)
initConf = {
    "remotePy":False,
    "updateChannel":0,
    "globalModules":True,
    "autoPins":True,
}
dev.init_dev_tools(locals(), verbose=False)
##############################################################
print vault.content()
#dev.clean_presistant_storage(locals())


#ypin = ghenv.Component.Params.Input[1]
#print ypin.InstanceGuid
#ghenv.Component.Params.Input.Remove()
# ---------- end python_2 ----------
C = Counter(Trigger=python_2.a, Reset=Button())
rec = DataRecorder(python_2.out, DataLimit=-10, RecordData=True)
panel_2 = Panel(python_2.out)
