# Grasshopper definition SEC_[example]_LayoutMatrixApt_treesCurves.gh (Grasshopper 1.0.7)
# Copyright: prslvtsv

crv = Curve([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])
cp = ControlPoints(Curve=crv)  # -> Points, Weights, Knots
pline = PolyLine(Vertices=cp.Points, Closed=True)  # -> flatten(Polyline)
group = Group(Objects=pline)
dup = DuplicateData(Data=group, Number=10, Order=True)  # -> graft(Data)
ungroup = Ungroup(Group=dup)

# ---- group: index from neigbour curves (trees)
python = GhPythonScript(crv=ungroup)  # -> indexes, curves; inputs crv: list of Polyline
# ---------- python: Python ----------
## -*- coding: utf-8 -*-
#"""
#@author: prslvtsv
#"""
###############################################################
#import ghdev.devcon as dev
#reload(dev)
#
#dev.init_dev_tools(locals(),  config=dev_options, verbose=True)
###############################################################

import ghpythonlib.treehelpers as th
from  Rhino.Geometry import Point3d
from collections import OrderedDict as oddict
import gblock.ghhelp as ghh
import gh_components_script.gh_points2matrix as p2m
reload(p2m)
reload(ghh)

def crv2points(crv):
    poly = [c.ToArray() for c in crv]
    # remove 5th point 
    pt = [[p for p in pl][:-1] for pl in poly]
    return pt

def orient_poly_points(pt):
    pl_pts = []
    for pt in pt:
        pl_pts.append( [Point3d(x, y, 0) for (x, y) in p2m.sort_pt_xy(pt)])
    return pl_pts  


def corners2index(corners):
    leftLow = [a[0] for a in corners]
    xll = [p.X for p in leftLow]
    unique_x= sorted(list(set([round(x) for x in xll])))
    ix = [unique_x.index(round(xp)) for xp in xll]
    
    rightTop = [a[2] for a in corners]
    yrt = [p.Y for p in rightTop]
    unique_y = sorted(list(set([round(y) for y in yrt])))
    jy = [unique_y.index(round(yp)) for yp in yrt]


    print list(zip(ix, jy))
    return list(zip(ix, jy))

pts = crv2points(crv)
sorted_corners = orient_poly_points(pts)
indx = corners2index(sorted_corners)

#print sorted_corners
indexes = indx
curves = [c for c in crv]
# ---------- end python ----------

# ----
pcen = PolygonCenter(Polyline=python.curves)  # -> CenterV, CenterE, CenterA
tag = TextTag(Location=pcen.CenterV, Text=python.indexes)
