# Grasshopper definition SEC_[tool]_AptSolver_wip.gh (Grasshopper 1.0.7)
# Copyright: prslvtsv
# plug-ins: Telepathy, Human, Pancake, Heteroptera, Pufferfish

# ---- group: PARAMETERS - replace with your pathes
# C:\Windows\System32\WindowsPowerShell\v1.0\powershell.exe -ExecutionPolicy ByPass -NoExit -Command "& 'C:\ProgramData\Anaconda3\shell\condabin\conda-hook.ps1' ; conda activate 'C:\ProgramData\Anaconda3' "
conda_base_env = Panel("\"C:\\ProgramData\\Anaconda3\\shell\\condabin\\conda-hook.ps1; conda activate C:\\ProgramData\\Anaconda3;\"")
# "C:\ProgramData\Anaconda3\shell\condabin\conda-hook.ps1; conda activate C:\ProgramData\Anaconda3\envs\exc43;"
power_shell_as_executable = Panel("C:\Windows\System32\WindowsPowerShell\v1.0\powershell.exe")
solver_script = Panel("C:\Users\GUEST\Documents\CODE\aective\sectiondev\sections_dataset_generator\apart_solver.py")
shell_executable = RemoteSender(power_shell_as_executable)
conda_activate = RemoteSender(conda_base_env)
solver_script_2 = RemoteSender(solver_script)

# ---- group: read geometry inside frames / get selection frames
pipeline = GeometryPipeline(
    GroupByLayer=False,
    GroupByType=False,
    IncludeHidden=False,
    IncludeLocked=False,
    LayerFilter="Floors_gen::frames",
    NameFilter="*",
    SublayerFiltering=True,
    TypeFilter=5)

# ---- group: read attributes from py
list = ValueList({"floor", "floor_user"}, selected="floor_user")
python = GhPythonScript(setName=list)  # -> out, attrib_names, attrib_dims, attrib_obj, mapping_dict
# ---------- python: Python ----------
# -*- coding: utf-8 -*-
"""
@author: prslvtsv
"""
import scriptcontext as sc
import gblock.gh_context.gh_context as context
import gblock.core as core
reload(context)

################################################################################
## CONTEXT CREATOR BELOW | ADDS DEV METODS TO COMPONENT 
## SEE GH_CONTEXT\CONTEXT_GENERAL.TXT FOR DETAILS
################################################################################
#exec(compile(''.join(context.init()), 'init', 'exec'), locals())
################################################################################
import collections 
core.StateContainer.init_attributes()
 
attr_list = core.StateContainer.get_all_attr(setName).values()

names = list([a.name for a in attr_list])
dims = []



def map_addresses(attributes):
    mapping = collections.OrderedDict()
    for n, obj in enumerate(attributes):
        #print n
    
        name = obj.name
        mapping[name] = {}
        mapping[name]['pos'] = n
        
        for o, opt in enumerate(obj.options):
            mapping[name]['range'] = slice(None)
            mapping[name][opt.value] = o
    sc.sticky['attributes_mapping'] = mapping
    return mapping

for n in attr_list:

    n.valuenow = 0
    if n in 'distribution' or n in 'length':
        dims.append(1)
    else:
        dims.append(n.count_options())
print dims
###  sorting
#dims = list(dims)
#print dims

indx = [i[0] for i in  sorted(zip(range(len(attr_list)), dims), reverse=True, key=lambda c: c[1])]
print indx
#indx = (-dims).argsort()



################
# manuallty push distr & length to end
dis = 3
dp = 8
len = 8
lp = 10
indx[lp] = 10
indx[dp] = 9
indx[11] = len
indx[12] = dis
indx[0] = 10
indx[10] = 11
#print indx

dims = [dims[i] for i in indx]
#print names
names = [names[i] for i in indx]
print names

attrib_names = [n for n in names]
attrib_dims = [n for n in dims]
attrib_obj =[attr_list[i] for i in indx]


mapping_dict = [map_addresses(attrib_obj)]

sc.sticky['attrib_names'] = attrib_names
sc.sticky['attrib_dims'] = attrib_dims
sc.sticky['attrib_obj'] = attr_list

#print names
#print dims
#print indx
# ---------- end python ----------

# ---- group: read geometry inside frames
id = Guid(pipeline)
read_floor = GhPythonScript(guid=id)  # -> out, tiles_geo, ref_geo, origin_pt, attr_txt, other_geo; inputs autoUpdate: Boolean
# ---------- read_floor: Python ----------
# -*- coding: utf-8 -*-
"""
@author: prslvtsv
"""
import scriptcontext as sc
import gblock.ghhelp as ghh
reload (ghh)
#import gblock.gh_context.gh_context as context
#reload(context)
#
################################################################################
## CONTEXT CREATOR BELOW | ADDS DEV METODS TO COMPONENT 
## SEE GH_CONTEXT\CONTEXT_GENERAL.TXT FOR DETAILS
################################################################################
##print context.init()[4]
#_verbose_init = False
#try:
#    exec(compile(context.init()[4], 'init', 'exec'), locals())
#except:
#    ghenv.Component.ExpireSolution(True)
################################################################################

#from Rhino.Geometry import Point3d, Point, Curve, Polyline, PolylineCurve
from Rhino.DocObjects import CurveObject, TextObject, PointObject
import copy

tiles_geo  = []
ref_geo = []
attr_txt = []
other_geo = []
origin_pt = []
def read_guid_data():

    geo, layer = ghh.Helper.get_obj_by_region(guid)
    

    
    for i in range(len(geo)):
    
        g = ghh.Helper.get_by_id_obj(geo[i])
        g.UserDictionary.Clear()
        state_name = layer[i].split('::')[-1]
        group_name = layer[i].split('::')[-2]
        g.UserDictionary.Set('state', state_name)
        g.UserDictionary.Set('group', group_name)
            
        if isinstance(g, CurveObject):
           
            if group_name == 'tiles':
                tiles_geo.append(g)
            elif group_name == 'refgeo':
                ref_geo.append(g)
            else:
                print 'unsorted curve ', group_name, ' ', state_name
    
        elif isinstance(g, PointObject):
            if state_name == 'origin':
                origin_pt.append(g)
            else:
                print 'unsorted point ', group_name, ' ', state_name
            # print'point'
        elif isinstance(g, TextObject):
            if state_name in 'attrib_txt':
                for st in g.DisplayText.splitlines():
                    attr_txt.append(st)
                    
            else:
                print type(g)
                print 'unsorted text ',  state_name
        else:
            print 'unsorted geometry ', group_name, ' ', state_name
#            other_geo.append(g)

ghenv.Component.Params.Input[1].Optional = True
if not ghenv.Component.Params.Input[1].VolatileData.IsEmpty:
    try:
        read_guid_data()
    except:
        print 'reading failed'
#        ghenv.Component.ExpireSolution(True)
else:
#    ghenv.Component.AddRuntimeMessage(runtimeMessage.Warning, 'input data is missing')
    print 'no objects'
# ---------- end read_floor ----------

# ----
list_2 = ValueList({"corridor", "custom", "fixed", "free", "llu"}, selected=["corridor", "custom", "fixed", "free", "llu"])

# ---- group: get geo by state user data
py = GhPythonScript(obj=read_floor.tiles_geo, user_data_key="state", user_data_val=list_2)  # -> out, geo, user_data; inputs obj: list, user_data_val: list
# ---------- py: Python ----------
# -*- coding: utf-8 -*-
"""
@author: prslvtsv
"""
import scriptcontext as sc
import Grasshopper.Kernel.GH_RuntimeMessageLevel as runtimeMessage


geo = []
user_data = []

for o in obj:
    if o == None:
        geo = None
        user_data = None
    else:
        uVal = o.UserDictionary.GetString(user_data_key)
        for udv in user_data_val:
            if uVal== udv:
                geo.append(o.Geometry)
                user_data.append(uVal)
            elif not udv:
                geo.append(o.Geometry)
                user_data.append(uVal)
# ---------- end py ----------

# ---- group: arrange read attributes / modify floor state val
replace_val = GhPythonScript(attr_glob=python.attrib_obj, floor_read=read_floor.attr_txt)  # -> out, attr_out; inputs attr_glob: list, floor_read: list
# ---------- replace_val: Python ----------
# -*- coding: utf-8 -*-
"""
@author: prslvtsv
"""
import scriptcontext as sc
import gblock.gh_context.gh_context as context
import gblock.core as core
import copy
reload(context)

################################################################################
## CONTEXT CREATOR BELOW | ADDS DEV METODS TO COMPONENT 
## SEE GH_CONTEXT\CONTEXT_GENERAL.TXT FOR DETAILS
################################################################################
#_verbose_init = False
#exec(compile(''.join(context.init()), 'init', 'exec'), locals())
################################################################################



# print attr_dict

replaced = [core.att.Attribute().assign(a) for a in attr_glob]
#print replaced[0].name
try:
    for fl in floor_read:
    
        name, value = fl.split(':')
        print name, value
        i = sc.sticky['attrib_names'].index(name)
        if name in 'groundFloorAccess':
            if value in 'n/a':
                value = 'undefined'
        replaced[i].valuenow = str(value)
#        print replaced[i].valuenow
    #replaced[sc.sticky['attrib_names'].index('distribution')]
    attr_out = replaced
    #
    #print replaced
    #print replaced.shape()
except:
    print 'BYPASSED'
    print 'no data to work with'
    attr_out = replaced
# ---------- end replace_val ----------

# ---- group: arrange read attributes
ghpython_script = GhPythonScript(attr_loc=replace_val.attr_out)  # -> out, name_val; inputs attr_loc: list
# ---------- ghpython_script: Python ----------
# -*- coding: utf-8 -*-
"""
@author: prslvtsv
"""
import scriptcontext as sc
import gblock.gh_context.gh_context as context
reload(context)

################################################################################
## CONTEXT CREATOR BELOW | ADDS DEV METODS TO COMPONENT 
## SEE GH_CONTEXT\CONTEXT_GENERAL.TXT FOR DETAILS
################################################################################
#autoUpdate = False
#exec(compile(''.join(context.init()), 'init', 'exec'), locals())
################################################################################

name_val = []

for a in attr_loc:
    name_val.append('{}:{}'.format(a.name, a.valuenow))
# ---------- end ghpython_script ----------
panel = Panel(ghpython_script.name_val)

# ----
floor_attr_obj = RemoteSender(replace_val.attr_out)
python_2 = GhPythonScript(crv=py.geo, state=py.user_data)  # -> out, combined; inputs crv: list of Polyline, state: list
# ---------- python_2: Python ----------
# -*- coding: utf-8 -*-
"""
@author: prslvtsv
"""
###############################################################
#import ghdev.devcon as dev
#reload(dev)
#
#dev.init_dev_tools(locals(),  config=dev_options, verbose=True)
###############################################################

combined = list(zip(crv, state))
# ---------- end python_2 ----------
floor_read_attr = RemoteSender(ghpython_script.name_val)

# ---- group: index from neigbour curves (trees)
python_3 = GhPythonScript(crv=py.geo)  # -> indexes, curves; inputs crv: list of Polyline
# ---------- python_3: Python ----------
## -*- coding: utf-8 -*-
#"""
#@author: prslvtsv
#"""
###############################################################
#import ghdev.devcon as dev
#reload(dev)
#
#dev.init_dev_tools(locals(),  config=dev_options, verbose=True)
###############################################################

import ghpythonlib.treehelpers as th
from  Rhino.Geometry import Point3d
from collections import OrderedDict as oddict
import gblock.ghhelp as ghh
import gh_components_script.gh_points2matrix as p2m
reload(p2m)
reload(ghh)

def crv2points(crv):
    poly = [c.ToArray() for c in crv]
    # remove 5th point 
    pt = [[p for p in pl][:-1] for pl in poly]
    return pt

def orient_poly_points(pt):
    pl_pts = []
    for pt in pt:
        pl_pts.append( [Point3d(x, y, 0) for (x, y) in p2m.sort_pt_xy(pt)])
    return pl_pts  

def xy2ij(points):
    xx, yy = [p.X for p in points], [p.Y for p in points]
    unique_x= sorted(list(set([round(x) for x in xx])))
    unique_y = sorted(list(set([round(y) for y in yy])))
    i = [unique_x.index(round(xp)) for xp in xx]
    j = [unique_y.index(round(yp)) for yp in yy]
    print list(zip(ix, jy))
    return list(zip(ix, jy))
    
def corners2index(corners):
    leftLow = [a[0] for a in corners]
    xll = [p.X for p in leftLow]
    unique_x= sorted(list(set([round(x) for x in xll])))
    ix = [unique_x.index(round(xp)) for xp in xll]
    
    rightTop = [a[2] for a in corners]
    yrt = [p.Y for p in rightTop]
    unique_y = sorted(list(set([round(y) for y in yrt])))
    jy = [unique_y.index(round(yp)) for yp in yrt]


    print list(zip(ix, jy))
    return list(zip(ix, jy))

pts = crv2points(crv)
sorted_corners = orient_poly_points(pts)
indx = corners2index(sorted_corners)

#print sorted_corners
indexes = indx
curves = [c for c in crv]
# ---------- end python_3 ----------

# ----
pipeline_2 = GeometryPipeline(
    GroupByLayer=False,
    GroupByType=False,
    IncludeHidden=False,
    IncludeLocked=False,
    LayerFilter="apartments::possible",
    NameFilter="*",
    SublayerFiltering=True,
    TypeFilter=1)

# ---- group: state matrix from indexes
python_4 = GhPythonScript(indexes=python_3.indexes, opt_data=python_2.combined)  # -> out, matrix, cells; inputs indexes: list, opt_data: list
# ---------- python_4: Python ----------
# -*- coding: utf-8 -*-
"""
@author: prslvtsv
"""
###############################################################
#import ghdev.devcon as dev
#reload(dev)
#
#dev.init_dev_tools(locals(),  config=dev_options, verbose=True)
###############################################################
import gblock.elements.matrix as mtx
reload(mtx)


matrix = mtx.SpacialMatrix().from_indexes(indexes, data=opt_data)
cells = matrix.active_indexes()
print cells
# ---------- end python_4 ----------

# ----
pcen = PolygonCenter(Polyline=python_3.curves)  # -> CenterV, CenterE, CenterA
pgroups = PointGroups(Points=pipeline_2, Distance=Slider(2.5, range=0..10))  # -> Groups, Indices

# ---- group: display point groups
disp = Disp_2(data=pgroups.Groups)

# ----
tag = TextTag(Location=pcen.CenterV, Text=python_3.indexes)

# ---- group: separate floors tiles & handle corridor conditions
python_5 = GhPythonScript(matrix=python_4.matrix)  # -> out, mtx_full, cells_all, cells_pub, cells_res, cells_to_tile
# ---------- python_5: Python ----------
# -*- coding: utf-8 -*-
"""
@author: prslvtsv
"""
###############################################################
#import ghdev.devcon as dev
#reload(dev)
#
#dev.init_dev_tools(locals(),  config=dev_options, verbose=True)
###############################################################
import gblock.elements.matrix as mtx
reload(mtx)


mtx_full = matrix
res = [m for m in matrix.active_cells() if m.data[1] not in ("llu", "corridor")]
pub = [m for m in matrix.active_cells() if m.data[1] in ("llu", "corridor")]
corridor = [m for m in matrix.active_cells() if m.data[1] in "corridor"]

# handle corridor end conditions
endStates = []
for s in range(1,3):
    for e in range(1,3):
        endStates.append(corridor[:s]+corridor[-e:])
print [[es.index() for es in ess ]for ess in endStates]

# currently - use only most full option
tile = [res + es for es in endStates]

cells_pub = pub
cells_res = res
cells_to_tile = tile
cells_all = matrix.active_cells()
# ---------- end python_5 ----------

# ----
cells_to_tile = RemoteSender(python_5.cells_to_tile)

# ---- group: points to indexes
indx = GhPythonScript(points=pgroups.Groups)  # -> out, indexes, pt, xy; inputs points: list of Point3d
# ---------- indx: Python ----------
import gblock.ghhelp as ghh
reload(ghh)
import gh_components_script.gh_points2matrix as p2m
reload(p2m)

indexes = ghh.xy2ij(points)
xy = p2m.points2matrix_xy(points)
pt = points
# ---------- end indx ----------

# ---- group: display_block / copute things for display
d = D(xy=indx.xy)  # -> R, T

# ---- group: display_block
screentext = ScreenOrientedText(
    Text=indx.indexes,
    Font="Arial",
    Justification=2,
    Location=d.T,
    SizeFactor=Slider(0.173, range=0..2),
    Color=RGB(255, 255, 255),
    Depth=0,
    Absolute=True)

# ----
floor_matrix_data_crv_state = RemoteSender(python_4.matrix)
til = GhPythonScript(tiling_options=python_5.cells_to_tile)  # -> cells
# ---------- til: Python ----------
# -*- coding: utf-8 -*-
"""
@author: prslvtsv
"""
###############################################################
#import ghdev.devcon as dev
#reload(dev)
#
#dev.init_dev_tools(locals(),  config=dev_options, verbose=True)
###############################################################
cells = tiling_options
# ---------- end til ----------

# ---- group: display_block / display cells tiles
disp_2 = Disp(geo_to_viz=d.R)

# ----
til_2 = GhPythonScript(tiling_options=python_5.cells_to_tile)  # -> cells; same code as til

# ---- group: create from indexes
python_6 = GhPythonScript(indexes=indx.indexes)  # -> out, matrix, cells; inputs indexes: list
# ---------- python_6: Python ----------
# -*- coding: utf-8 -*-
"""
@author: prslvtsv
"""
###############################################################
#import ghdev.devcon as dev
#reload(dev)
#
#dev.init_dev_tools(locals(),  config=dev_options, verbose=True)
###############################################################
import gblock.elements.matrix as mtx
reload(mtx)


matrix = mtx.SpacialMatrix().from_indexes(indexes, data="cell")
cells = matrix.active_indexes()
# ---------- end python_6 ----------

# ----
expl = GhPythonScript(cells=til)  # -> indexes, crv, state; inputs cells: list
# ---------- expl: Python ----------
# -*- coding: utf-8 -*-
"""
@author: prslvtsv
"""
###############################################################
#import ghdev.devcon as dev
#reload(dev)
#
#dev.init_dev_tools(locals(),  config=dev_options, verbose=True)
###############################################################
import gblock.elements.matrix as mtx
reload(mtx)


indexes = [c.index() for c in cells]
crv = [c.data[0] for c in cells]
state = [c.data[1] for c in cells]
# ---------- end expl ----------
expl_2 = GhPythonScript(cells=til_2)  # -> indexes, crv, state; inputs cells: list; same code as expl
expl_3 = GhPythonScript(cells=python_5.cells_all)  # -> indexes, crv, state; inputs cells: list; same code as expl
python_7 = GhPythonScript(indexes=expl.indexes)  # -> out, matrix, cells; inputs indexes: list; same code as python_6
str = GhPythonScript(idx_list=python_6.cells)  # -> flatten(set_string); inputs idx_list: list
# ---------- str: Python ----------
set_string = "[" + ", ".join("({}, {})".format(x, y) for (x, y) in idx_list) + "]"
# ---------- end str ----------
python_8 = GhPythonScript(indexes=expl_2.indexes)  # -> out, matrix, cells; inputs indexes: list; same code as python_6
python_9 = GhPythonScript(matrix=python_6.matrix)  # -> out, representation, cells_indx
# ---------- python_9: Python ----------
# -*- coding: utf-8 -*-
"""
@author: prslvtsv
"""
###############################################################
#import ghdev.devcon as dev
#reload(dev)
#
#dev.init_dev_tools(locals(),  config=dev_options, verbose=True)
###############################################################
import gblock.elements.matrix as mtx
reload(mtx)


representation = matrix.__repr__()
cells_indx = matrix.active_indexes()
# ---------- end python_9 ----------

# ---- group: appartments templates
appt_23_o = RemoteReceiver()  # disabled
appt_23_p = RemoteReceiver()  # disabled
appt_12_i = RemoteReceiver()  # disabled
appt_13_i = RemoteReceiver()  # disabled
appt_23_j = RemoteReceiver()  # disabled
appt_33_j = RemoteReceiver()  # disabled

# ----
python_10 = GhPythonScript(matrix=python_7.matrix)  # -> out, representation, cells_indx; same code as python_9
matrix_to_tile = RemoteSender(python_8.matrix)
panel_2 = Panel(python_9.representation)
set_of_tiles = RemoteSender(str)
ghpython_script_2 = GhPythonScript(tiles=[appt_23_o, appt_23_j])  # -> formated; inputs tiles: list; disabled
# ---------- ghpython_script_2: Python ----------
# -*- coding: utf-8 -*-
"""
@author: prslvtsv
"""
###############################################################
#import ghdev.devcon as dev
#reload(dev)
#
#dev.init_dev_tools(locals(),  config=dev_options, verbose=True)
###############################################################

formated = "..".join(tiles)
# ---------- end ghpython_script_2 ----------
ghpython_script_3 = GhPythonScript(tiles=[appt_12_i, appt_13_i])  # -> formated; inputs tiles: list; disabled; same code as ghpython_script_2
ghpython_script_4 = GhPythonScript(tiles=appt_13_i)  # -> formated; inputs tiles: list; disabled; same code as ghpython_script_2
panel_3 = Panel(python_10.representation)
solver_conditional_script = RemoteReceiver()  # disabled
python_11 = GhPythonScript(mandatory=ghpython_script_2, filler=ghpython_script_3)  # -> out, tileset; disabled
# ---------- python_11: Python ----------
# -*- coding: utf-8 -*-
"""
@author: prslvtsv
"""
###############################################################
#import ghdev.devcon as dev
#reload(dev)
#
#dev.init_dev_tools(locals(),  config=dev_options, verbose=True)
###############################################################

tileset = ""
if mandatory != None:
    tileset += "-m {} ".format(mandatory)
if optional != None:
    tileset += "-o {} ".format(optional)
if filler != None:
    tileset += "-f {} ".format(filler)
# ---------- end python_11 ----------
board_remove_cells = RemoteReceiver()  # disabled
shell_executable_2 = RemoteReceiver(shell_executable)  # disabled
conda_activate_2 = RemoteReceiver(conda_activate)  # disabled
cells_to_tile_2 = RemoteReceiver(cells_to_tile)
board_size = RemoteReceiver()  # disabled
til_3 = GhPythonScript(tiling_options=cells_to_tile_2)  # -> cells; same code as til
python_12 = GhPythonScript(solver=solver_conditional_script, board_size=board_size, board_remove=board_remove_cells, tile_set=python_11.tileset)  # -> out, cmd_str; disabled
# ---------- python_12: Python ----------
# -*- coding: utf-8 -*-
"""
@author: prslvtsv
"""
###############################################################
#import ghdev.devcon as dev
#reload(dev)
#
#dev.init_dev_tools(locals(),  config=dev_options, verbose=True)
###############################################################

xs = board_size.split(",")[0]
ys = board_size.split(",")[1]

cmd_str = "python {} -s {} {} -r {} {}".format(solver, xs, ys, board_remove, tile_set)
# ---------- end python_12 ----------
panel_4 = Panel(python_12.cmd_str)  # disabled
path_mapper = PathMapper(til_3, source="{A;B;C;D;E}", target="{D;E}")
python_13 = GhPythonScript(terminal=shell_executable_2, conda_activate=conda_activate_2, payload=python_12.cmd_str)  # -> out, result; disabled
# ---------- python_13: Python ----------
# -*- coding: utf-8 -*-
"""
@author: prslvtsv
"""
###############################################################
#import ghdev.devcon as dev
#reload(dev)
#
#dev.init_dev_tools(locals(),  config=dev_options, verbose=True)
###############################################################

import subprocess as sub


def execute_in_shell(cmd):
    
    process = sub.Popen(cmd, executable=terminal, stdin=sub.PIPE, stdout=sub.PIPE, stderr=sub.PIPE, shell=True)
    stdout, stderr = process.communicate()
    print stdout
    return stdout


cmd = "; ".join([conda_activate, payload])
result = execute_in_shell(cmd).split('\n')
# ---------- end python_13 ----------
expl_4 = GhPythonScript(cells=path_mapper)  # -> indexes, crv, state; inputs cells: list; same code as expl
panel_5 = Panel(python_13.result)  # disabled
python_14 = GhPythonScript(result_in=python_13.result)  # -> out, board, tiling; inputs result_in: list; disabled
# ---------- python_14: Python ----------
# -*- coding: utf-8 -*-
"""
@author: prslvtsv
"""
###############################################################
#import ghdev.devcon as dev
#reload(dev)
#
#dev.init_dev_tools(locals(),  config=dev_options, verbose=True)
###############################################################

print type(result_in[0])
exec("board = {}".format(result_in[0].strip())) 
exec("tiling = {}".format(result_in[1].strip())) 
#board = result_in[0]
#tiling = result_in[1]
# ---------- end python_14 ----------
set_of_tiles_2 = RemoteReceiver(set_of_tiles)
group = Group(Objects=expl_4.crv)
python_15 = GhPythonScript(indexes=expl_4.indexes)  # -> out, matrix, cells; inputs indexes: list; same code as python_6

# ---- group: parse tiling
python_16 = GhPythonScript(cells=python_14.tiling)  # -> out, x, y; disabled
# ---------- python_16: Python ----------
# -*- coding: utf-8 -*-
"""
@author: prslvtsv
"""
###############################################################
#import ghdev.devcon as dev
#reload(dev)
#
#dev.init_dev_tools(locals(),  config=dev_options, verbose=True)
###############################################################

x= []
y = []

print cells
srt = sorted(cells)
print srt
for c in srt:
    
    x.append(c[0])
    y.append(c[1])
# ---------- end python_16 ----------

# ---- group: parse board
python_17 = GhPythonScript(cells=python_14.board)  # -> out, x, y; inputs cells: list; disabled
# ---------- python_17: Python ----------
# -*- coding: utf-8 -*-
"""
@author: prslvtsv
"""
###############################################################
#import ghdev.devcon as dev
#reload(dev)
#
#dev.init_dev_tools(locals(),  config=dev_options, verbose=True)
###############################################################

x= []
y = []

srt = sorted(cells)
print srt
for c in srt:
    
    x.append(c[0])
    y.append(c[1])
# ---------- end python_17 ----------

# ----
python_18 = GhPythonScript(matrix=python_15.matrix)  # -> out, representation, cells_indx; same code as python_9
panel_6 = Panel(python_18.representation)

# ---- group: generate geometry
tiling = Tiling(index_x=python_16.x, index_y=python_16.y)  # -> cell_srf, cell_rect, cell_pt; disabled

# ----
bbox = BoundingBox(Content=flatten(tiling.cell_pt), Plane=PlaneXY(0, 0, 0), UnionBox=True)  # -> Box, Box_2; disabled

# ---- group: generate geometry
tiling_2 = Tiling(index_x=python_17.x, index_y=python_17.y)  # -> cell_srf, cell_rect, cell_pt; disabled

# ----
dim = Dimensions(Surface=bbox.Box)  # -> UDimension, VDimension; disabled

# ---- group: format to solver
str_2 = GhPythonScript(idx_list=set_of_tiles_2)  # -> set_array_str; inputs idx_list: list
# ---------- str_2: Python ----------
set_array_str = "[" + ", ".join(x for x in idx_list) + "]"
# ---------- end str_2 ----------

# ---- group: format_to_solver
str_3 = GhPythonScript(idx_list=python_18.cells_indx)  # -> set_array_str; inputs idx_list: list
# ---------- str_3: Python ----------
set_array_str = "[" + ", ".join("({}, {})".format(x, y) for (x, y) in idx_list) + "]"
# ---------- end str_3 ----------

# ----
solver_script_3 = RemoteReceiver(solver_script_2)
shell_executable_3 = RemoteReceiver(shell_executable)
conda_activate_3 = RemoteReceiver(conda_activate)

# ---- group: format shell command
f = GhPythonScript(solver=solver_script_3, aparts=str_2, board=str_3)  # -> out, cmd_str
# ---------- f: Python ----------
# -*- coding: utf-8 -*-
"""
@author: prslvtsv
"""
###############################################################
#import ghdev.devcon as dev
#reload(dev)
#
#dev.init_dev_tools(locals(),  config=dev_options, verbose=True)
###############################################################


cmd_str = "python {} -bd '{}' -ap '{}'".format(solver, board, aparts)
print cmd_str
# ---------- end f ----------

# ---- group: RUN SOLVER IN TERMINAL
cmd = GhPythonScript(terminal=shell_executable_3, conda_activate=conda_activate_3, payload=f.cmd_str)  # -> out, result
# ---------- cmd: Python ----------
# -*- coding: utf-8 -*-
"""
@author: prslvtsv
"""
###############################################################
#import ghdev.devcon as dev
#reload(dev)
#
#dev.init_dev_tools(locals(),  config=dev_options, verbose=True)
###############################################################

import subprocess as sub


def execute_in_shell(cmd):
    
    process = sub.Popen(cmd, executable=terminal, stdin=sub.PIPE, stdout=sub.PIPE, stderr=sub.PIPE, shell=True)
    stdout, stderr = process.communicate()
#    print stdout, stderr
    return stdout


cmd = "; ".join([conda_activate, payload])
r = execute_in_shell(cmd).splitlines()[0].strip()
exec("result = {}".format(r))
#result = execute_in_shell(cmd)
#print result
# ---------- end cmd ----------

# ----
trim = TrimTree(Tree=cmd.result, Depth=2)
floor_matrix_data_crv_state_2 = RemoteReceiver(graft(floor_matrix_data_crv_state))
python_19 = GhPythonScript(lst=trim, lim=Slider(12, range=0..100), bypass=Toggle(False))  # -> out, result; inputs lst: list, lim: Int32, bypass: Boolean
# ---------- python_19: Python ----------
if not bypass:
    result = lst[:lim]
else:
    result = lst
# ---------- end python_19 ----------
trim_2 = TrimTree(Tree=python_19.result, Depth=1)
python_20 = GhPythonScript(group_idx=trim_2, floor_mtx=floor_matrix_data_crv_state_2)  # -> out, floor_full_groups; inputs group_idx: tree
# ---------- python_20: Python ----------
import ghpythonlib.treehelpers as th
from Grasshopper import DataTree

groups = th.tree_to_list(group_idx)
#floor = th.tree_to_list(floor_mtx.AllData())
#print floor
out_tree = DataTree[object]()

print len(groups)
for i, board_res in enumerate(groups):

    for gr in board_res:
        setA = set(sum(gr, []))
        setB = floor_mtx.active_cells()
        corridor = [c.index() for c in setB if c.index() not in setA and c.data[1] in 'corridor']
        llu = [c.index() for c in setB if c.index() not in setA and c.data[1] in 'llu']
        full = gr+[corridor]+[llu]
        out_tree.Add(full, group_idx.Paths[i])
        
#print floor_full[0][0]
floor_full_groups = out_tree
# ---------- end python_20 ----------
python_21 = GhPythonScript(result=python_20.floor_full_groups)  # -> out, flat_idx, grouped_indexes, layouts; inputs result: list
# ---------- python_21: Python ----------
import ghpythonlib.treehelpers as th
import gblock.elements.matrix as mtx
import gblock.elements.layout as layout
reload(mtx)
reload(layout)

print result[1]

flat_idx = [[x for xs in xss for x in xs] for xss in result]
print flat_idx[0]
#matrix = mtx.SpacialMatrix.create_from_indexes(indexes, data="cell")

mtx_tiled_groups = [mtx.SpacialMatrix().from_indexes(idx) for idx in flat_idx]
grouped_indexes = result
layouts = []
for i, v in enumerate(result):
    layouts.append(layout.FloorLayout(mtx_tiled_groups[i], v))
    print layouts[-1].spacediv
# ---------- end python_21 ----------
python_22 = GhPythonScript(space_groups=python_20.floor_full_groups, base_matrix=floor_matrix_data_crv_state_2)  # -> out, apt_layouts; inputs space_groups: list
# ---------- python_22: Python ----------
import ghpythonlib.treehelpers as th
import gblock.elements.matrix as mtx
import gblock.elements.layout as layout
reload(mtx)
reload(layout)

#print result[1]
#
#flat_idx = [[x for xs in xss for x in xs] for xss in result]
#print flat_idx[0]
##matrix = mtx.SpacialMatrix.create_from_indexes(indexes, data="cell")
#
#mtx_tiled_groups = [mtx.SpacialMatrix().from_indexes(idx) for idx in flat_idx]
#grouped_indexes = result
#layouts = []
#for i, v in enumerate(result):
#    layouts.append(layout.FloorLayout(mtx_tiled_groups[i], v))

apt = []
for tiling in space_groups:
    apartLayout = layout.FloorLayout().from_matrix_tiling(base_matrix, tiling)
    apt.append(apartLayout)

print [[len(g) for g in a.spacediv.values()] for a in apt]
apt_layouts = apt
# ---------- end python_22 ----------
brec = BoundingRectangle(Geometry=group, Plane=PlaneXY(0, 0, 0), Axis=0, Slide=0, Union=True)  # -> Bounding, expr("x*1.05", DimensionX), expr("x*1.05", DimensionY)
lng = ListLength(List=flatten(python_21.flat_idx))
panel_7 = Panel(python_21.layouts)
pt = ConstructPoint(XCoordinate=20, YCoordinate=100, ZCoordinate=0)
trim_3 = TrimTree(Tree=brec.DimensionX, Depth=1)
number_slider = Slider(20, range=0..100)
trim_4 = TrimTree(Tree=brec.DimensionY, Depth=1)
path_mapper_2 = PathMapper(python_22.apt_layouts, source="{A;B;C;D;E}", target="{C;D;E}")
texttoscreen = RenderTextToScreen(Text=lng, Location=pt, Size=72, Color=ColourSwatch(SwatchColor=RGB(255, 255, 255)), m_scWithvp=False)

# ---- group: parse tiling
python_23 = GhPythonScript(layout=python_22.apt_layouts, i=trim_3, j=trim_4)  # -> out, debug, coords_rows; inputs layout: list
# ---------- python_23: Python ----------
import ghpythonlib.treehelpers as th
import math
x= []
y = []

rows = []
ratio = j/i
size = int(math.ceil(math.sqrt(len(layout)) * ratio))
#print len(layout)
print ratio

for i, v in enumerate(layout):
    
    if i % size == 0:
        rows.append([])
    rows[-1].append(v)

#th.list_to_tree(
coords_rows = th.list_to_tree(rows,source=[0,ghenv.Component.RunCount-1])

#print ghenv.Component.RunCount
#for lyo in layout:
##    print cells
#    srt = sorted(cells)
##    print srt
#    for c in srt:
#        
#        x.append(c[0])
#        y.append(c[1])
# ---------- end python_23 ----------

# ----
addition = Addition(A=trim_3, B=number_slider)
addition_2 = Addition(A=trim_4, B=number_slider)
panel_8 = Panel(python_21.out)
pt_2 = Point(<point referenced from the Rhino model>)
python_24 = GhPythonScript(layout=python_21.layouts, i=trim_3, j=trim_4)  # -> out, debug, coords_rows; inputs layout: list; same code as python_23
python_25 = GhPythonScript(rows=python_23.coords_rows, xoff=addition, yoff=addition_2, origin=pt_2)  # -> out, debug, x, y, tiles_crv; inputs rows: tree, xoff: tree, yoff: tree, origin: Plane
# ---------- python_25: Python ----------
import ghpythonlib.treehelpers as th
import gblock.elements.layout as layout
from Rhino.Geometry.Transform import PlaneToPlane
from Rhino.Geometry import Plane
reload(layout)

solutions = th.tree_to_list(rows)
xff = sum(th.tree_to_list(xoff), [])
yff = sum(th.tree_to_list(yoff), [])
#print yff
#print len(solutions)
xx = []
yy = []
crv = []
for sol, lst_rows in enumerate(solutions):
    row_col_num = [r for r in lst_rows]
    x = []
    y = []
    cr = []
    for i, row in enumerate(row_col_num):
        x.append([])
        y.append([])
        cr.append([])
        for j, col in enumerate(row):
#            print col
            cells = col.matrix.active_cells()
            aparts = row[j].space_divisions()
            cc = [[c.defCrv for c in a.active_cells()] for a in aparts]
#            debug = repr(aparts[0])
            ii = i*xff[sol]  
            jj = j* yff[sol] + (sol * yff[sol] * len(row))*1.1
            cr[-1].append(cc)
#            print (jj, ii)
            


            x[-1].append(jj)
            y[-1].append(ii)
    xx.append(x)
    yy.append(y)
    crv.append(cr)
#            
x = th.list_to_tree(xx)
y = th.list_to_tree(yy)
tiles_crv = th.list_to_tree(crv)
# ---------- end python_25 ----------
python_26 = GhPythonScript(rows=python_24.coords_rows, xoff=trim_3, yoff=trim_4)  # -> out, x, y; inputs rows: tree, xoff: tree, yoff: tree
# ---------- python_26: Python ----------
import ghpythonlib.treehelpers as th
import gblock.elements.layout as layout
reload(layout)

solutions = th.tree_to_list(rows)
xff = sum(th.tree_to_list(xoff), [])
yff = sum(th.tree_to_list(yoff), [])
print yff
xx = []
yy = []
for sol, lst_rows in enumerate(solutions):
    row_col_num = [r for r in lst_rows]
#    print len(row_col_num)
#    print row_col_num
    class Apt:
        pass
        
    x = []
    y = []
    for i, row in enumerate(row_col_num):
#        print len(row)
        x.append([])
        y.append([])
        for j, col in enumerate(row):
            
            ii = i*xff[sol]  
            jj = j* yff[sol] + (sol * yff[sol] * len(row))*1.1
            print (jj, ii)
#            print type(row_col_num[i][j])
            row_col_num[i][j].dispPadding = (jj, ii)
            xa = Apt()
            xa.data = [[v[0] for v in g] for g in row_col_num[i][j].display_coords()]
#            print xa.data
            ya = Apt()
            ya.data = [[v[1] for v in g] for g in row_col_num[i][j].display_coords()]
            x[-1].append(xa)
            y[-1].append(ya)
    xx.append(x)
    yy.append(y)
#            
x = th.list_to_tree(xx)
y = th.list_to_tree(yy)
# ---------- end python_26 ----------
panel_9 = Panel(python_25.tiles_crv)
python_27 = GhPythonScript(X=python_25.tiles_crv)  # -> Out, A
pt_3 = ConstructPoint(XCoordinate=python_25.x, YCoordinate=python_25.y, ZCoordinate=0)
pline = PolyLine(Vertices=python_25.tiles_crv, Closed=False)
python_28 = GhPythonScript(x=python_26.x)  # -> out, a
# ---------- python_28: Python ----------
import ghpythonlib.treehelpers as th
print x.data
a = x.data
# ---------- end python_28 ----------
python_29 = GhPythonScript(x=python_26.y)  # -> out, a; same code as python_28
trim_5 = TrimTree(Tree=pline, Depth=1)
python_30 = GhPythonScript(xx=python_28.a, yy=python_29.a)  # -> out, x, y
# ---------- python_30: Python ----------
import ghpythonlib.treehelpers as th

x = xx
y = yy
# ---------- end python_30 ----------
group_2 = Group(Objects=trim_5)
trim_6 = TrimTree(Tree=group_2, Depth=1)

# ---- group: generate geometry
tiling_3 = Tiling(index_x=python_30.x, index_y=python_30.y)  # -> cell_srf, cell_rect, cell_pt

# ----
group_3 = Group(Objects=trim_6)
trim_7 = TrimTree(Tree=group_3, Depth=1)
orient = Orient(Geometry=trim_7, Source=pt_2, Target=pt_3)  # -> Geometry, Transform
panel_10 = Panel(tiling_3.cell_rect)
ungroup = Ungroup(Group=orient.Geometry)
ungroup_2 = Ungroup(Group=ungroup)
data = Data(ungroup_2)
python_31 = GhPythonScript(matrix=python_21.layouts)  # -> out, unique; inputs matrix: list
# ---------- python_31: Python ----------
import ghpythonlib.treehelpers as th

d= [[(i, j) for j in range(3)] for i in range(3)]
dim = []
for r in d:
    for v in r:
        dim.append(v)
        
#print dim

def unq(a, b):
    minx = min([v[0] for v in b])
    miny = min([v[1] for v in b])
    maxy = max([v[1]-miny for v in b])
    
#    s = set(a) ^ set(b)
    s = list(b)
#    sm = [(x-minx)+(y-miny) for (x,y) in s]
    sm = [(x-minx)+(y-miny)+(s[-1][0]-minx)+(s[0][1]-miny) for (x,y) in s]
    return sum(sm)

col = []
for mtx in matrix:
    col.append([])
    for g in mtx.aptGroups:
        col[-1].append(unq(dim, g))

unique = th.list_to_tree(col)
# ---------- end python_31 ----------
color = Color(data_in=data)
runion = RegionUnion(Curves=data)
pcwraplist = WrapList(Items=python_31.unique, LastSaveLocalization="neutral,N")  # -> flatten(AtomList)
tstat = TreeStatistics(Tree=python_23.coords_rows)  # -> Paths, Length, Count
cluster = Cluster_2(G=data)
boundary = BoundarySurfaces(Edges=runion)
extremums = MinMax(Number=flatten(python_31.unique))  # -> Minimum, Maximum
partition = PartitionList(List=pcwraplist, Size=tstat.Length)
cluster_2 = Cluster(G=data)
data_2 = Data(cluster)
bnd = Bounds(Numbers=flatten(python_31.unique))
number_slider_2 = Slider(0.211, range=0..1)
pcunwraplist = UnwrapList(AtomList=partition, LastSaveLocalization="neutral,N")
dom = ConstructDomain(DomainStart=Slider(0.125, range=0..1), DomainEnd=Slider(1, range=0..1))
addition_3 = Addition(A=data_2, B=ColourSwatch(SwatchColor=RGB(150, 150, 150)))
col = Colour(data_2)
remap = RemapNumbers(Value=pcunwraplist, Source=bnd, Target=dom)  # -> graft(Mapped), Clipped
graph = GraphMapper(
    remap.Mapped,
    x0=0,
    x1=1,
    y0=0,
    y1=1,
    container_name="Bezier",
    cpx=[0, 0.3714369535, 0.6646251082, 1],
    cpy=[0, 0.5249854922, 0.8223620653, 1])
previewlw = CustomPreviewLineweights(
    Geometry=simplify(runion),
    Shader=simplify(ColourSwatch(SwatchColor=RGBA(0, 0, 0, 212))),
    Thickness=Slider(2, range=0..10),
    Absolute=False)
previewlw_2 = CustomPreviewLineweights(Geometry=simplify(data), Shader=simplify(addition_3), Thickness=Slider(1.28, range=0..10), Absolute=False)
hsv = ColourHSV(Alpha=1, Hue=graph, Saturation=Slider(0.742, range=0..1), Value=Slider(0.991, range=0..1))
addition_4 = Addition(A=hsv, B=ColourSwatch(SwatchColor=RGB(150, 150, 150)))
previewlw_3 = CustomPreviewLineweights(Geometry=simplify(data), Shader=simplify(addition_4), Thickness=Slider(1.7, range=0..10), Absolute=False)
previewmat = CustomPreviewMaterials(Geometry=boundary, DiffuseColor=hsv, Transparency=Slider(0, range=0..10))
number_slider_3 = Slider(0.625, range=0..1)
multiplication = Multiplication(A=dim.UDimension, B=2)  # disabled
X = UnitX(Factor=multiplication)  # disabled
move = Move(Geometry=tiling.cell_rect, Motion=X)  # -> Geometry, Transform; disabled

# ---- group: custom display
display = Display(geo_to_viz=move.Geometry)  # disabled

display_2 = Display(geo_to_viz=tiling_2.cell_rect)  # disabled

# ----
pcwraplist_2 = WrapList(LastSaveLocalization="neutral,N")  # disabled
group_4 = Group()  # disabled
pcwraplist_3 = WrapList(LastSaveLocalization="neutral,N")  # disabled
group_5 = Group()  # disabled
group_6 = Group(Objects=[group_5, group_4])  # disabled
tstat_2 = TreeStatistics(Tree=group_6)  # -> Paths, Length, Count; disabled
sqrt = SquareRoot(Value=tstat_2.Count)  # disabled
round = Round(Number=sqrt)  # -> Nearest, Floor, Ceiling; disabled
number_slider_4 = Slider(5.36, range=0..10)  # disabled
partition_2 = PartitionList(List=flatten(group_6), Size=round.Ceiling)  # -> simplify(Chunks); disabled
number_slider_5 = Slider(5.36, range=0..10)  # disabled
partition_3 = PartitionList(List=flatten(pcwraplist_2), Size=round.Ceiling)  # -> simplify(Chunks); disabled
partition_4 = PartitionList(List=flatten(pcwraplist_3), Size=round.Ceiling)  # -> simplify(Chunks); disabled
pcunwraplist_2 = UnwrapList(AtomList=partition_4, LastSaveLocalization="neutral,N")  # disabled
pcunwraplist_3 = UnwrapList(AtomList=partition_3, LastSaveLocalization="neutral,N")  # disabled
tstat_3 = TreeStatistics(Tree=pcunwraplist_3)  # -> Paths, Length, Count; disabled
dup = DuplicateData(Data=tstat_3.Count, Number=tstat_3.Length, Order=True)  # disabled
series = Series(Start=1, Step=number_slider_4, Count=tstat_3.Count)  # -> simplify(graft(Series)); disabled
series_2 = Series(Start=1, Step=number_slider_5, Count=tstat_3.Length)  # -> simplify(Series); disabled
tstat_4 = TreeStatistics(Tree=pcunwraplist_3)  # -> Paths, Length, Count; disabled
dup_2 = DuplicateData(Data=series, Number=tstat_3.Length, Order=True)  # disabled
addition_5 = Addition(A=pcunwraplist_3, B=series_2)  # disabled
addition_6 = Addition(A=pcunwraplist_2, B=series)  # disabled
trim_8 = TrimTree(Tree=pcunwraplist_3, Depth=1)  # disabled
pt_4 = ConstructPoint(XCoordinate=addition_5, YCoordinate=addition_6, ZCoordinate=0)  # disabled
viewer = ParamViewer(series_2)  # disabled

# ==== cluster Tiling
index_y = ClusterInput()  # index Y
index_x = ClusterInput()  # index X
data = Data(Slider(1, range=0..2))
Y = Data(index_y)
X = Data(index_x)
ghpython_script = GhPythonScript(x=Y, c=data)  # -> a
# ---------- ghpython_script: Python ----------
# -*- coding: utf-8 -*-
"""
@author: prslvtsv
"""
###############################################################
#import ghdev.devcon as dev
#reload(dev)
#
#dev.init_dev_tools(locals(),  config=dev_options, verbose=True)
###############################################################


a = x*c
# ---------- end ghpython_script ----------
ghpython_script_2 = GhPythonScript(x=X, c=data)  # -> a; same code as ghpython_script
ghpython_script_3 = GhPythonScript(x=X, c=data)  # -> a
# ---------- ghpython_script_3: Python ----------
# -*- coding: utf-8 -*-
"""
@author: prslvtsv
"""
###############################################################
#import ghdev.devcon as dev
#reload(dev)
#
#dev.init_dev_tools(locals(),  config=dev_options, verbose=True)
###############################################################


a = x*c + c
# ---------- end ghpython_script_3 ----------
ghpython_script_4 = GhPythonScript(x=Y, c=data)  # -> a; same code as ghpython_script_3
pt = ConstructPoint(XCoordinate=ghpython_script_2, YCoordinate=ghpython_script, ZCoordinate=0)
pt_2 = ConstructPoint(XCoordinate=ghpython_script_3, YCoordinate=ghpython_script_4, ZCoordinate=0)
rec_2pt = Rectangle2Pt(Plane=PlaneXY(0, 0, 0), PointA=pt, PointB=pt_2, Radius=0)  # -> Rectangle, Length
pcen = PolygonCenter(Polyline=rec_2pt.Rectangle)  # -> CenterV, CenterE, CenterA
boundary = BoundarySurfaces(Edges=rec_2pt.Rectangle)
viewer = ParamViewer(boundary)
item = ListItem(List=viewer, Index=Slider(0, range=0..10), Wrap=True)
branch = TreeBranch(Tree=rec_2pt.Rectangle, Path=item, MaintainPaths=True)
cell_srf = ClusterOutput(boundary)  # cell_srf
cell_rect = ClusterOutput(rec_2pt.Rectangle)  # cell_rect
cell_pt = ClusterOutput(pcen.CenterV)  # cell_pt
boundary_2 = BoundarySurfaces(Edges=branch)

# ==== cluster Display
geo_to_viz = ClusterInput()
data = Data(geo_to_viz)
color = Color(data_in=data)
runion = RegionUnion(Curves=data)
boundary = BoundarySurfaces(Edges=runion)
addition = Addition(A=color, B=ColourSwatch(SwatchColor=RGB(150, 150, 150)))
preview = CustomPreview(Geometry=simplify(boundary), Material=simplify(color))
previewlw = CustomPreviewLineweights(
    Geometry=simplify(runion),
    Shader=simplify(ColourSwatch(SwatchColor=RGBA(0, 0, 0, 212))),
    Thickness=Slider(2, range=0..10),
    Absolute=False)
previewlw_2 = CustomPreviewLineweights(Geometry=simplify(data), Shader=simplify(addition), Thickness=Slider(0, range=0..10), Absolute=False)
previewmat = CustomPreviewMaterials(Geometry=boundary, DiffuseColor=color, Transparency=Slider(0.197, range=0..1))
createhatch = CreateHatch(Bake=False, Curves=runion, HatchPatternName="Hatch1", HatchScale=0.8, HatchRotation=45)  # -> HatchGeometry, HatchObjects
number_slider = Slider(0.625, range=0..1)
preview_2 = CustomPreview(Geometry=simplify(createhatch.HatchGeometry), Material=simplify(color))

# ==== cluster Disp
geo_to_viz = ClusterInput()
data = Data(geo_to_viz)
color = Color(data_in=data)
runion = RegionUnion(Curves=data)
boundary = BoundarySurfaces(Edges=runion)
addition = Addition(A=color, B=ColourSwatch(SwatchColor=RGB(150, 150, 150)))
preview = CustomPreview(Geometry=simplify(boundary), Material=simplify(color))
previewlw = CustomPreviewLineweights(
    Geometry=simplify(runion),
    Shader=simplify(ColourSwatch(SwatchColor=RGBA(0, 0, 0, 212))),
    Thickness=Slider(2, range=0..10),
    Absolute=False)
previewlw_2 = CustomPreviewLineweights(Geometry=simplify(data), Shader=simplify(addition), Thickness=Slider(1.7, range=0..10), Absolute=False)
previewmat = CustomPreviewMaterials(Geometry=boundary, DiffuseColor=color, Transparency=Slider(0.211, range=0..1))
createhatch = CreateHatch(Bake=False, Curves=runion, HatchPatternName="Hatch1", HatchScale=0.8, HatchRotation=45)  # -> HatchGeometry, HatchObjects
number_slider = Slider(0.625, range=0..1)
preview_2 = CustomPreview(Geometry=simplify(createhatch.HatchGeometry), Material=simplify(color))

# ==== cluster Disp_2
data = ClusterInput()

# ---- group: display point groups
data_2 = Data(data)
tstat = TreeStatistics(Tree=data_2)  # -> Paths, Length, Count
txt = Text(tstat.Length)
txt_2 = Text(tstat.Paths)
pt = ConstructPoint(XCoordinate="0.2", YCoordinate="0.1", ZCoordinate="0.2")
concat = Concatenate(FragmentA=txt_2, FragmentB=txt)
cpreview = PreviewClasses(Geometry=data_2, Name=concat, Position=pt, Size=12, Seed=123)

# ==== cluster D
xy = ClusterInput()
x_y = GhPythonScript(xy=xy)  # -> x, y; inputs xy: list
# ---------- x_y: Python ----------
x = [a[0] for a in xy]
y = [a[1] for a in xy]
# ---------- end x_y ----------
pt = ConstructPoint(XCoordinate=x_y.x, YCoordinate=x_y.y, ZCoordinate=0)

# ---- group: compute tile rectangle
rec = Rec(p=pt)

# ----
R = ClusterOutput(rec)

# ---- group: compute label pt
pt_2 = Pt(C=rec)

# ----
T = ClusterOutput(pt_2)

# ==== cluster Cluster
G = ClusterInput()
area = Area(Geometry=G)  # -> Area, Centroid
ma = MassAddition(Input=area.Area)  # -> Result, PartialResults
data = Data(ma.Result)
bnd = Bounds(Numbers=flatten(data))
dom = ConstructDomain(DomainStart=Slider(0.182, range=0..1), DomainEnd=Slider(1, range=0..1))
remap = RemapNumbers(Value=data, Source=bnd, Target=dom)  # -> Mapped, Clipped
graph = GraphMapper(
    remap.Mapped,
    x0=0,
    x1=1,
    y0=0,
    y1=1,
    container_name="Bezier",
    cpx=[0, 0.3469126225, 0.6804535389, 1],
    cpy=[0, 0.2965884209, 0.7558469772, 1])
hsv = ColourHSV(Alpha=1, Hue=graph, Saturation=1, Value=1)
data_2 = Data(hsv)
data_3 = ClusterOutput(data_2)

# ==== cluster Cluster_2
G = ClusterInput()
area = Area(Geometry=G)  # -> Area, Centroid
ma = MassAddition(Input=area.Area)  # -> Result, PartialResults
data = Data(ma.Result)
bnd = Bounds(Numbers=flatten(data))
dom = ConstructDomain(DomainStart=Slider(0.182, range=0..1), DomainEnd=Slider(1, range=0..1))
remap = RemapNumbers(Value=data, Source=bnd, Target=dom)  # -> Mapped, Clipped
graph = GraphMapper(
    remap.Mapped,
    x0=0,
    x1=1,
    y0=0,
    y1=1,
    container_name="Bezier",
    cpx=[0, 0.3469126225, 0.6804535389, 1],
    cpy=[0, 0.2965884209, 0.7558469772, 1])
hsv = ColourHSV(Alpha=1, Hue=remap.Mapped, Saturation=1, Value=1)
data_2 = Data(hsv)
data_3 = ClusterOutput(data_2)

# ==== cluster Color
data_in = ClusterInput()  # data_in
dom = ConstructDomain(DomainStart=Slider(0.168, range=0..1), DomainEnd=Slider(0.922, range=0..1))
tstat = TreeStatistics(Tree=data_in)  # -> Paths, Length, Count
bbox = BoundingBox(Content=data_in, Plane=PlaneXY(0, 0, 0), UnionBox=True)  # -> Box, Box_2
extremums = MinMax(Number=tstat.Length)  # -> Minimum, Maximum
range = Range(Domain=dom, Steps=expr("x-1", tstat.Length))
dim = Dimensions(Surface=bbox.Box)  # -> UDimension, VDimension
area = Area(Geometry=bbox.Box)  # -> Area, Centroid
pcshuffle = Shuffle(List=range, Seed=Slider(1, range=0..1), LastSaveLocalization="neutral,N")
extremums_2 = MinMax(Number=flatten(dim.UDimension))  # -> Minimum, Maximum
wheel = ColourWheel(
    extremums_2.Maximum,
    ColourGrips_Style=10,
    ColourGrips_Grip=[5.115610268, 3.821325235, 1.989214472, 5.130807126],
    ColourGrips_Lum=[0.1, 1],
    ColourGrips_Range=[0.5123760279, 0.5123760279, 0.5123760279, 0.5123760279],
    ColourGrips_Sat=[0.2, 1])
addition = Addition(A=dim.UDimension, B=area.Area)
hsv = ColourHSV(Alpha=1, Hue=pcshuffle, Saturation=1, Value=1)
subtraction = Subtraction(A=dim.UDimension, B=extremums_2.Minimum)
hsl = ColourHSL(Alpha=0.7, Hue=pcshuffle, Saturation=1, Luminance=Slider(0.247, range=0..1))
data = Data(graft(wheel))
data_2 = Data(simplify(graft(hsv)))
item = ListItem(List=hsv, Index=subtraction, Wrap=True)  # -> simplify(Item)
panel = Panel(dim.UDimension)
addition_2 = Addition(A=data_2, B=item)
division = Division(A=addition_2, B=2)
panel_2 = Panel(division)
color_out = ClusterOutput(item)  # color_out

# ==== cluster Rec
p = ClusterInput()  # p
pdecon = Deconstruct(Point=p)  # -> XComponent, YComponent, ZComponent
data = Data(Slider(1, range=0..1))
number_slider = Slider(2, range=0..10)
ghpython_script = GhPythonScript(x=pdecon.XComponent, c=data)  # -> a; same code as ghpython_script_3
ghpython_script_2 = GhPythonScript(x=pdecon.YComponent, c=data)  # -> a; same code as ghpython_script
ghpython_script_3 = GhPythonScript(x=pdecon.XComponent, c=data)  # -> a; same code as ghpython_script
addition = Addition(A=ghpython_script_3, B=ghpython_script)
ghpython_script_4 = GhPythonScript(x=pdecon.YComponent, c=data)  # -> a; same code as ghpython_script_3
addition_2 = Addition(A=ghpython_script_2, B=ghpython_script_4)
subtraction = Subtraction(A=ghpython_script_2, B=ghpython_script_4)
subtraction_2 = Subtraction(A=ghpython_script_3, B=ghpython_script)
pt = ConstructPoint(XCoordinate=ghpython_script_3, YCoordinate=ghpython_script_2, ZCoordinate=0)
pt_2 = ConstructPoint(XCoordinate=ghpython_script, YCoordinate=ghpython_script_4, ZCoordinate=0)
division = Division(A=subtraction_2, B=number_slider)
division_2 = Division(A=subtraction, B=number_slider)
rec_2pt = Rectangle2Pt(Plane=PlaneXY(0, 0, 0), PointA=pt, PointB=pt_2, Radius=0)  # -> Rectangle, Length
vec = VectorXYZ(XComponent=division, YComponent=division_2, ZComponent=0)  # -> Vector, Length
move = Move(Geometry=rec_2pt.Rectangle, Motion=vec.Vector)  # -> Geometry, Transform
pcen = PolygonCenter(Polyline=move.Geometry)  # -> CenterV, CenterE, CenterA
boundary = BoundarySurfaces(Edges=move.Geometry)
G = ClusterOutput(move.Geometry)

# ==== cluster Pt
C = ClusterInput()
cpoly = ControlPolygon(Curve=C)  # -> Polygon, Points
item = ListItem(List=cpoly.Points, Index=[0, 1, 3], Wrap=True)
ma = MassAddition(Input=item)  # -> Result, PartialResults
division = Division(A=ma.Result, B=3)
trim = TrimTree(Tree=division, Depth=1)
T = ClusterOutput(trim)
