# Grasshopper definition SEC_[tool]_AptSolver_wip_GB.gh (Grasshopper 1.0.7)
# Copyright: prslvtsv
# plug-ins: Telepathy, Human, Pufferfish

# ---- group: PARAMETERS - replace with your pathes
# C:\Windows\System32\WindowsPowerShell\v1.0\powershell.exe -ExecutionPolicy ByPass -NoExit -Command "& 'C:\ProgramData\Anaconda3\shell\condabin\conda-hook.ps1' ; conda activate 'C:\ProgramData\Anaconda3' "
conda_base_env = Panel("\"C:\\ProgramData\\Anaconda3\\shell\\condabin\\conda-hook.ps1; conda activate C:\\ProgramData\\Anaconda3;\"")
# "C:\ProgramData\Anaconda3\shell\condabin\conda-hook.ps1; conda activate C:\ProgramData\Anaconda3\envs\exc43;"
power_shell_as_executable = Panel("C:\Windows\System32\WindowsPowerShell\v1.0\powershell.exe")
solver_script = Panel("C:\Users\grbal\workspace\aective\sections_dataset_generator\apart_solver.py")
shell_executable = RemoteSender(power_shell_as_executable)
conda_activate = RemoteSender(conda_base_env)
solver_script_2 = RemoteSender(solver_script)

# ---- group: read geometry inside frames / get selection frames
pipeline = GeometryPipeline(
    GroupByLayer=False,
    GroupByType=False,
    IncludeHidden=False,
    IncludeLocked=False,
    LayerFilter="Floors_gen::frames",
    NameFilter="*",
    SublayerFiltering=True,
    TypeFilter=5)

# ---- group: read attributes from py
list = ValueList({"floor", "floor_user"}, selected="floor_user")
python = GhPythonScript(setName=list)  # -> out, attrib_names, attrib_dims, attrib_obj, mapping_dict
# ---------- python: Python ----------
# -*- coding: utf-8 -*-
"""
@author: prslvtsv
"""
import scriptcontext as sc
import gblock.gh_context.gh_context as context
import gblock.core as core
reload(context)

################################################################################
## CONTEXT CREATOR BELOW | ADDS DEV METODS TO COMPONENT 
## SEE GH_CONTEXT\CONTEXT_GENERAL.TXT FOR DETAILS
################################################################################
#exec(compile(''.join(context.init()), 'init', 'exec'), locals())
################################################################################
import collections 
core.StateContainer.init_attributes()
 
attr_list = core.StateContainer.get_all_attr(setName).values()

names = list([a.name for a in attr_list])
dims = []



def map_addresses(attributes):
    mapping = collections.OrderedDict()
    for n, obj in enumerate(attributes):
        #print n
    
        name = obj.name
        mapping[name] = {}
        mapping[name]['pos'] = n
        
        for o, opt in enumerate(obj.options):
            mapping[name]['range'] = slice(None)
            mapping[name][opt.value] = o
    sc.sticky['attributes_mapping'] = mapping
    return mapping

for n in attr_list:

    n.valuenow = 0
    if n in 'distribution' or n in 'length':
        dims.append(1)
    else:
        dims.append(n.count_options())
print dims
###  sorting
#dims = list(dims)
#print dims

indx = [i[0] for i in  sorted(zip(range(len(attr_list)), dims), reverse=True, key=lambda c: c[1])]
print indx
#indx = (-dims).argsort()



################
# manuallty push distr & length to end
dis = 3
dp = 8
len = 8
lp = 10
indx[lp] = 10
indx[dp] = 9
indx[11] = len
indx[12] = dis
indx[0] = 10
indx[10] = 11
#print indx

dims = [dims[i] for i in indx]
#print names
names = [names[i] for i in indx]
print names

attrib_names = [n for n in names]
attrib_dims = [n for n in dims]
attrib_obj =[attr_list[i] for i in indx]


mapping_dict = [map_addresses(attrib_obj)]

sc.sticky['attrib_names'] = attrib_names
sc.sticky['attrib_dims'] = attrib_dims
sc.sticky['attrib_obj'] = attr_list

#print names
#print dims
#print indx
# ---------- end python ----------

# ---- group: read geometry inside frames
id = Guid(pipeline)
read_floor = GhPythonScript(guid=id)  # -> out, tiles_geo, ref_geo, origin_pt, attr_txt, other_geo; inputs autoUpdate: Boolean
# ---------- read_floor: Python ----------
# -*- coding: utf-8 -*-
"""
@author: prslvtsv
"""
import scriptcontext as sc
import gblock.ghhelp as ghh
reload (ghh)
#import gblock.gh_context.gh_context as context
#reload(context)
#
################################################################################
## CONTEXT CREATOR BELOW | ADDS DEV METODS TO COMPONENT 
## SEE GH_CONTEXT\CONTEXT_GENERAL.TXT FOR DETAILS
################################################################################
##print context.init()[4]
#_verbose_init = False
#try:
#    exec(compile(context.init()[4], 'init', 'exec'), locals())
#except:
#    ghenv.Component.ExpireSolution(True)
################################################################################

#from Rhino.Geometry import Point3d, Point, Curve, Polyline, PolylineCurve
from Rhino.DocObjects import CurveObject, TextObject, PointObject
import copy

tiles_geo  = []
ref_geo = []
attr_txt = []
other_geo = []
origin_pt = []
def read_guid_data():

    geo, layer = ghh.Helper.get_obj_by_region(guid)
    

    
    for i in range(len(geo)):
    
        g = ghh.Helper.get_by_id_obj(geo[i])
        g.UserDictionary.Clear()
        state_name = layer[i].split('::')[-1]
        group_name = layer[i].split('::')[-2]
        g.UserDictionary.Set('state', state_name)
        g.UserDictionary.Set('group', group_name)
            
        if isinstance(g, CurveObject):
           
            if group_name == 'tiles':
                tiles_geo.append(g)
            elif group_name == 'refgeo':
                ref_geo.append(g)
            else:
                print 'unsorted curve ', group_name, ' ', state_name
    
        elif isinstance(g, PointObject):
            if state_name == 'origin':
                origin_pt.append(g)
            else:
                print 'unsorted point ', group_name, ' ', state_name
            # print'point'
        elif isinstance(g, TextObject):
            if state_name in 'attrib_txt':
                for st in g.DisplayText.splitlines():
                    attr_txt.append(st)
                    
            else:
                print type(g)
                print 'unsorted text ',  state_name
        else:
            print 'unsorted geometry ', group_name, ' ', state_name
#            other_geo.append(g)

ghenv.Component.Params.Input[1].Optional = True
if not ghenv.Component.Params.Input[1].VolatileData.IsEmpty:
    try:
        read_guid_data()
    except:
        print 'reading failed'
#        ghenv.Component.ExpireSolution(True)
else:
#    ghenv.Component.AddRuntimeMessage(runtimeMessage.Warning, 'input data is missing')
    print 'no objects'
# ---------- end read_floor ----------

# ----
origin_point__point_object = RemoteSender(read_floor.origin_pt)
list_2 = ValueList({"corridor", "custom", "fixed", "free", "llu"}, selected=["corridor", "custom", "fixed", "free", "llu"])

# ---- group: get geo by state user data
py = GhPythonScript(obj=read_floor.tiles_geo, user_data_key="state", user_data_val=list_2)  # -> out, geo, user_data; inputs obj: list, user_data_val: list
# ---------- py: Python ----------
# -*- coding: utf-8 -*-
"""
@author: prslvtsv
"""
import scriptcontext as sc
import Grasshopper.Kernel.GH_RuntimeMessageLevel as runtimeMessage


geo = []
user_data = []

for o in obj:
    if o == None:
        geo = None
        user_data = None
    else:
        uVal = o.UserDictionary.GetString(user_data_key)
        for udv in user_data_val:
            if uVal== udv:
                geo.append(o.Geometry)
                user_data.append(uVal)
            elif not udv:
                geo.append(o.Geometry)
                user_data.append(uVal)
# ---------- end py ----------

# ---- group: arrange read attributes / modify floor state val
replace_val = GhPythonScript(attr_glob=python.attrib_obj, floor_read=read_floor.attr_txt)  # -> out, attr_out; inputs attr_glob: list, floor_read: list
# ---------- replace_val: Python ----------
# -*- coding: utf-8 -*-
"""
@author: prslvtsv
"""
import scriptcontext as sc
import gblock.gh_context.gh_context as context
import gblock.core as core
import copy
reload(context)

################################################################################
## CONTEXT CREATOR BELOW | ADDS DEV METODS TO COMPONENT 
## SEE GH_CONTEXT\CONTEXT_GENERAL.TXT FOR DETAILS
################################################################################
#_verbose_init = False
#exec(compile(''.join(context.init()), 'init', 'exec'), locals())
################################################################################



# print attr_dict

replaced = [core.att.Attribute().assign(a) for a in attr_glob]
#print replaced[0].name
try:
    for fl in floor_read:
    
        name, value = fl.split(':')
        print name, value
        i = sc.sticky['attrib_names'].index(name)
        if name in 'groundFloorAccess':
            if value in 'n/a':
                value = 'undefined'
        replaced[i].valuenow = str(value)
#        print replaced[i].valuenow
    #replaced[sc.sticky['attrib_names'].index('distribution')]
    attr_out = replaced
    #
    #print replaced
    #print replaced.shape()
except:
    print 'BYPASSED'
    print 'no data to work with'
    attr_out = replaced
# ---------- end replace_val ----------

# ---- group: arrange read attributes
ghpython_script = GhPythonScript(attr_loc=replace_val.attr_out)  # -> out, name_val; inputs attr_loc: list
# ---------- ghpython_script: Python ----------
# -*- coding: utf-8 -*-
"""
@author: prslvtsv
"""
import scriptcontext as sc
import gblock.gh_context.gh_context as context
reload(context)

################################################################################
## CONTEXT CREATOR BELOW | ADDS DEV METODS TO COMPONENT 
## SEE GH_CONTEXT\CONTEXT_GENERAL.TXT FOR DETAILS
################################################################################
#autoUpdate = False
#exec(compile(''.join(context.init()), 'init', 'exec'), locals())
################################################################################

name_val = []

for a in attr_loc:
    name_val.append('{}:{}'.format(a.name, a.valuenow))
# ---------- end ghpython_script ----------
panel = Panel(ghpython_script.name_val)

# ----
python_2 = GhPythonScript(crv=py.geo, state=py.user_data)  # -> out, combined; inputs crv: list of Polyline, state: list
# ---------- python_2: Python ----------
# -*- coding: utf-8 -*-
"""
@author: prslvtsv
"""
###############################################################
#import ghdev.devcon as dev
#reload(dev)
#
#dev.init_dev_tools(locals(),  config=dev_options, verbose=True)
###############################################################

combined = list(zip(crv, state))
# ---------- end python_2 ----------

# ---- group: index from neigbour curves (trees)
python_3 = GhPythonScript(crv=py.geo)  # -> indexes, curves; inputs crv: list of Polyline
# ---------- python_3: Python ----------
## -*- coding: utf-8 -*-
#"""
#@author: prslvtsv
#"""
###############################################################
#import ghdev.devcon as dev
#reload(dev)
#
#dev.init_dev_tools(locals(),  config=dev_options, verbose=True)
###############################################################

import ghpythonlib.treehelpers as th
from  Rhino.Geometry import Point3d
from collections import OrderedDict as oddict
import gblock.ghhelp as ghh
import gh_components_script.gh_points2matrix as p2m
reload(p2m)
reload(ghh)

def crv2points(crv):
    poly = [c.ToArray() for c in crv]
    # remove 5th point 
    pt = [[p for p in pl][:-1] for pl in poly]
    return pt

def orient_poly_points(pt):
    pl_pts = []
    for pt in pt:
        pl_pts.append( [Point3d(x, y, 0) for (x, y) in p2m.sort_pt_xy(pt)])
    return pl_pts  

def xy2ij(points):
    xx, yy = [p.X for p in points], [p.Y for p in points]
    unique_x= sorted(list(set([round(x) for x in xx])))
    unique_y = sorted(list(set([round(y) for y in yy])))
    i = [unique_x.index(round(xp)) for xp in xx]
    j = [unique_y.index(round(yp)) for yp in yy]
    print list(zip(ix, jy))
    return list(zip(ix, jy))
    
def corners2index(corners):
    leftLow = [a[0] for a in corners]
    xll = [p.X for p in leftLow]
    unique_x= sorted(list(set([round(x) for x in xll])))
    ix = [unique_x.index(round(xp)) for xp in xll]
    
    rightTop = [a[2] for a in corners]
    yrt = [p.Y for p in rightTop]
    unique_y = sorted(list(set([round(y) for y in yrt])))
    jy = [unique_y.index(round(yp)) for yp in yrt]


    print list(zip(ix, jy))
    return list(zip(ix, jy))

pts = crv2points(crv)
sorted_corners = orient_poly_points(pts)
indx = corners2index(sorted_corners)

#print sorted_corners
indexes = indx
curves = [c for c in crv]
# ---------- end python_3 ----------

# ----
floor_attr_obj = RemoteSender(replace_val.attr_out)
floor_read_attr = RemoteSender(ghpython_script.name_val)
pipeline_2 = GeometryPipeline(
    GroupByLayer=False,
    GroupByType=False,
    IncludeHidden=False,
    IncludeLocked=False,
    LayerFilter="apartments::possible",
    NameFilter="*",
    SublayerFiltering=True,
    TypeFilter=1)

# ---- group: state matrix from indexes
python_4 = GhPythonScript(indexes=python_3.indexes, opt_data=python_2.combined)  # -> out, matrix, cells; inputs indexes: list, opt_data: list
# ---------- python_4: Python ----------
# -*- coding: utf-8 -*-
"""
@author: prslvtsv
"""
###############################################################
#import ghdev.devcon as dev
#reload(dev)
#
#dev.init_dev_tools(locals(),  config=dev_options, verbose=True)
###############################################################
import gblock.elements.matrix as mtx
reload(mtx)


matrix = mtx.SpacialMatrix().from_indexes(indexes, data=opt_data)
cells = matrix.active_indexes()
print cells
# ---------- end python_4 ----------

# ----
pcen = PolygonCenter(Polyline=python_3.curves)  # -> CenterV, CenterE, CenterA
pgroups = PointGroups(Points=pipeline_2, Distance=Slider(2.5, range=0..10))  # -> Groups, Indices

# ---- group: display point groups
disp = Disp_2(data=pgroups.Groups)

# ----
tag = TextTag(Location=pcen.CenterV, Text=python_3.indexes)

# ---- group: separate floors tiles & handle corridor conditions
python_5 = GhPythonScript(matrix=python_4.matrix)  # -> out, mtx_full, cells_all, cells_pub, cells_res, cells_to_tile
# ---------- python_5: Python ----------
# -*- coding: utf-8 -*-
"""
@author: prslvtsv
"""
###############################################################
#import ghdev.devcon as dev
#reload(dev)
#
#dev.init_dev_tools(locals(),  config=dev_options, verbose=True)
###############################################################
import gblock.elements.matrix as mtx
reload(mtx)


mtx_full = matrix
res = [m for m in matrix.active_cells() if m.data[1] not in ("llu", "corridor")]
pub = [m for m in matrix.active_cells() if m.data[1] in ("llu", "corridor")]
corridor = [m for m in matrix.active_cells() if m.data[1] in "corridor"]

# handle corridor end conditions
endStates = []
for s in range(1,3):
    for e in range(1,3):
        endStates.append(corridor[:s]+corridor[-e:])
print [[es.index() for es in ess ]for ess in endStates]

# currently - use only most full option
tile = [res + es for es in endStates]

cells_pub = pub
cells_res = res
cells_to_tile = tile
cells_all = matrix.active_cells()
# ---------- end python_5 ----------

# ---- group: points to indexes
indx = GhPythonScript(points=pgroups.Groups)  # -> out, indexes, pt, xy; inputs points: list of Point3d
# ---------- indx: Python ----------
import gblock.ghhelp as ghh
reload(ghh)
import gh_components_script.gh_points2matrix as p2m
reload(p2m)

indexes = ghh.xy2ij(points)
xy = p2m.points2matrix_xy(points)
pt = points
# ---------- end indx ----------

# ----
cells_to_tile = RemoteSender(python_5.cells_to_tile)

# ---- group: display_block / copute things for display
d = D(xy=indx.xy)  # -> R, T

# ---- group: display_block
screentext = ScreenOrientedText(
    Text=indx.indexes,
    Font="Arial",
    Justification=2,
    Location=d.T,
    SizeFactor=Slider(0.173, range=0..2),
    Color=RGB(255, 255, 255),
    Depth=0,
    Absolute=True)

# ----
floor_matrix_data_crv_state = RemoteSender(python_4.matrix)
til = GhPythonScript(tiling_options=python_5.cells_to_tile)  # -> cells
# ---------- til: Python ----------
# -*- coding: utf-8 -*-
"""
@author: prslvtsv
"""
###############################################################
#import ghdev.devcon as dev
#reload(dev)
#
#dev.init_dev_tools(locals(),  config=dev_options, verbose=True)
###############################################################
cells = tiling_options
# ---------- end til ----------

# ---- group: display_block / display cells tiles
disp_2 = Disp(geo_to_viz=d.R)

# ----
til_2 = GhPythonScript(tiling_options=python_5.cells_to_tile)  # -> cells; same code as til

# ---- group: create from indexes
python_6 = GhPythonScript(indexes=indx.indexes)  # -> out, matrix, cells; inputs indexes: list
# ---------- python_6: Python ----------
# -*- coding: utf-8 -*-
"""
@author: prslvtsv
"""
###############################################################
#import ghdev.devcon as dev
#reload(dev)
#
#dev.init_dev_tools(locals(),  config=dev_options, verbose=True)
###############################################################
import gblock.elements.matrix as mtx
reload(mtx)


matrix = mtx.SpacialMatrix().from_indexes(indexes, data="cell")
cells = matrix.active_indexes()
# ---------- end python_6 ----------

# ----
expl = GhPythonScript(cells=til)  # -> indexes, crv, state; inputs cells: list
# ---------- expl: Python ----------
# -*- coding: utf-8 -*-
"""
@author: prslvtsv
"""
###############################################################
#import ghdev.devcon as dev
#reload(dev)
#
#dev.init_dev_tools(locals(),  config=dev_options, verbose=True)
###############################################################
import gblock.elements.matrix as mtx
reload(mtx)


indexes = [c.index() for c in cells]
crv = [c.data[0] for c in cells]
state = [c.data[1] for c in cells]
# ---------- end expl ----------
expl_2 = GhPythonScript(cells=til_2)  # -> indexes, crv, state; inputs cells: list; same code as expl
expl_3 = GhPythonScript(cells=python_5.cells_all)  # -> indexes, crv, state; inputs cells: list; same code as expl
python_7 = GhPythonScript(indexes=expl.indexes)  # -> out, matrix, cells; inputs indexes: list; same code as python_6
str = GhPythonScript(idx_list=python_6.cells)  # -> flatten(set_string); inputs idx_list: list
# ---------- str: Python ----------
set_string = "[" + ", ".join("({}, {})".format(x, y) for (x, y) in idx_list) + "]"
# ---------- end str ----------
python_8 = GhPythonScript(indexes=expl_2.indexes)  # -> out, matrix, cells; inputs indexes: list; same code as python_6
python_9 = GhPythonScript(matrix=python_6.matrix)  # -> out, representation, cells_indx
# ---------- python_9: Python ----------
# -*- coding: utf-8 -*-
"""
@author: prslvtsv
"""
###############################################################
#import ghdev.devcon as dev
#reload(dev)
#
#dev.init_dev_tools(locals(),  config=dev_options, verbose=True)
###############################################################
import gblock.elements.matrix as mtx
reload(mtx)


representation = matrix.__repr__()
cells_indx = matrix.active_indexes()
# ---------- end python_9 ----------
python_10 = GhPythonScript(matrix=python_8.matrix)  # -> out, representation, cells_indx; same code as python_9
matrix_to_tile = RemoteSender(python_8.matrix)
panel_2 = Panel(python_9.representation)
set_of_tiles = RemoteSender(str)
panel_3 = Panel(python_10.representation)
cells_to_tile_2 = RemoteReceiver(cells_to_tile)
til_3 = GhPythonScript(tiling_options=cells_to_tile_2)  # -> cells; same code as til
path_mapper = PathMapper(til_3, source="{A;B;C;D;E}", target="{D;E}")
expl_4 = GhPythonScript(cells=path_mapper)  # -> indexes, crv, state; inputs cells: list; same code as expl
set_of_tiles_2 = RemoteReceiver(set_of_tiles)
python_11 = GhPythonScript(indexes=expl_4.indexes)  # -> out, matrix, cells; inputs indexes: list; same code as python_6
group = Group(Objects=expl_4.crv)
python_12 = GhPythonScript(matrix=python_11.matrix)  # -> out, representation, cells_indx; same code as python_9

# ---- group: format to solver
str_2 = GhPythonScript(idx_list=set_of_tiles_2)  # -> set_array_str; inputs idx_list: list
# ---------- str_2: Python ----------
set_array_str = "[" + ", ".join(x for x in idx_list) + "]"
# ---------- end str_2 ----------

# ---- group: format_to_solver
str_3 = GhPythonScript(idx_list=python_12.cells_indx)  # -> set_array_str; inputs idx_list: list
# ---------- str_3: Python ----------
set_array_str = "[" + ", ".join("({}, {})".format(x, y) for (x, y) in idx_list) + "]"
# ---------- end str_3 ----------

# ----
solver_script_3 = RemoteReceiver(solver_script_2)
shell_executable_2 = RemoteReceiver(shell_executable)

# ---- group: format shell command
f = GhPythonScript(solver=solver_script_3, aparts=str_2, board=str_3)  # -> out, cmd_str
# ---------- f: Python ----------
# -*- coding: utf-8 -*-
"""
@author: prslvtsv
"""
###############################################################
#import ghdev.devcon as dev
#reload(dev)
#
#dev.init_dev_tools(locals(),  config=dev_options, verbose=True)
###############################################################


cmd_str = "python {} -bd '{}' -ap '{}'".format(solver, board, aparts)
print cmd_str
# ---------- end f ----------

# ----
conda_activate_2 = RemoteReceiver(conda_activate)

# ---- group: RUN SOLVER IN TERMINAL
cmd = GhPythonScript(terminal=shell_executable_2, conda_activate=conda_activate_2, payload=f.cmd_str)  # -> out, result
# ---------- cmd: Python ----------
# -*- coding: utf-8 -*-
"""
@author: prslvtsv
"""
###############################################################
#import ghdev.devcon as dev
#reload(dev)
#
#dev.init_dev_tools(locals(),  config=dev_options, verbose=True)
###############################################################

import subprocess as sub


def execute_in_shell(cmd):
    
    process = sub.Popen(cmd, executable=terminal, stdin=sub.PIPE, stdout=sub.PIPE, stderr=sub.PIPE, shell=True)
    stdout, stderr = process.communicate()
#    print stdout, stderr
    return stdout


cmd = "; ".join([conda_activate, payload])
r = execute_in_shell(cmd).splitlines()[0].strip()
exec("result = {}".format(r))
#result = execute_in_shell(cmd)
#print result
# ---------- end cmd ----------

# ----
trim = TrimTree(Tree=cmd.result, Depth=2)
number_slider = Slider(64, range=0..1024)
number_slider_2 = Slider(256, range=0..1024)
bypass = BooleanToggle(False)

# ---- group: LIMIT DISPLAY NUMBER
python_13 = GhPythonScript(lst=trim, lim=Slider(45, range=0..100), bypass=bypass)  # -> out, result; inputs lst: list, lim: Int32, bypass: Boolean
# ---------- python_13: Python ----------
if not bypass:
    result = lst[:lim]
else:
    result = lst
# ---------- end python_13 ----------

# ----
trim_2 = TrimTree(Tree=python_13.result, Depth=1)
origin_point__point_object_2 = RemoteReceiver(origin_point__point_object)
floor_matrix_data_crv_state_2 = RemoteReceiver(graft(floor_matrix_data_crv_state))

brec = BoundingRectangle(Geometry=group, Plane=PlaneXY(0, 0, 0), Axis=0, Slide=0, Union=True)  # -> Bounding, expr("x*1.2", DimensionX), expr("x*1.2", DimensionY)
trim_3 = TrimTree(Tree=brec.DimensionX, Depth=1)
trim_4 = TrimTree(Tree=brec.DimensionY, Depth=1)

# ---- group: add corridor and llu tiles
python_14 = GhPythonScript(group_idx=trim_2, floor_mtx=floor_matrix_data_crv_state_2)  # -> out, floor_full_groups; inputs group_idx: tree
# ---------- python_14: Python ----------
import ghpythonlib.treehelpers as th
from Grasshopper import DataTree

groups = th.tree_to_list(group_idx)
#floor = th.tree_to_list(floor_mtx.AllData())
#print floor
out_tree = DataTree[object]()

print len(groups)
for i, board_res in enumerate(groups):

    for gr in board_res:
        setA = set(sum(gr, []))
        setB = floor_mtx.active_cells()
        corridor = [c.index() for c in setB if c.index() not in setA and c.data[1] in 'corridor']
        llu = [c.index() for c in setB if c.index() not in setA and c.data[1] in 'llu']
        full = gr+[corridor]+[llu]
        out_tree.Add(full, group_idx.Paths[i])
        
#print floor_full[0][0]
floor_full_groups = out_tree
# ---------- end python_14 ----------

# ----
item = ListItem(List=flatten(python_14.floor_full_groups), Index=Slider(20, range=0..100), Wrap=True)

# ---- group: cerate laypout from index groups \\ rebuikld here to propagate lib changes further
python_15 = GhPythonScript(space_groups=python_14.floor_full_groups, base_matrix=floor_matrix_data_crv_state_2, origin=origin_point__point_object_2)  # -> out, apt_layouts; inputs space_groups: list
# ---------- python_15: Python ----------
import ghpythonlib.treehelpers as th
import gblock.elements.matrix as mtx
import gblock.elements.layout as layout
reload(mtx)
reload(layout)

opt = origin.PointGeometry.Location


apt = []
for tiling in space_groups:
    apartLayout = layout.FloorLayout().from_matrix_tiling(base_matrix, tiling, (opt.X, opt.Y, opt.Z))
    apartLayout = apartLayout.relocate_to((0, 0, 0))
    apt.append(apartLayout)

print [[len(g) for g in a.spacediv.values()] for a in apt]
apt_layouts = apt
# ---------- end python_15 ----------

# ---- group: group_by_rows
python_16 = GhPythonScript(layout=python_15.apt_layouts, i=trim_3, j=trim_4)  # -> out, coords_rows; inputs layout: list
# ---------- python_16: Python ----------
import ghpythonlib.treehelpers as th
import math
rows = []
ratio = j/i
size = int(math.ceil(math.sqrt(len(layout)) * ratio))
for i, v in enumerate(layout):
    if i % size == 0:
        rows.append([])
    rows[-1].append(v)
coords_rows = th.list_to_tree(rows,source=[0,ghenv.Component.RunCount-1])
# ---------- end python_16 ----------

# ---- group: relocate_layout_to grid
python_17 = GhPythonScript(rows=python_16.coords_rows, xoff=trim_3, yoff=trim_4)  # -> out, layout_positioned; inputs rows: tree, xoff: tree, yoff: tree
# ---------- python_17: Python ----------
import ghpythonlib.treehelpers as th
from Grasshopper import DataTree
import gblock.elements.layout as layout
reload(layout)

solutions = th.tree_to_list(rows)
xff = sum(th.tree_to_list(xoff), [])
yff = sum(th.tree_to_list(yoff), [])
#print yff
#print len(solutions)
out_tree = DataTree[object]()

for sol, lst_rows in enumerate(solutions):
    row_col_num = [r for r in lst_rows]
#    print sol
    for i, row in enumerate(row_col_num):
#        print i
        for j, col in enumerate(row):
#            print j
            ii = i*yff[sol]  
            jj = j* xff[sol] + (sol * xff[sol] * len(row))*1.1
            print (jj, ii)
            pp = sol * len(solutions) + i
#            print rows.Paths[pp]
            layout = col.relocate_to((jj, ii, 0))
            out_tree.Add(layout, rows.Paths[pp])
#            aparts = layout.space_divisions()

layout_positioned = out_tree
# ---------- end python_17 ----------

# ----
# здесь я немного адаптировал
# код из кластера визуализации
# чтобы вытащить контур лэйаута
# 
# я думаю его можно дописать чтобы
# не пришлось удалять существующие тайлы,
# но как именно работать в случае
# со смещенными тайлами, я не смог придумать
number_slider_3 = Slider(58, range=0..100)

# ---- group: get_layout_outline
python_18 = GhPythonScript(layout=python_15.apt_layouts)  # -> out, simplify(spacial_units)
# ---------- python_18: Python ----------
spacial_units = []

for k, v in layout.spacediv.items():
    for spacial_unit in v:
        for cell in spacial_unit.active_cells():
            spacial_units.append(cell)
        
        
print(spacial_units)
# ---------- end python_18 ----------
python_19 = GhPythonScript(spacial_unit=python_18.spacial_units)  # -> simplify(sun), simplify(no_sun); inputs spacial_unit: list
# ---------- python_19: Python ----------
#from Grasshopper import DataTree
from Rhino.Geometry import Point3d, Polyline
from gblock.elements.matrix import SpacialMatrix
import rhinoscriptsyntax as rs
import math
#import gblock.elements.layout as layout
#reload(layout)


def generate_outline(su):
    def sh_str(fl):
        n = str(math.trunc(round(fl * 100)))
        if n not in "0":
            n = ".".join([n[:-2], n[-2:]])
        return n

    tl = [
        [(sh_str(x), sh_str(y), sh_str(z)) for (x, y, z) in cl.outline]
        for cl in su
    ]
    str_coords = set(sum(tl, []))
    coords = [((float(x), float(y), float(z))) for (x, y, z) in str_coords]
    display_mtx = SpacialMatrix().from_coordinates(coords)
    b_out, b_in = display_mtx.get_matrix_boundary_indeces()
    return [c.data for c in display_mtx.cells_at(b_out)]

global_outline = [Point3d(x, y, z) for (x, y, z) in generate_outline(spacial_unit)]
global_outline = global_outline[:] + global_outline[:1]
glob_ply = rs.AddPolyline(global_outline)
rs.SimplifyCurve(glob_ply)

space_outline = glob_ply #outline of simplified layout
glob_ply_segs = rs.ExplodeCurves(glob_ply)

# find segment of north facade (no_sun)
y_sums_dict = {}
for i, seg in enumerate(glob_ply_segs):
    print(rs.CurveEditPoints(seg))
    pt1, pt2 = rs.CurveEditPoints(seg)
    y_sums_dict[i] = pt1[1]+pt2[1]

for k, v in y_sums_dict.items():
    if v == max(y_sums_dict.values()):
        no_sun = glob_ply_segs[k]
        del y_sums_dict[k]
        break

# exclude upper right segment
x_sums_dict = {}
for i, seg in enumerate(glob_ply_segs):
    print(rs.CurveEditPoints(seg))
    pt1, pt2 = rs.CurveEditPoints(seg)
    x_sums_dict[i] = pt1[0]+pt2[0]

for k, v in x_sums_dict.items():
    if v == max(x_sums_dict.values()):
        del y_sums_dict[k]
        break

# rest segments of outline
sun = rs.JoinCurves([glob_ply_segs[k] for k in y_sums_dict.keys()])
# ---------- end python_19 ----------

# ---- group: test_verificators
# здесь собраны все
# верификаторы которые
# есть в модуле verificator
# я этот верификатор пока в таком
# виде прописал, потому что тоже была
# проблема с контуром. плюс тут постоянно
# отсылки на rhinoscriptxyntax
# и я хотел с тобой это обсудить
# поскольку ты вроде говорил
# что выносить в модуль библиотеку
# не стоит
python_20 = GhPythonScript(layout=python_15.apt_layouts)  # -> out
# ---------- python_20: Python ----------
from gblock.apt_verificator import verificator as v
reload(v)


#print(v.check_corridor_neighbourhood(layout))
#print(v.check_corridor_segments_lengths(layout))
#print(v.check_corridor_full_length(layout))
#print(v.get_corridor_corner_tile(corridor))
print(v.apply_verificator(layout))
# ---------- end python_20 ----------

# ---- group: здесь верификация на темную угловую квартиру.
crv = Curve(<curve referenced from the Rhino model>)
crv_2 = Curve(<curve referenced from the Rhino model>)
explode = Explode(Curve=crv, Recursive=True)  # -> Segments, Vertices
python_21 = GhPythonScript(pts=explode.Vertices, layout_contour=crv_2, min_length=Slider(1.6, range=0..10))  # -> out; inputs pts: list of Point3d
# ---------- python_21: Python ----------
import rhinoscriptsyntax as rs


def get_seg_angle((pt1, pt2)):
    angle = rs.Angle2([pt1, pt2], [[0,0,0], [0,1,0]])[0]
    if angle > 90:
        return abs(180 - angle)
    return angle


def round_coords(pt):
    s = [str(round(coord, 2)).split('.') for coord in pt]
    return [i[0]+'.'+i[1] for i in s]


def check_pt_on_contour_corner(pt, contour):
    p = rs.CurveClosestPoint(contour, pt)
    ccp = rs.EvaluateCurve(contour, p)
    d = (rs.Distance(pt, ccp))
    if d < 0.1:
        return True
    return False


def check_corner_apt_seg_length(pts, min_seg_length, layout_contour):
    segs_to_check = {}
    for i, pt in enumerate(pts[:-1]):
        pt1, pt2  = (pt, pts[i+1])
        if check_pt_on_contour_corner(pt1, layout_contour) and check_pt_on_contour_corner(pt2, layout_contour):
            segs_to_check[i] = (pt1, pt2)
    angles = {}
    for k, v in segs_to_check.items():
        angle = get_seg_angle(v)
        angles[k] = angle
        print(k, angle)
    
    for k, v in angles.items():
        if v == max(angles.values()):
            seg_length = rs.Distance(segs_to_check[k][0], segs_to_check[k][1])
            print(seg_length)
            if seg_length < min_seg_length:
                return False
            return True


print(check_corner_apt_seg_length(pts, min_length, layout_contour))
# ---------- end python_21 ----------
panel_4 = Panel(python_21)

# ----
lng = ListLength(List=flatten(python_15.apt_layouts))
item_2 = ListItem(List=flatten(python_15.apt_layouts), Index=number_slider_3, Wrap=True)
floor_layouts = Panel(lng)
panel_5 = Panel(python_20)
crv_3 = Curve([python_19.no_sun, python_19.sun])
python_22 = GhPythonScript(layout=simplify(graft(python_15.apt_layouts)), sun=python_19.sun, no_sun=python_19.no_sun)  # -> flatten(out)
# ---------- python_22: Python ----------
import rhinoscriptsyntax as rs

def check_pt_on_contour_corner(pt, contour, min_dist=0.1):
    p = rs.CurveClosestPoint(contour, pt)
    ccp = rs.EvaluateCurve(contour, p)
    d = (rs.Distance(pt, ccp))
    if d < min_dist:
        return True
    return False


def check_apt_on_contour(apt, contour):
    for tile in apt.active_cells():
        for pt in tile.outline:
            check = check_pt_on_contour_corner(pt, contour)
            if check:
                return True
    return False

def check_north_apts(layout, no_sun_contour, sun_contour):
    apartments = layout.get_apartments()
    north_apts = []
    for apt in apartments:
        if check_apt_on_contour(apt, no_sun_contour):
            north_apts.append(apt)
    for apt in north_apts:
        if not check_apt_on_contour(apt, sun_contour):
            return False
    return True


print(check_north_apts(layout, no_sun, sun))
# ---------- end python_22 ----------
cull = CullPattern(List=python_15.apt_layouts, CullPattern=flatten(python_22))
panel_6 = Panel(python_22)

# ---- group: get separate spacial groups
python_23 = GhPythonScript(layout_in=cull)  # -> out, space_apartments, space_corridor, space_llu
# ---------- python_23: Python ----------
from Grasshopper import DataTree
import gblock.elements.layout as layout
#reload(layout)

space_apartments = layout_in.get_apartments()
space_corridor = layout_in.get_corridor()
space_llu = layout_in.get_llu()
# ---------- end python_23 ----------

# ----
cluster = Cluster(apartments=python_23.space_apartments, corridor=python_23.space_corridor, llu=python_23.space_llu)

# ---- group: placed outside cluster to ensure draws on top of all
previewlw = CustomPreviewLineweights(
    Geometry=simplify(cluster),
    Shader=simplify(ColourSwatch(SwatchColor=RGBA(0, 0, 0, 212))),
    Thickness=Slider(2, range=0..10),
    Absolute=False)

# ==== cluster Disp
geo_to_viz = ClusterInput()
data = Data(geo_to_viz)
color = Color(data_in=data)
runion = RegionUnion(Curves=data)
boundary = BoundarySurfaces(Edges=runion)
addition = Addition(A=color, B=ColourSwatch(SwatchColor=RGB(150, 150, 150)))
preview = CustomPreview(Geometry=simplify(boundary), Material=simplify(color))
previewlw = CustomPreviewLineweights(
    Geometry=simplify(runion),
    Shader=simplify(ColourSwatch(SwatchColor=RGBA(0, 0, 0, 212))),
    Thickness=Slider(2, range=0..10),
    Absolute=False)
previewlw_2 = CustomPreviewLineweights(Geometry=simplify(data), Shader=simplify(addition), Thickness=Slider(1.7, range=0..10), Absolute=False)
previewmat = CustomPreviewMaterials(Geometry=boundary, DiffuseColor=color, Transparency=Slider(0.211, range=0..1))
createhatch = CreateHatch(Bake=False, Curves=runion, HatchPatternName="Hatch1", HatchScale=0.8, HatchRotation=45)  # -> HatchGeometry, HatchObjects
number_slider = Slider(0.625, range=0..1)
preview_2 = CustomPreview(Geometry=simplify(createhatch.HatchGeometry), Material=simplify(color))

# ==== cluster Disp_2
data = ClusterInput()

# ---- group: display point groups
data_2 = Data(data)
tstat = TreeStatistics(Tree=data_2)  # -> Paths, Length, Count
txt = Text(tstat.Length)
txt_2 = Text(tstat.Paths)
pt = ConstructPoint(XCoordinate="0.2", YCoordinate="0.1", ZCoordinate="0.2")
concat = Concatenate(FragmentA=txt_2, FragmentB=txt)
cpreview = PreviewClasses(Geometry=data_2, Name=concat, Position=pt, Size=12, Seed=123)

# ==== cluster D
xy = ClusterInput()
x_y = GhPythonScript(xy=xy)  # -> x, y; inputs xy: list
# ---------- x_y: Python ----------
x = [a[0] for a in xy]
y = [a[1] for a in xy]
# ---------- end x_y ----------
pt = ConstructPoint(XCoordinate=x_y.x, YCoordinate=x_y.y, ZCoordinate=0)

# ---- group: compute tile rectangle
rec = Rec(p=pt)

# ----
R = ClusterOutput(rec)

# ---- group: compute label pt
pt_2 = Pt(C=rec)

# ----
T = ClusterOutput(pt_2)

# ==== cluster Cluster
corridor = ClusterInput()
apartments = ClusterInput()
llu = ClusterInput()
lng = ListLength(List=flatten(apartments))
corridor_2 = Data(corridor)
llu_2 = Data(llu)
apartments_2 = Data(apartments)
panel = Panel(lng)

# ---- group: generate all geometry
python = GhPythonScript(spacial_unit=corridor_2)  # -> out, tiles_outline, space_outline
# ---------- python: Python ----------
from Grasshopper import DataTree
from Rhino.Geometry import Point3d, Polyline
import gblock.elements.layout as layout
#reload(layout)

outline_pt_xyz = spacial_unit.tiles_outline()
ply = []
for outline in outline_pt_xyz:
    pt_list = [Point3d(x, y, z) for (x, y, z) in outline]
    ply.append(Polyline(pt_list))
    
global_outline = [Point3d(x, y, z) for (x, y, z) in spacial_unit.generate_outline()]
global_outline = global_outline[:] + global_outline[:1]
print len(global_outline)
glob_ply = [Polyline(global_outline)]
tiles_outline = ply
space_outline = glob_ply
# ---------- end python ----------

python_2 = GhPythonScript(spacial_unit=apartments_2)  # -> out, tiles_outline, space_outline
# ---------- python_2: Python ----------
#from Grasshopper import DataTree
from Rhino.Geometry import Point3d, Polyline
#import gblock.elements.layout as layout
#reload(layout)

outline_pt_xyz = spacial_unit.tiles_outline()
ply = []
for outline in outline_pt_xyz:
    pt_list = [Point3d(x, y, z) for (x, y, z) in outline]
    ply.append(Polyline(pt_list))
    
global_outline = [Point3d(x, y, z) for (x, y, z) in spacial_unit.generate_outline()]
global_outline = global_outline[:] + global_outline[:1]
#print len(global_outline)
glob_ply = [Polyline(global_outline)]
tiles_outline = ply
space_outline = glob_ply
# ---------- end python_2 ----------

python_3 = GhPythonScript(spacial_unit=llu_2)  # -> out, tiles_outline, space_outline; same code as python

# ----
lng_2 = ListLength(List=flatten(python_2.space_outline))
lng_3 = ListLength(List=flatten(python_2.tiles_outline))
crv = Curve(python_3.space_outline)
crv_2 = Curve(python_3.tiles_outline)
crv_3 = Curve(python.tiles_outline)
crv_4 = Curve(python.space_outline)
crv_5 = Curve(python_2.tiles_outline)
crv_6 = Curve(python_2.space_outline)
panel_2 = Panel(lng_2)
panel_3 = Panel(lng_3)
_5 = ColourSwatch(SwatchColor=RGB(255, 84, 84))
_4 = ColourSwatch(SwatchColor=RGB(190, 147, 250))
_2 = ColourSwatch(SwatchColor=RGB(241, 250, 140))
_3 = ColourSwatch(SwatchColor=RGB(139, 232, 252))
_6 = ColourSwatch(SwatchColor=RGB(255, 184, 107))
_6_2 = ColourSwatch(SwatchColor=RGB(80, 250, 122))
_1 = ColourSwatch(SwatchColor=RGB(255, 255, 255))
lng_4 = ListLength(List=crv_5)
merge = Merge(Data1=_1, Data2=_1, Data3=_2, Data4=_3, Data5=_6, Data6=_4, Data7=_6_2)
swatch = ColourSwatch(SwatchColor=RGB(68, 71, 89))
_5_2 = ColourSwatch(SwatchColor=RGB(255, 84, 84))
item = ListItem(List=merge, Index=lng_4, Wrap=True)
boundary = BoundarySurfaces(Edges=crv)
boundary_2 = BoundarySurfaces(Edges=crv_4)
boundary_3 = BoundarySurfaces(Edges=crv_6)
previewlw = CustomPreviewLineweights(
    Geometry=simplify([crv_5, crv_3, crv_2]),
    Shader=simplify(ColourSwatch(SwatchColor=RGB(255, 255, 255))),
    Thickness=Slider(1, range=0..10),
    Absolute=False)
previewmat = CustomPreviewMaterials(Geometry=boundary, DiffuseColor=_5_2, Transparency=Slider(0, range=0..10))
previewmat_2 = CustomPreviewMaterials(Geometry=boundary_2, DiffuseColor=ColourSwatch(SwatchColor=RGB(98, 114, 163)), Transparency=Slider(0, range=0..10))
previewmat_3 = CustomPreviewMaterials(Geometry=boundary_3, DiffuseColor=item, Transparency=Slider(0, range=0..1))
outlines = Data([crv_6, crv_4, crv])
outlines_2 = ClusterOutput(outlines)

# ==== cluster Color
data_in = ClusterInput()  # data_in
dom = ConstructDomain(DomainStart=Slider(0.168, range=0..1), DomainEnd=Slider(0.922, range=0..1))
tstat = TreeStatistics(Tree=data_in)  # -> Paths, Length, Count
bbox = BoundingBox(Content=data_in, Plane=PlaneXY(0, 0, 0), UnionBox=True)  # -> Box, Box_2
extremums = MinMax(Number=tstat.Length)  # -> Minimum, Maximum
range = Range(Domain=dom, Steps=expr("x-1", tstat.Length))
dim = Dimensions(Surface=bbox.Box)  # -> UDimension, VDimension
area = Area(Geometry=bbox.Box)  # -> Area, Centroid
pcshuffle = Shuffle(List=range, Seed=Slider(1, range=0..1), LastSaveLocalization="neutral,N")
extremums_2 = MinMax(Number=flatten(dim.UDimension))  # -> Minimum, Maximum
wheel = ColourWheel(
    extremums_2.Maximum,
    ColourGrips_Style=10,
    ColourGrips_Grip=[5.115610268, 3.821325235, 1.989214472, 5.130807126],
    ColourGrips_Lum=[0.1, 1],
    ColourGrips_Range=[0.5123760279, 0.5123760279, 0.5123760279, 0.5123760279],
    ColourGrips_Sat=[0.2, 1])
addition = Addition(A=dim.UDimension, B=area.Area)
hsv = ColourHSV(Alpha=1, Hue=pcshuffle, Saturation=1, Value=1)
subtraction = Subtraction(A=dim.UDimension, B=extremums_2.Minimum)
hsl = ColourHSL(Alpha=0.7, Hue=pcshuffle, Saturation=1, Luminance=Slider(0.247, range=0..1))
data = Data(graft(wheel))
data_2 = Data(simplify(graft(hsv)))
item = ListItem(List=hsv, Index=subtraction, Wrap=True)  # -> simplify(Item)
panel = Panel(dim.UDimension)
addition_2 = Addition(A=data_2, B=item)
division = Division(A=addition_2, B=2)
panel_2 = Panel(division)
color_out = ClusterOutput(item)  # color_out

# ==== cluster Rec
p = ClusterInput()  # p
pdecon = Deconstruct(Point=p)  # -> XComponent, YComponent, ZComponent
data = Data(Slider(1, range=0..1))
number_slider = Slider(2, range=0..10)
ghpython_script = GhPythonScript(x=pdecon.XComponent, c=data)  # -> a
# ---------- ghpython_script: Python ----------
# -*- coding: utf-8 -*-
"""
@author: prslvtsv
"""
###############################################################
#import ghdev.devcon as dev
#reload(dev)
#
#dev.init_dev_tools(locals(),  config=dev_options, verbose=True)
###############################################################


a = x*c + c
# ---------- end ghpython_script ----------
ghpython_script_2 = GhPythonScript(x=pdecon.YComponent, c=data)  # -> a
# ---------- ghpython_script_2: Python ----------
# -*- coding: utf-8 -*-
"""
@author: prslvtsv
"""
###############################################################
#import ghdev.devcon as dev
#reload(dev)
#
#dev.init_dev_tools(locals(),  config=dev_options, verbose=True)
###############################################################


a = x*c
# ---------- end ghpython_script_2 ----------
ghpython_script_3 = GhPythonScript(x=pdecon.XComponent, c=data)  # -> a; same code as ghpython_script_2
addition = Addition(A=ghpython_script_3, B=ghpython_script)
ghpython_script_4 = GhPythonScript(x=pdecon.YComponent, c=data)  # -> a; same code as ghpython_script
addition_2 = Addition(A=ghpython_script_2, B=ghpython_script_4)
subtraction = Subtraction(A=ghpython_script_2, B=ghpython_script_4)
subtraction_2 = Subtraction(A=ghpython_script_3, B=ghpython_script)
pt = ConstructPoint(XCoordinate=ghpython_script_3, YCoordinate=ghpython_script_2, ZCoordinate=0)
pt_2 = ConstructPoint(XCoordinate=ghpython_script, YCoordinate=ghpython_script_4, ZCoordinate=0)
division = Division(A=subtraction_2, B=number_slider)
division_2 = Division(A=subtraction, B=number_slider)
rec_2pt = Rectangle2Pt(Plane=PlaneXY(0, 0, 0), PointA=pt, PointB=pt_2, Radius=0)  # -> Rectangle, Length
vec = VectorXYZ(XComponent=division, YComponent=division_2, ZComponent=0)  # -> Vector, Length
move = Move(Geometry=rec_2pt.Rectangle, Motion=vec.Vector)  # -> Geometry, Transform
pcen = PolygonCenter(Polyline=move.Geometry)  # -> CenterV, CenterE, CenterA
boundary = BoundarySurfaces(Edges=move.Geometry)
G = ClusterOutput(move.Geometry)

# ==== cluster Pt
C = ClusterInput()
cpoly = ControlPolygon(Curve=C)  # -> Polygon, Points
item = ListItem(List=cpoly.Points, Index=[0, 1, 3], Wrap=True)
ma = MassAddition(Input=item)  # -> Result, PartialResults
division = Division(A=ma.Result, B=3)
trim = TrimTree(Tree=division, Depth=1)
T = ClusterOutput(trim)
