# Grasshopper definition SEC_[tool]_apartments_solver_01.gh (Grasshopper 1.0.7)
# Copyright: prslvtsv
# plug-ins: Telepathy, Human, Pancake, Heteroptera

# ---- group: PARAMETERS - replace with your pathes
# C:\Windows\System32\WindowsPowerShell\v1.0\powershell.exe -ExecutionPolicy ByPass -NoExit -Command "& 'C:\ProgramData\Anaconda3\shell\condabin\conda-hook.ps1' ; conda activate 'C:\ProgramData\Anaconda3' "
conda_base_env = Panel("\"C:\\ProgramData\\Anaconda3\\shell\\condabin\\conda-hook.ps1; conda activate C:\\ProgramData\\Anaconda3;\"")
# "C:\ProgramData\Anaconda3\shell\condabin\conda-hook.ps1; conda activate C:\ProgramData\Anaconda3\envs\exc43;"
power_shell_as_executable = Panel("C:\Windows\System32\WindowsPowerShell\v1.0\powershell.exe")
solver_script = Panel("C:\Users\GUEST\Documents\CODE\aective\sectiondev\sections_dataset_generator\apart_solver.py")
shell_executable = RemoteSender(power_shell_as_executable)
conda_activate = RemoteSender(conda_base_env)
solver_script_2 = RemoteSender(solver_script)

# ----
pipeline = GeometryPipeline(
    GroupByLayer=False,
    GroupByType=False,
    IncludeHidden=False,
    IncludeLocked=False,
    LayerFilter="apartments::crv",
    NameFilter="*",
    SublayerFiltering=True,
    TypeFilter=4)

# ---- group: FLOOR MATRIX
pipeline_2 = GeometryPipeline(
    GroupByLayer=False,
    GroupByType=False,
    IncludeHidden=False,
    IncludeLocked=False,
    LayerFilter="floor_matrix::points",
    NameFilter="*",
    SublayerFiltering=True,
    TypeFilter=1)
pgroups = PointGroups(Points=pipeline_2, Distance=Slider(2.5, range=0..10))  # -> Groups, Indices

# ---- group: from guids
pipeline_3 = GeometryPipeline(
    GroupByLayer=False,
    GroupByType=False,
    IncludeHidden=False,
    IncludeLocked=False,
    LayerFilter="polyominos::crv",
    NameFilter="*",
    SublayerFiltering=True,
    TypeFilter=4)
id = Guid(pipeline)

# ---- group: display point groups
disp = Disp_2(data=pgroups.Groups)

# ---- group: FLOOR MATRIX / convert points to indexes
indx = GhPythonScript(points=pgroups.Groups)  # -> out, indexes, xy; inputs points: list of Point3d
# ---------- indx: Python ----------
import gh_components_script.gh_points2matrix as p2m
reload(p2m)

indexes = p2m.points2matrix_ij(points)
xy = p2m.points2matrix_xy(points)
# ---------- end indx ----------

# ---- group: from guids / index from neigbour curves
python = GhPythonScript(crv=id)  # -> indexes, curves; inputs crv: list
# ---------- python: Python ----------
## -*- coding: utf-8 -*-
#"""
#@author: prslvtsv
#"""
###############################################################
#import ghdev.devcon as dev
#reload(dev)
#
#dev.init_dev_tools(locals(),  config=dev_options, verbose=True)
###############################################################

import ghpythonlib.treehelpers as th
from  Rhino.Geometry import Point3d
from collections import OrderedDict as oddict
import gblock.ghhelp as ghh
import gh_components_script.gh_points2matrix as p2m
reload(p2m)
reload(ghh)

def crv2points(crv):
    poly = [ghh.Helper.get_by_id_geo(c).ToPolyline().ToArray() for c in crv]
    # remove 5th point 
    pt = [[p for p in pl][:-1] for pl in poly]
    return pt

def orient_poly_points(pt):
    pl_pts = []
    for pt in pt:
        pl_pts.append( [Point3d(x, y, 0) for (x, y) in p2m.sort_pt_xy(pt)])
    return pl_pts  
    
#def mapRange(value, leftMin, leftMax, rightMin, rightMax):
#    leftSpan = leftMax - leftMin
#    rightSpan = rightMax - rightMin
#    valueScaled = float(value - leftMin) / float(leftSpan)
#    return rightMin + (valueScaled * rightSpan)

def corners2index(corners):
    leftLow = [a[0] for a in corners]
    xll = [p.X for p in leftLow]
    unique_x= sorted(list(set([round(x) for x in xll])))
    ix = [unique_x.index(round(xp)) for xp in xll]
    
    rightTop = [a[2] for a in corners]
    yrt = [p.Y for p in rightTop]
    unique_y = sorted(list(set([round(y) for y in yrt])))
    jy = [unique_y.index(round(yp)) for yp in yrt]

#    indx_i = [int(mapRange(a, min(xll), max(xll), 0, len(unique_x)-1)) for a in xll]
#    indx_j = [int(mapRange(a, min(yrt), max(yrt), 0, len(unique_y)-1)) for a in yrt]
    print list(zip(ix, jy))
    return list(zip(ix, jy))

pts = crv2points(crv)
sorted_corners = orient_poly_points(pts)
indx = corners2index(sorted_corners)

#print sorted_corners
indexes = indx
curves = [ghh.Helper.get_by_id_geo(c) for c in crv]
# ---------- end python ----------

# ---- group: display_block / copute things for display
d = D(xy=indx.xy)  # -> R, T

# ---- group: display_block
screentext = ScreenOrientedText(
    Text=indx.indexes,
    Font="Arial",
    Justification=2,
    Location=d.T,
    SizeFactor=Slider(0.173, range=0..2),
    Color=RGB(255, 255, 255),
    Depth=0,
    Absolute=True)

# ---- group: points to indexes
indx_2 = GhPythonScript(points=pgroups.Groups)  # -> out, indexes, pt; inputs points: list of Point3d
# ---------- indx_2: Python ----------
import gblock.ghhelp as ghh
#reload(ghh)


indexes = ghh.xy2ij(points)
pt = points
# ---------- end indx_2 ----------

# ---- group: display_block / display cells tiles
disp_2 = Disp(geo_to_viz=d.R)

# ----
pcen = PolygonCenter(Polyline=python.curves)  # -> CenterV, CenterE, CenterA
series = Series(Start=0, Step=Slider(3.3, range=0..10), Count=Slider(12, range=0..24))

# ---- group: FLOOR MATRIX / create from indexes
python_2 = GhPythonScript(indexes=python.indexes)  # -> out, matrix, cells; inputs indexes: list
# ---------- python_2: Python ----------
# -*- coding: utf-8 -*-
"""
@author: prslvtsv
"""
###############################################################
#import ghdev.devcon as dev
#reload(dev)
#
#dev.init_dev_tools(locals(),  config=dev_options, verbose=True)
###############################################################
import gblock.elements.matrix as mtx
reload(mtx)


matrix = mtx.SpacialMatrix().from_indexes(indexes, data="cell")
cells = matrix.active_indexes()
# ---------- end python_2 ----------

# ----
tag = TextTag(Location=pcen.CenterV, Text=python.indexes)
Z = UnitZ(Factor=series)
group = Group(Objects=python.curves)
move = Move(Geometry=group, Motion=Z)  # -> Geometry, Transform
python_3 = GhPythonScript(matrix=python_2.matrix)  # -> out, representation, cells_indx
# ---------- python_3: Python ----------
# -*- coding: utf-8 -*-
"""
@author: prslvtsv
"""
###############################################################
#import ghdev.devcon as dev
#reload(dev)
#
#dev.init_dev_tools(locals(),  config=dev_options, verbose=True)
###############################################################
import gblock.elements.matrix as mtx
reload(mtx)


representation = matrix.__repr__()
cells_indx = matrix.active_indexes()
# ---------- end python_3 ----------
panel = Panel(python_3.representation)

# ---- group: FLOOR MATRIX / data formated for solver
str = GhPythonScript(idx_list=python_2.cells)  # -> set_array_str; inputs idx_list: list
# ---------- str: Python ----------
set_array_str = "[" + ", ".join("({}, {})".format(x, y) for (x, y) in idx_list) + "]"
# ---------- end str ----------

# ----
panel_2 = Panel(str)
solver_script_3 = RemoteReceiver(solver_script_2)
shell_executable_2 = RemoteReceiver(shell_executable)
conda_activate_2 = RemoteReceiver(conda_activate)

# ---- group: appartments templates
appt_23_o = RemoteReceiver()  # disabled
appt_23_p = RemoteReceiver()  # disabled
appt_12_i = RemoteReceiver()  # disabled
appt_13_i = RemoteReceiver()  # disabled
appt_23_j = RemoteReceiver()  # disabled
appt_33_j = RemoteReceiver()  # disabled

# ----
ghpython_script = GhPythonScript(tiles=[appt_23_o, appt_23_j])  # -> formated; inputs tiles: list; disabled
# ---------- ghpython_script: Python ----------
# -*- coding: utf-8 -*-
"""
@author: prslvtsv
"""
###############################################################
#import ghdev.devcon as dev
#reload(dev)
#
#dev.init_dev_tools(locals(),  config=dev_options, verbose=True)
###############################################################

formated = "..".join(tiles)
# ---------- end ghpython_script ----------
ghpython_script_2 = GhPythonScript(tiles=[appt_12_i, appt_13_i])  # -> formated; inputs tiles: list; disabled; same code as ghpython_script
ghpython_script_3 = GhPythonScript(tiles=appt_13_i)  # -> formated; inputs tiles: list; disabled; same code as ghpython_script
python_4 = GhPythonScript(x=python_2.matrix)  # -> i, j
# ---------- python_4: Python ----------
i, j = x.shape()

i += 1
j += 1
# ---------- end python_4 ----------
pt = ConstructPoint(XCoordinate=20, YCoordinate=100, ZCoordinate=0)
solver_conditional_script = RemoteReceiver()  # disabled
python_5 = GhPythonScript(mandatory=ghpython_script, filler=ghpython_script_2)  # -> out, tileset; disabled
# ---------- python_5: Python ----------
# -*- coding: utf-8 -*-
"""
@author: prslvtsv
"""
###############################################################
#import ghdev.devcon as dev
#reload(dev)
#
#dev.init_dev_tools(locals(),  config=dev_options, verbose=True)
###############################################################

tileset = ""
if mandatory != None:
    tileset += "-m {} ".format(mandatory)
if optional != None:
    tileset += "-o {} ".format(optional)
if filler != None:
    tileset += "-f {} ".format(filler)
# ---------- end python_5 ----------
board_remove_cells = RemoteReceiver()  # disabled
shell_executable_3 = RemoteReceiver(shell_executable)  # disabled
conda_activate_3 = RemoteReceiver(conda_activate)  # disabled
board_size = RemoteReceiver()  # disabled
number_slider = Slider(14, range=0..20)
number_slider_2 = Slider(8, range=0..10)
python_6 = GhPythonScript(solver=solver_conditional_script, board_size=board_size, board_remove=board_remove_cells, tile_set=python_5.tileset)  # -> out, cmd_str; disabled
# ---------- python_6: Python ----------
# -*- coding: utf-8 -*-
"""
@author: prslvtsv
"""
###############################################################
#import ghdev.devcon as dev
#reload(dev)
#
#dev.init_dev_tools(locals(),  config=dev_options, verbose=True)
###############################################################

xs = board_size.split(",")[0]
ys = board_size.split(",")[1]

cmd_str = "python {} -s {} {} -r {} {}".format(solver, xs, ys, board_remove, tile_set)
# ---------- end python_6 ----------
panel_3 = Panel(python_6.cmd_str)  # disabled
python_7 = GhPythonScript(terminal=shell_executable_3, conda_activate=conda_activate_3, payload=python_6.cmd_str)  # -> out, result; disabled
# ---------- python_7: Python ----------
# -*- coding: utf-8 -*-
"""
@author: prslvtsv
"""
###############################################################
#import ghdev.devcon as dev
#reload(dev)
#
#dev.init_dev_tools(locals(),  config=dev_options, verbose=True)
###############################################################

import subprocess as sub


def execute_in_shell(cmd):
    
    process = sub.Popen(cmd, executable=terminal, stdin=sub.PIPE, stdout=sub.PIPE, stderr=sub.PIPE, shell=True)
    stdout, stderr = process.communicate()
    print stdout
    return stdout


cmd = "; ".join([conda_activate, payload])
result = execute_in_shell(cmd).split('\n')
# ---------- end python_7 ----------
panel_4 = Panel(python_7.result)  # disabled
python_8 = GhPythonScript(result_in=python_7.result)  # -> out, board, tiling; inputs result_in: list; disabled
# ---------- python_8: Python ----------
# -*- coding: utf-8 -*-
"""
@author: prslvtsv
"""
###############################################################
#import ghdev.devcon as dev
#reload(dev)
#
#dev.init_dev_tools(locals(),  config=dev_options, verbose=True)
###############################################################

print type(result_in[0])
exec("board = {}".format(result_in[0].strip())) 
exec("tiling = {}".format(result_in[1].strip())) 
#board = result_in[0]
#tiling = result_in[1]
# ---------- end python_8 ----------

# ---- group: parse tiling
python_9 = GhPythonScript(cells=python_8.tiling)  # -> out, x, y; disabled
# ---------- python_9: Python ----------
# -*- coding: utf-8 -*-
"""
@author: prslvtsv
"""
###############################################################
#import ghdev.devcon as dev
#reload(dev)
#
#dev.init_dev_tools(locals(),  config=dev_options, verbose=True)
###############################################################

x= []
y = []

print cells
srt = sorted(cells)
print srt
for c in srt:
    
    x.append(c[0])
    y.append(c[1])
# ---------- end python_9 ----------

# ---- group: parse board
python_10 = GhPythonScript(cells=python_8.board)  # -> out, x, y; inputs cells: list; disabled
# ---------- python_10: Python ----------
# -*- coding: utf-8 -*-
"""
@author: prslvtsv
"""
###############################################################
#import ghdev.devcon as dev
#reload(dev)
#
#dev.init_dev_tools(locals(),  config=dev_options, verbose=True)
###############################################################

x= []
y = []

srt = sorted(cells)
print srt
for c in srt:
    
    x.append(c[0])
    y.append(c[1])
# ---------- end python_10 ----------

# ---- group: generate geometry
tiling = Tiling(index_x=python_9.x, index_y=python_9.y)  # -> cell_srf, cell_rect, cell_pt; disabled

# ----
bbox = BoundingBox(Content=flatten(tiling.cell_pt), Plane=PlaneXY(0, 0, 0), UnionBox=True)  # -> Box, Box_2; disabled

# ---- group: generate geometry
tiling_2 = Tiling(index_x=python_10.x, index_y=python_10.y)  # -> cell_srf, cell_rect, cell_pt; disabled

# ----
dim = Dimensions(Surface=bbox.Box)  # -> UDimension, VDimension; disabled
number_slider_3 = Slider(0.211, range=0..1)
dom = ConstructDomain(DomainStart=Slider(0.125, range=0..1), DomainEnd=Slider(1, range=0..1))
number_slider_4 = Slider(0.625, range=0..1)
multiplication = Multiplication(A=dim.UDimension, B=2)  # disabled
X = UnitX(Factor=multiplication)  # disabled
move_2 = Move(Geometry=tiling.cell_rect, Motion=X)  # -> Geometry, Transform; disabled

# ---- group: custom display
display = Display(geo_to_viz=move_2.Geometry)  # disabled

display_2 = Display(geo_to_viz=tiling_2.cell_rect)  # disabled

# ----
pcwraplist = WrapList(LastSaveLocalization="neutral,N")  # disabled
group_2 = Group()  # disabled
pcwraplist_2 = WrapList(LastSaveLocalization="neutral,N")  # disabled
group_3 = Group()  # disabled
group_4 = Group(Objects=[group_3, group_2])  # disabled
tstat = TreeStatistics(Tree=group_4)  # -> Paths, Length, Count; disabled
sqrt = SquareRoot(Value=tstat.Count)  # disabled
round = Round(Number=sqrt)  # -> Nearest, Floor, Ceiling; disabled
number_slider_5 = Slider(5.36, range=0..10)  # disabled
partition = PartitionList(List=flatten(group_4), Size=round.Ceiling)  # -> simplify(Chunks); disabled
number_slider_6 = Slider(5.36, range=0..10)  # disabled
partition_2 = PartitionList(List=flatten(pcwraplist), Size=round.Ceiling)  # -> simplify(Chunks); disabled
partition_3 = PartitionList(List=flatten(pcwraplist_2), Size=round.Ceiling)  # -> simplify(Chunks); disabled
pcunwraplist = UnwrapList(AtomList=partition_3, LastSaveLocalization="neutral,N")  # disabled
pcunwraplist_2 = UnwrapList(AtomList=partition_2, LastSaveLocalization="neutral,N")  # disabled
tstat_2 = TreeStatistics(Tree=pcunwraplist_2)  # -> Paths, Length, Count; disabled
dup = DuplicateData(Data=tstat_2.Count, Number=tstat_2.Length, Order=True)  # disabled
series_2 = Series(Start=1, Step=number_slider_5, Count=tstat_2.Count)  # -> simplify(graft(Series)); disabled
series_3 = Series(Start=1, Step=number_slider_6, Count=tstat_2.Length)  # -> simplify(Series); disabled
tstat_3 = TreeStatistics(Tree=pcunwraplist_2)  # -> Paths, Length, Count; disabled
dup_2 = DuplicateData(Data=series_2, Number=tstat_2.Length, Order=True)  # disabled
addition = Addition(A=pcunwraplist_2, B=series_3)  # disabled
addition_2 = Addition(A=pcunwraplist, B=series_2)  # disabled
trim = TrimTree(Tree=pcunwraplist_2, Depth=1)  # disabled
pt_2 = ConstructPoint(XCoordinate=addition, YCoordinate=addition_2, ZCoordinate=0)  # disabled
viewer = ParamViewer(series_3)  # disabled

# ---- group: APARTMENTS MATRISES
pipeline_4 = GeometryPipeline(
    GroupByLayer=False,
    GroupByType=False,
    IncludeHidden=False,
    IncludeLocked=False,
    LayerFilter="apartments::possible",
    NameFilter="*",
    SublayerFiltering=True,
    TypeFilter=1)
pgroups_2 = PointGroups(Points=pipeline_4, Distance=Slider(2.5, range=0..10))  # -> Groups, Indices

# ---- group: display point groups
disp_3 = Disp_2(data=pgroups_2.Groups)

# ---- group: points to indexes
indx_3 = GhPythonScript(points=pgroups_2.Groups)  # -> out, indexes, pt; inputs points: list of Point3d; same code as indx_2

# ---- group: APARTMENTS MATRISES / convert points to indexes
indx_4 = GhPythonScript(points=pgroups_2.Groups)  # -> out, indexes, xy; inputs points: list of Point3d; same code as indx

# ---- group: display_block / copute things for display
d_2 = D(xy=indx_4.xy)  # -> R, T

# ---- group: display_block
screentext_2 = ScreenOrientedText(
    Text=indx_4.indexes,
    Font="Arial",
    Justification=2,
    Location=d_2.T,
    SizeFactor=Slider(0.173, range=0..2),
    Color=RGB(255, 255, 255),
    Depth=0,
    Absolute=True)

# ---- group: display_block / display cells tiles
disp_4 = Disp(geo_to_viz=d_2.R)

# ---- group: APARTMENTS MATRISES / create from indexes
python_11 = GhPythonScript(indexes=indx_4.indexes)  # -> out, matrix, cells; inputs indexes: list; same code as python_2

# ----
python_12 = GhPythonScript(matrix=python_11.matrix)  # -> out, representation, cells_indx; same code as python_3
panel_5 = Panel(python_12.representation)

# ---- group: APARTMENTS MATRISES (continued)
str_2 = GhPythonScript(idx_list=python_11.cells)  # -> flatten(set_string); inputs idx_list: list
# ---------- str_2: Python ----------
set_string = "[" + ", ".join("({}, {})".format(x, y) for (x, y) in idx_list) + "]"
# ---------- end str_2 ----------

# ---- group: APARTMENTS MATRISES / data_formated for sol
str_3 = GhPythonScript(idx_list=str_2)  # -> set_array_str; inputs idx_list: list
# ---------- str_3: Python ----------
set_array_str = "[" + ", ".join(x for x in idx_list) + "]"
# ---------- end str_3 ----------

# ----
panel_6 = Panel(str_3)

# ---- group: format shell command
f = GhPythonScript(solver=solver_script_3, board=str, aparts=str_3)  # -> out, cmd_str
# ---------- f: Python ----------
# -*- coding: utf-8 -*-
"""
@author: prslvtsv
"""
###############################################################
#import ghdev.devcon as dev
#reload(dev)
#
#dev.init_dev_tools(locals(),  config=dev_options, verbose=True)
###############################################################


cmd_str = "python {} -bd '{}' -ap '{}'".format(solver, board, aparts)
print cmd_str
# ---------- end f ----------

# ---- group: RUN SOLVER IN TERMINAL
cmd = GhPythonScript(terminal=shell_executable_2, conda_activate=conda_activate_2, payload=f.cmd_str)  # -> out, result
# ---------- cmd: Python ----------
# -*- coding: utf-8 -*-
"""
@author: prslvtsv
"""
###############################################################
#import ghdev.devcon as dev
#reload(dev)
#
#dev.init_dev_tools(locals(),  config=dev_options, verbose=True)
###############################################################

import subprocess as sub


def execute_in_shell(cmd):
    
    process = sub.Popen(cmd, executable=terminal, stdin=sub.PIPE, stdout=sub.PIPE, stderr=sub.PIPE, shell=True)
    stdout, stderr = process.communicate()
    print stdout, stderr
    return stdout


cmd = "; ".join([conda_activate, payload])
r = execute_in_shell(cmd).splitlines()[0].strip()
exec("result = {}".format(r))
#result = execute_in_shell(cmd)
#print result
# ---------- end cmd ----------

# ----
python_13 = GhPythonScript(result=cmd.result)  # -> out, layout_matrix, layouts; inputs result: list
# ---------- python_13: Python ----------
import ghpythonlib.treehelpers as th
import gblock.elements.matrix as mtx
import gblock.elements.layout as layout
reload(mtx)
reload(layout)

print result[1]

flat_idx = [[x for xs in xss for x in xs] for xss in result]

#matrix = mtx.SpacialMatrix.create_from_indexes(indexes, data="cell")

layout_matrix = [mtx.SpacialMatrix().from_indexes(idx) for idx in flat_idx]

layouts = []
for i, v in enumerate(result):
    layouts.append(layout.FloorLayout(layout_matrix[i], v))
# ---------- end python_13 ----------
lng = ListLength(List=python_13.layouts)
texttoscreen = RenderTextToScreen(Text=lng, Location=pt, Size=72, Color=ColourSwatch(SwatchColor=RGB(255, 255, 255)), m_scWithvp=False)
panel_7 = Panel(python_13.out)

# ---- group: parse tiling
python_14 = GhPythonScript(layout=python_13.layouts, i=python_4.i, j=python_4.j)  # -> out, coords_rows; inputs layout: list
# ---------- python_14: Python ----------
import ghpythonlib.treehelpers as th
import math
x= []
y = []

rows = []
ratio = j/i
size = int(math.floor(math.sqrt(len(layout)) * ratio))


for i, v in enumerate(layout):
    if i % size == 0:
        rows.append([])
    rows[-1].append(v)
    
coords_rows = th.list_to_tree(rows)
#for lyo in layout:
##    print cells
#    srt = sorted(cells)
##    print srt
#    for c in srt:
#        
#        x.append(c[0])
#        y.append(c[1])
# ---------- end python_14 ----------

# ----
item = ListItem(List=python_13.layouts, Index=0, Wrap=True)
python_15 = GhPythonScript(rows=python_14.coords_rows, xoff=python_4.j, yoff=python_4.i)  # -> out, x, y; inputs rows: tree
# ---------- python_15: Python ----------
import ghpythonlib.treehelpers as th
import gblock.elements.layout as layout
reload(layout)

lst_rows = th.tree_to_list(rows)

row_col_num = [r for r in lst_rows]
class Apt:
    pass
    
x = []
y = []
for i, row in enumerate(row_col_num):
    x.append([])
    y.append([])
    for j, col in enumerate(row):
        ii = i*xoff
        jj = j* yoff
#        print (jj, ii)
        row_col_num[i][j].dispPadding = (jj, ii)
        xa = Apt()
        xa.data = [[v[0] for v in g] for g in row_col_num[i][j].display_coords()]
        ya = Apt()
        ya.data = [[v[1] for v in g] for g in row_col_num[i][j].display_coords()]
        x[-1].append(xa)
        y[-1].append(ya)
        
        
x = th.list_to_tree(x)
y = th.list_to_tree(y)
# ---------- end python_15 ----------
python_16 = GhPythonScript(x=python_15.x)  # -> out, a
# ---------- python_16: Python ----------
import ghpythonlib.treehelpers as th
print x.data
a = x.data
# ---------- end python_16 ----------
python_17 = GhPythonScript(x=python_15.y)  # -> out, a; same code as python_16
python_18 = GhPythonScript(xx=python_16.a, yy=python_17.a)  # -> out, x, y
# ---------- python_18: Python ----------
import ghpythonlib.treehelpers as th

x = xx
y = yy
# ---------- end python_18 ----------

# ---- group: generate geometry
tiling_3 = Tiling(index_x=python_18.x, index_y=python_18.y)  # -> cell_srf, cell_rect, cell_pt

# ----
data = Data(tiling_3.cell_rect)
python_19 = GhPythonScript(matrix=python_13.layouts)  # -> out, unique; inputs matrix: list
# ---------- python_19: Python ----------
import ghpythonlib.treehelpers as th

d= [[(i, j) for j in range(3)] for i in range(3)]
dim = []
for r in d:
    for v in r:
        dim.append(v)
        
#print dim

def unq(a, b):
    minx = min([v[0] for v in b])
    miny = min([v[1] for v in b])
    maxy = max([v[1]-miny for v in b])
    
#    s = set(a) ^ set(b)
    s = list(b)
#    sm = [(x-minx)+(y-miny) for (x,y) in s]
    sm = [(x-minx)+(y-miny)+(s[-1][0]-minx)+(s[0][1]-miny) for (x,y) in s]
    return sum(sm)

col = []
for mtx in matrix:
    col.append([])
    for g in mtx.aptGroups:
        col[-1].append(unq(dim, g))

unique = th.list_to_tree(col)
# ---------- end python_19 ----------
color = Color(data_in=data)
pcwraplist_3 = WrapList(Items=python_19.unique, LastSaveLocalization="neutral,N")  # -> flatten(AtomList)
tstat_4 = TreeStatistics(Tree=python_14.coords_rows)  # -> Paths, Length, Count
runion = RegionUnion(Curves=data)
cluster = Cluster_2(G=data)
boundary = BoundarySurfaces(Edges=runion)
extremums = MinMax(Number=flatten(python_19.unique))  # -> Minimum, Maximum
partition_4 = PartitionList(List=pcwraplist_3, Size=tstat_4.Length)
cluster_2 = Cluster(G=data)
data_2 = Data(cluster)
bnd = Bounds(Numbers=flatten(python_19.unique))
pcunwraplist_3 = UnwrapList(AtomList=partition_4, LastSaveLocalization="neutral,N")
addition_3 = Addition(A=data_2, B=ColourSwatch(SwatchColor=RGB(150, 150, 150)))
col = Colour(data_2)
remap = RemapNumbers(Value=pcunwraplist_3, Source=bnd, Target=dom)  # -> graft(Mapped), Clipped
graph = GraphMapper(
    remap.Mapped,
    x0=0,
    x1=1,
    y0=0,
    y1=1,
    container_name="Bezier",
    cpx=[0, 0.3714369535, 0.6646251082, 1],
    cpy=[0, 0.5249854922, 0.8223620653, 1])
previewlw = CustomPreviewLineweights(
    Geometry=simplify(runion),
    Shader=simplify(ColourSwatch(SwatchColor=RGBA(0, 0, 0, 212))),
    Thickness=Slider(2, range=0..10),
    Absolute=False)
previewlw_2 = CustomPreviewLineweights(Geometry=simplify(data), Shader=simplify(addition_3), Thickness=Slider(1.28, range=0..10), Absolute=False)
hsv = ColourHSV(Alpha=1, Hue=graph, Saturation=Slider(0.742, range=0..1), Value=Slider(0.991, range=0..1))
addition_4 = Addition(A=hsv, B=ColourSwatch(SwatchColor=RGB(150, 150, 150)))
previewlw_3 = CustomPreviewLineweights(Geometry=simplify(data), Shader=simplify(addition_4), Thickness=Slider(1.7, range=0..10), Absolute=False)
previewmat = CustomPreviewMaterials(Geometry=boundary, DiffuseColor=hsv, Transparency=Slider(0, range=0..10))

# ==== cluster Tiling
index_y = ClusterInput()  # index Y
index_x = ClusterInput()  # index X
data = Data(Slider(1, range=0..2))
Y = Data(index_y)
X = Data(index_x)
ghpython_script = GhPythonScript(x=Y, c=data)  # -> a
# ---------- ghpython_script: Python ----------
# -*- coding: utf-8 -*-
"""
@author: prslvtsv
"""
###############################################################
#import ghdev.devcon as dev
#reload(dev)
#
#dev.init_dev_tools(locals(),  config=dev_options, verbose=True)
###############################################################


a = x*c
# ---------- end ghpython_script ----------
ghpython_script_2 = GhPythonScript(x=X, c=data)  # -> a; same code as ghpython_script
ghpython_script_3 = GhPythonScript(x=X, c=data)  # -> a
# ---------- ghpython_script_3: Python ----------
# -*- coding: utf-8 -*-
"""
@author: prslvtsv
"""
###############################################################
#import ghdev.devcon as dev
#reload(dev)
#
#dev.init_dev_tools(locals(),  config=dev_options, verbose=True)
###############################################################


a = x*c + c
# ---------- end ghpython_script_3 ----------
ghpython_script_4 = GhPythonScript(x=Y, c=data)  # -> a; same code as ghpython_script_3
pt = ConstructPoint(XCoordinate=ghpython_script_2, YCoordinate=ghpython_script, ZCoordinate=0)
pt_2 = ConstructPoint(XCoordinate=ghpython_script_3, YCoordinate=ghpython_script_4, ZCoordinate=0)
rec_2pt = Rectangle2Pt(Plane=PlaneXY(0, 0, 0), PointA=pt, PointB=pt_2, Radius=0)  # -> Rectangle, Length
pcen = PolygonCenter(Polyline=rec_2pt.Rectangle)  # -> CenterV, CenterE, CenterA
boundary = BoundarySurfaces(Edges=rec_2pt.Rectangle)
viewer = ParamViewer(boundary)
item = ListItem(List=viewer, Index=Slider(0, range=0..10), Wrap=True)
branch = TreeBranch(Tree=rec_2pt.Rectangle, Path=item, MaintainPaths=True)
cell_srf = ClusterOutput(boundary)  # cell_srf
cell_rect = ClusterOutput(rec_2pt.Rectangle)  # cell_rect
cell_pt = ClusterOutput(pcen.CenterV)  # cell_pt
boundary_2 = BoundarySurfaces(Edges=branch)

# ==== cluster Display
geo_to_viz = ClusterInput()
data = Data(geo_to_viz)
color = Color(data_in=data)
runion = RegionUnion(Curves=data)
boundary = BoundarySurfaces(Edges=runion)
addition = Addition(A=color, B=ColourSwatch(SwatchColor=RGB(150, 150, 150)))
preview = CustomPreview(Geometry=simplify(boundary), Material=simplify(color))
previewlw = CustomPreviewLineweights(
    Geometry=simplify(runion),
    Shader=simplify(ColourSwatch(SwatchColor=RGBA(0, 0, 0, 212))),
    Thickness=Slider(2, range=0..10),
    Absolute=False)
previewlw_2 = CustomPreviewLineweights(Geometry=simplify(data), Shader=simplify(addition), Thickness=Slider(0, range=0..10), Absolute=False)
previewmat = CustomPreviewMaterials(Geometry=boundary, DiffuseColor=color, Transparency=Slider(0.197, range=0..1))
createhatch = CreateHatch(Bake=False, Curves=runion, HatchPatternName="Hatch1", HatchScale=0.8, HatchRotation=45)  # -> HatchGeometry, HatchObjects
number_slider = Slider(0.625, range=0..1)
preview_2 = CustomPreview(Geometry=simplify(createhatch.HatchGeometry), Material=simplify(color))

# ==== cluster Disp
geo_to_viz = ClusterInput()
data = Data(geo_to_viz)
color = Color(data_in=data)
runion = RegionUnion(Curves=data)
boundary = BoundarySurfaces(Edges=runion)
addition = Addition(A=color, B=ColourSwatch(SwatchColor=RGB(150, 150, 150)))
preview = CustomPreview(Geometry=simplify(boundary), Material=simplify(color))
previewlw = CustomPreviewLineweights(
    Geometry=simplify(runion),
    Shader=simplify(ColourSwatch(SwatchColor=RGBA(0, 0, 0, 212))),
    Thickness=Slider(2, range=0..10),
    Absolute=False)
previewlw_2 = CustomPreviewLineweights(Geometry=simplify(data), Shader=simplify(addition), Thickness=Slider(1.7, range=0..10), Absolute=False)
previewmat = CustomPreviewMaterials(Geometry=boundary, DiffuseColor=color, Transparency=Slider(0.211, range=0..1))
createhatch = CreateHatch(Bake=False, Curves=runion, HatchPatternName="Hatch1", HatchScale=0.8, HatchRotation=45)  # -> HatchGeometry, HatchObjects
number_slider = Slider(0.625, range=0..1)
preview_2 = CustomPreview(Geometry=simplify(createhatch.HatchGeometry), Material=simplify(color))

# ==== cluster Disp_2
data = ClusterInput()

# ---- group: display point groups
data_2 = Data(data)
tstat = TreeStatistics(Tree=data_2)  # -> Paths, Length, Count
txt = Text(tstat.Length)
txt_2 = Text(tstat.Paths)
pt = ConstructPoint(XCoordinate="0.2", YCoordinate="0.1", ZCoordinate="0.2")
concat = Concatenate(FragmentA=txt_2, FragmentB=txt)
cpreview = PreviewClasses(Geometry=data_2, Name=concat, Position=pt, Size=12, Seed=123)

# ==== cluster D
xy = ClusterInput()
x_y = GhPythonScript(xy=xy)  # -> x, y; inputs xy: list
# ---------- x_y: Python ----------
x = [a[0] for a in xy]
y = [a[1] for a in xy]
# ---------- end x_y ----------
pt = ConstructPoint(XCoordinate=x_y.x, YCoordinate=x_y.y, ZCoordinate=0)

# ---- group: compute tile rectangle
rec = Rec(p=pt)

# ----
R = ClusterOutput(rec)

# ---- group: compute label pt
pt_2 = Pt(C=rec)

# ----
T = ClusterOutput(pt_2)

# ==== cluster Cluster
G = ClusterInput()
area = Area(Geometry=G)  # -> Area, Centroid
ma = MassAddition(Input=area.Area)  # -> Result, PartialResults
data = Data(ma.Result)
bnd = Bounds(Numbers=flatten(data))
dom = ConstructDomain(DomainStart=Slider(0.182, range=0..1), DomainEnd=Slider(1, range=0..1))
remap = RemapNumbers(Value=data, Source=bnd, Target=dom)  # -> Mapped, Clipped
graph = GraphMapper(
    remap.Mapped,
    x0=0,
    x1=1,
    y0=0,
    y1=1,
    container_name="Bezier",
    cpx=[0, 0.3469126225, 0.6804535389, 1],
    cpy=[0, 0.2965884209, 0.7558469772, 1])
hsv = ColourHSV(Alpha=1, Hue=graph, Saturation=1, Value=1)
data_2 = Data(hsv)
data_3 = ClusterOutput(data_2)

# ==== cluster Cluster_2
G = ClusterInput()
area = Area(Geometry=G)  # -> Area, Centroid
ma = MassAddition(Input=area.Area)  # -> Result, PartialResults
data = Data(ma.Result)
bnd = Bounds(Numbers=flatten(data))
dom = ConstructDomain(DomainStart=Slider(0.182, range=0..1), DomainEnd=Slider(1, range=0..1))
remap = RemapNumbers(Value=data, Source=bnd, Target=dom)  # -> Mapped, Clipped
graph = GraphMapper(
    remap.Mapped,
    x0=0,
    x1=1,
    y0=0,
    y1=1,
    container_name="Bezier",
    cpx=[0, 0.3469126225, 0.6804535389, 1],
    cpy=[0, 0.2965884209, 0.7558469772, 1])
hsv = ColourHSV(Alpha=1, Hue=remap.Mapped, Saturation=1, Value=1)
data_2 = Data(hsv)
data_3 = ClusterOutput(data_2)

# ==== cluster Color
data_in = ClusterInput()  # data_in
dom = ConstructDomain(DomainStart=Slider(0.168, range=0..1), DomainEnd=Slider(0.922, range=0..1))
tstat = TreeStatistics(Tree=data_in)  # -> Paths, Length, Count
bbox = BoundingBox(Content=data_in, Plane=PlaneXY(0, 0, 0), UnionBox=True)  # -> Box, Box_2
extremums = MinMax(Number=tstat.Length)  # -> Minimum, Maximum
range = Range(Domain=dom, Steps=expr("x-1", tstat.Length))
dim = Dimensions(Surface=bbox.Box)  # -> UDimension, VDimension
area = Area(Geometry=bbox.Box)  # -> Area, Centroid
pcshuffle = Shuffle(List=range, Seed=Slider(1, range=0..1), LastSaveLocalization="neutral,N")
extremums_2 = MinMax(Number=flatten(dim.UDimension))  # -> Minimum, Maximum
wheel = ColourWheel(
    extremums_2.Maximum,
    ColourGrips_Style=10,
    ColourGrips_Grip=[5.115610268, 3.821325235, 1.989214472, 5.130807126],
    ColourGrips_Lum=[0.1, 1],
    ColourGrips_Range=[0.5123760279, 0.5123760279, 0.5123760279, 0.5123760279],
    ColourGrips_Sat=[0.2, 1])
addition = Addition(A=dim.UDimension, B=area.Area)
hsv = ColourHSV(Alpha=1, Hue=pcshuffle, Saturation=1, Value=1)
subtraction = Subtraction(A=dim.UDimension, B=extremums_2.Minimum)
hsl = ColourHSL(Alpha=0.7, Hue=pcshuffle, Saturation=1, Luminance=Slider(0.247, range=0..1))
data = Data(graft(wheel))
data_2 = Data(simplify(graft(hsv)))
item = ListItem(List=hsv, Index=subtraction, Wrap=True)  # -> simplify(Item)
panel = Panel(dim.UDimension)
addition_2 = Addition(A=data_2, B=item)
division = Division(A=addition_2, B=2)
panel_2 = Panel(division)
color_out = ClusterOutput(item)  # color_out

# ==== cluster Rec
p = ClusterInput()  # p
pdecon = Deconstruct(Point=p)  # -> XComponent, YComponent, ZComponent
data = Data(Slider(1, range=0..1))
number_slider = Slider(2, range=0..10)
ghpython_script = GhPythonScript(x=pdecon.XComponent, c=data)  # -> a; same code as ghpython_script_3
ghpython_script_2 = GhPythonScript(x=pdecon.YComponent, c=data)  # -> a; same code as ghpython_script
ghpython_script_3 = GhPythonScript(x=pdecon.XComponent, c=data)  # -> a; same code as ghpython_script
addition = Addition(A=ghpython_script_3, B=ghpython_script)
ghpython_script_4 = GhPythonScript(x=pdecon.YComponent, c=data)  # -> a; same code as ghpython_script_3
addition_2 = Addition(A=ghpython_script_2, B=ghpython_script_4)
subtraction = Subtraction(A=ghpython_script_2, B=ghpython_script_4)
subtraction_2 = Subtraction(A=ghpython_script_3, B=ghpython_script)
pt = ConstructPoint(XCoordinate=ghpython_script_3, YCoordinate=ghpython_script_2, ZCoordinate=0)
pt_2 = ConstructPoint(XCoordinate=ghpython_script, YCoordinate=ghpython_script_4, ZCoordinate=0)
division = Division(A=subtraction_2, B=number_slider)
division_2 = Division(A=subtraction, B=number_slider)
rec_2pt = Rectangle2Pt(Plane=PlaneXY(0, 0, 0), PointA=pt, PointB=pt_2, Radius=0)  # -> Rectangle, Length
vec = VectorXYZ(XComponent=division, YComponent=division_2, ZComponent=0)  # -> Vector, Length
move = Move(Geometry=rec_2pt.Rectangle, Motion=vec.Vector)  # -> Geometry, Transform
pcen = PolygonCenter(Polyline=move.Geometry)  # -> CenterV, CenterE, CenterA
boundary = BoundarySurfaces(Edges=move.Geometry)
G = ClusterOutput(move.Geometry)

# ==== cluster Pt
C = ClusterInput()
cpoly = ControlPolygon(Curve=C)  # -> Polygon, Points
item = ListItem(List=cpoly.Points, Index=[0, 1, 3], Wrap=True)
ma = MassAddition(Input=item)  # -> Result, PartialResults
division = Division(A=ma.Result, B=3)
trim = TrimTree(Tree=division, Depth=1)
T = ClusterOutput(trim)
