# Grasshopper definition SEC_[tool]_floorGenerator_02.gh (Grasshopper 1.0.7)
# plug-ins: Telepathy, Human, Fologram For Grasshopper Utilities, Pancake, Heteroptera, LunchBox, EleFront

register_for_solution_updates = Button()  # disabled
unregister = Button()  # disabled
button = Button()  # disabled
button_2 = Button()  # disabled

# ---- group: automatic recompute
python = GhPythonScript(register=register_for_solution_updates, unregister=unregister)  # -> out, autoexpire_OFF; disabled
# ---------- python: Python ----------
# -*- coding: utf-8 -*-
"""
@author: prslvtsv
"""
import scriptcontext as sc
import Grasshopper.Kernel.GH_RuntimeMessageLevel as runtimeMessage
import ghpythonremote
import Rhino
import Grasshopper as gh

def updateWithTimer(ghEnv, msec):
    def callBack(e):
        ghEnv.Component.ExpireSolution(False)
    ghDoc = ghEnv.Component.OnPingDocument()
    ghDoc.ScheduleSolution(msec,gh.Kernel.GH_Document.GH_ScheduleDelegate(callBack))
    
try:
    sc.sticky['remotepy']
    isConnected = sc.sticky['remotepy']
except:
    isConnected = False

if not isConnected:
    # recompute component every second 
    updateWithTimer(ghenv, 1000)
    raise Exception("no connection")

try:
    exec(sc.sticky['module_import_string'])
except:
    updateWithTimer(ghenv, 1000)
    ghenv.Component.AddRuntimeMessage(runtimeMessage.Error, 'failed to load modules')
    
################################################################################

#ev.ExpireEvent.init_events()

if unregister:
    ev.unregister_component_updates([ghenv])
    
if register:
    ev.register_component_updates([ghenv])

try:
    sc.sticky['component_expire'][ghenv.Component.InstanceGuid.ToString()]
    ghenv.Component.Params.Output[1].NickName = 'autoexpire: ON'
except:
    ghenv.Component.Params.Output[1].NickName = 'autoexpire: OFF'
    # ghenv.Component.ExpireSolution(True)
print 'solution computed'


# ghenv.Component.Attributes.Form.GetStyle(System.Windows.Forms.ControlStyles.StandardClick)
# ---------- end python ----------

# ----
rec = DataRecorder(python.out, DataLimit=-10, RecordData=True)  # disabled
panel = Panel(rec)  # disabled

# ---- group: tab creation
python_2 = GhPythonScript(x=button_2)  # -> out, a; disabled
# ---------- python_2: Python ----------
import rhinoscriptsyntax as rs
################################################################################
# SampleEtoTabbedDialog.py
# Copyright (c) 2018 Robert McNeel & Associates.
# See License.md in the root of this repository for details.
################################################################################

# Imports
import System
import Rhino.UI
import Eto.Drawing as drawing
import Eto.Forms as forms

################################################################################
# Creates a panel that displays a text label
################################################################################
class LabelPanel(forms.Panel):
    # Initializer
    def __init__(self):
        # create a control
        label = forms.Label()
        label.Text = "Text Label"
        # create a layout
        layout = forms.DynamicLayout()
        layout.DefaultSpacing = drawing.Size(5, 5)
        layout.Padding = drawing.Padding(10)
        # add the control to the layout
        layout.Add(label)
        # set the panel content
        self.Content = layout

################################################################################
# Creates a panel that displays a text area control
################################################################################
class TextAreaPanel(forms.Scrollable):
    # Initializer
    def __init__(self):
        # create a control
        text = forms.TextArea()
        text.Text = "Every Good Boy Deserves Fudge."
        # create a layout
        layout = forms.TableLayout()
        layout.Padding = drawing.Padding(10)
        layout.Spacing = drawing.Size(5, 5)
        layout.Rows.Add(text)
        # set the panel content
        self.Content = layout

################################################################################
# SampleEtoTabbedDialog dialog class
################################################################################
class SampleEtoTabbedDialog(forms.Dialog):
    
    # Initializer
    def __init__(self):
        self.Rnd = System.Random()
        self.Title = "Sample Eto Tabbed Dialog"
        self.Padding = drawing.Padding(10)
        self.Resizable = True
        self.Content = self.Create()
    
    # Create the dialog content
    def Create(self):
        # create default tabs
        self.TabControl = self.DefaultTabs()
        # create stack layout item for tabs
        tab_items = forms.StackLayoutItem(self.TabControl, True)
        # create layout for buttons
        button_layout = forms.StackLayout()
        button_layout.Orientation = forms.Orientation.Horizontal
        button_layout.Items.Add(None)
        button_layout.Items.Add(self.AddTab())
        button_layout.Items.Add(self.RemoveTab())
        button_layout.Items.Add(self.SelectTab())
        button_layout.Items.Add(None)
        # create stack layout for content
        layout = forms.StackLayout()
        layout.Spacing = 5
        layout.HorizontalContentAlignment = forms.HorizontalAlignment.Stretch
        # add the stuff above to this layout
        layout.Items.Add(button_layout)
        layout.Items.Add(tab_items)
        return layout
    
    # Create the default tabs
    def DefaultTabs(self):
        # creates a tab control
        control = self.CreateTabControl()
        # create and add a tab page 1
        tab1 = forms.TabPage()
        tab1.Text = "Tab 1"
        tab1.Content = self.TabOne()
        control.Pages.Add(tab1)
        # create and add a tab page 2
        tab2 = forms.TabPage()
        tab2.Text = "Tab 2"
        tab2.Content = self.TabTwo()
        control.Pages.Add(tab2)
        # return
        return control
    
    # AddTab button click handler
    def AddTabClick(self, sender, e):
        tab = forms.TabPage()
        tab.Text = "Tab" + str(self.TabControl.Pages.Count + 1)
        if (self.TabControl.Pages.Count % 2 == 0):
            tab.Content = self.TabOne()
        else:
            tab.Content = self.TabTwo()
        self.TabControl.Pages.Add(tab)
    
    # RemoveTab button click handler
    def RemoveTabClick(self, sender, e):
        if (self.TabControl.SelectedIndex >= 0 and self.TabControl.Pages.Count > 0):
            self.TabControl.Pages.RemoveAt(self.TabControl.SelectedIndex)
    
    # SelectTab button click handler
    def SelectTabClick(self, sender, e):
        if (self.TabControl.Pages.Count > 0):
            self.TabControl.SelectedIndex = self.Rnd.Next(self.TabControl.Pages.Count)
    
    # Creates an add tab button
    def AddTab(self):
        button = forms.Button()
        button.Text = "Add Tab"
        button.Click += self.AddTabClick
        return button
    
    # Creates a remove tab button
    def RemoveTab(self):
        button = forms.Button()
        button.Text = "Remove Tab"
        button.Click += self.RemoveTabClick
        return button
    
    # Creates a tab selection button
    def SelectTab(self):
        button = forms.Button()
        button.Text = "Select Tab"
        button.Click += self.SelectTabClick
        return button
    
    # Delegate function to tab position control
    def DockPositionDelegate(self, position):
        self.TabControl = position
    
    # Creates the one and only tab control
    def CreateTabControl(self):
        tab = forms.TabControl()
        # Orient the tabs at the top
        tab.TabPosition = forms.DockPosition.Top
        return tab
    
    # Creates a tab page's content
    def TabOne(self):
        control = forms.Panel()
        control.Content = LabelPanel()
        return control
    
    # Creates a tab page's content
    def TabTwo(self):
        control = forms.Panel()
        control.Content = TextAreaPanel()
        return control

################################################################################
# TestSampleEtoTabbedDialog function
################################################################################
def TestSampleEtoTabbedDialog():
    dialog = SampleEtoTabbedDialog()
    dialog.ShowModal(Rhino.UI.RhinoEtoApp.MainWindow)

################################################################################
# Check to see if this file is being executed as the 'main' python
# script instead of being used as a module by some other python script
# This allows us to use the module which ever way we want.
################################################################################
if x:
    TestSampleEtoTabbedDialog()
# ---------- end python_2 ----------

# ---- group: viewport
python_3 = GhPythonScript(x=button)  # -> out, a; disabled
# ---------- python_3: Python ----------
import rhinoscriptsyntax as rs
################################################################################
# SampleEtoViewports.py
# Copyright (c) 2017 Robert McNeel & Associates.
# See License.md in the root of this repository for details.
################################################################################
import Rhino
import Rhino.UI
import Eto.Drawing as drawing
import Eto.Forms as forms

################################################################################
# Viewports dialog class
################################################################################
class ViewportsDialog(forms.Dialog[bool]):
    
    # Initializer
    def __init__(self):
        # Initialize dialog box
        self.Title = 'Rhino Viewport in an Eto Control'
        self.Padding = drawing.Padding(5)
        self.Resizable = True
        # Create viewport controls
        viewport0 = Rhino.UI.Controls.ViewportControl(Size = drawing.Size(400, 400))
        viewport1 = Rhino.UI.Controls.ViewportControl(Size = drawing.Size(400, 400))
        # Create layout
        layout = forms.DynamicLayout()
        layout.Padding = drawing.Padding(5)
        layout.Spacing = drawing.Size(5, 5)
        layout.AddRow(viewport0)
        layout.AddRow(viewport1)
        layout.AddRow(None)
        layout.AddRow(self.CloseButton())
        # Set the dialog content
        self.Content = layout
   
    # Close button click handler
    def OnCloseButtonClick(self, sender, e):
        self.Close(True)
   
    # Create button control
    def CloseButton(self):
        # Create the default button
        self.DefaultButton = forms.Button(Text = 'Close')
        self.DefaultButton.Click += self.OnCloseButtonClick
        return self.DefaultButton
    
################################################################################
# Function to test the viewport dialog
################################################################################
def TestViewportsDialog():
    dlg = ViewportsDialog()
    dlg.ShowModal(Rhino.UI.RhinoEtoApp.MainWindow)
     
################################################################################
# Check to see if this file is being executed as the "main" python
# script instead of being used as a module by some other python script
# This allows us to use the module which ever way we want.
################################################################################
if x:
    TestViewportsDialog()
# ---------- end python_3 ----------

# ---- group: templated of gh script
toggle = BooleanToggle(False)  # disabled
template = GhPythonScript(autoUpdate=toggle)  # -> out, a; disabled
# ---------- template: Python ----------
# -*- coding: utf-8 -*-
"""
@author: prslvtsv
"""

################################################################################
# TEMPLATE CODE BELOW 
################################################################################

import scriptcontext as sc
import Grasshopper.Kernel.GH_RuntimeMessageLevel as runtimeMessage
import ghpythonremote
import Rhino
import Grasshopper as gh

def updateWithTimer(ghEnv, msec):
    def callBack(e):
        ghEnv.Component.ExpireSolution(False)
    ghDoc = ghEnv.Component.OnPingDocument()
    ghDoc.ScheduleSolution(msec,gh.Kernel.GH_Document.GH_ScheduleDelegate(callBack))
    
# ------------------------------------------------------------------------------
# looking for valid connection to remote python 
try:
    sc.sticky['remotepy']
    isConnected = sc.sticky['remotepy']
except:
    isConnected = False

if not isConnected:
    # recompute component every second 
    updateWithTimer(ghenv, 1000)
    raise Exception("no connection")

# ------------------------------------------------------------------------------
# loads puthon modules via script context
try:
    exec(sc.sticky['module_import_string'])
except:
    updateWithTimer(ghenv, 1000)
    ghenv.Component.AddRuntimeMessage(runtimeMessage.Error, 'failed to load modules')
    
# ------------------------------------------------------------------------------
# adds remote expire event functionality. To enable add autoUpdate input toggle
try:
    if ghenv.Component.Params.IndexOfInputParam('autoUpdate') == -1:
        raise Exception("no input param")
    else:
        idx = ghenv.Component.Params.IndexOfInputParam('autoUpdate')
        if ghenv.Component.Params.Input[idx].Name != 'autoUpdate':
            raise Exception("no input param")
    if autoUpdate:
        if not ev.is_tracking_updates(ghenv):
            ev.register_component_updates([ghenv])
            print "autoupdate registered"
    else:
        if ev.is_tracking_updates(ghenv):
            ev.unregister_component_updates([ghenv])
            print "autoupdate unregistered"
    
    if ev.is_tracking_updates(ghenv):
        if sc.sticky[ev.key_comp_expire][ghenv.Component.InstanceGuid.ToString()]:
            print 'automatically updated'
except:
#    if ghenv.Component.Params.Input.Count > 0:
#        if ghenv.Component.Params.Input[0].NickName != 'autoUpdate':
#            ghenv.Component.Params.Input[0].NickName = 'autoUpdate'
#            ghenv.Component.Params.Input[0].Name = 'autoUpdate'
#            ghenv.Component.ExpireSolution(True)
    pass

################################################################################
# USER CODE BELOW 
################################################################################
# ---------- end template ----------

# ----
button_3 = Button()  # disabled
button_4 = Button()  # disabled
python_4 = GhPythonScript()  # -> out, a; disabled
# ---------- python_4: Python ----------
import rhinoscriptsyntax as rs
import scriptcontext as sc
import Grasshopper.Kernel as kernel

if 'events' not in sc.sticky:
    sc.sticky['events'] = {}
sc.sticky['flag'] = False

def subscribe_to(event, func, key):
    if key not in sc.sticky['events']:
        sc.sticky['events'][key] = event
    if key not in sc.sticky:
        sc.sticky[key] = func
        event += sc.sticky[key]

def unsubscribe_all():
    for key in sc.sticky['events']:
        if key in sc.sticky:
            sc.sticky['events'][key] -= sc.sticky[key]
            sc.sticky.Remove(key)
    sc.sticky['events'] = {}

# Set global flag to 'True' when event is fired
def event1(sender, e):
    sc.sticky['flag'] = True

# ExpireSolution if global flag is 'True' and set it back to 'False'
def event2(sender, e):
    if sc.sticky['flag'] == True:
        ghenv.Component.ExpireSolution(True)
        sc.sticky['flag'] = False

def event3(sender, e):
    unsubscribe_all()

#subscribe_to(doc.BeforeTransformObjects, event1, 'BeforeTransformObjects')
#subscribe_to(Rhino.RhinoDoc.DeleteRhinoObject, event1, 'DeleteRhinoObject')
#subscribe_to(Rhino.RhinoApp.Idle, event2, 'Idle')
#subscribe_to(Rhino.RhinoDoc.CloseDocument, event3, 'CloseDocument')
#subscribe_to(Rhino.RhinoDoc.NewDocument, event3, 'NewDocument')
# ---------- end python_4 ----------
toggle_2 = BooleanToggle(False)  # disabled
button_5 = Button()  # disabled
register_for_solution_updates_2 = Button()  # disabled

# ---- group: Event handling
python_5 = GhPythonScript(btn_subscribe=button_3, btn_unsubscribe=button_4)  # -> out, a; disabled
# ---------- python_5: Python ----------
import rhinoscriptsyntax as rs
import scriptcontext as sc
import Grasshopper.Kernel as kernel
import Rhino

if 'events' not in sc.sticky:
    sc.sticky['events'] = {}
sc.sticky['flag'] = False

def subscribe_to(event, func, key):
    if key not in sc.sticky['events']:
        sc.sticky['events'][key] = event
    if key not in sc.sticky:
        sc.sticky[key] = func
        event += sc.sticky[key]

def unsubscribe_all():
    for key in sc.sticky['events']:
        if key in sc.sticky:
            sc.sticky['events'][key] -= sc.sticky[key]
            sc.sticky.Remove(key)
    sc.sticky['events'] = {}

# Set global flag to 'True' when event is fired
def set_expire_flag(sender, e):
    sc.sticky['flag'] = True
    
def ping_event(sender, e):
    rs.MessageBox ("ping event", buttons=0, title='Leaving Dialog')

# ExpireSolution if global flag is 'True' and set it back to 'False'
def expire_event(sender, e):
    print 'idle event'
    if sc.sticky['flag'] == True:
        rs.MessageBox ("solution expired", buttons=0, title='Leaving Dialog')
        print 'exipred callback'
        ghenv.Component.ExpireSolution(True)
        sc.sticky['flag'] = False

def unsubscribe(sender, e):
    unsubscribe_all()


def escape_key_pressed(a, b):
    rs.MessageBox ("esc pressed", buttons=0, title='Leaving Dialog')
    print "hello"
# print sc.sticky['flag']

if btn_unsubscribe:
    print 'unsubscribed'
    unsubscribe_all()

if btn_subscribe:
    print 'subscibed' 

    
    subscribe_to(Rhino.RhinoApp.EscapeKeyPressed, escape_key_pressed, 'escapepresed')

    subscribe_to(Rhino.RhinoDoc.BeforeTransformObjects, set_expire_flag, 'BeforeTransformObjects')
    #subscribe_to(Rhino.RhinoApp.Idle, set_expire_flag, 'DeleteRhinoObject')
    subscribe_to(Rhino.RhinoApp.Idle, expire_event, 'Idle')
    subscribe_to(Rhino.RhinoDoc.CloseDocument, unsubscribe, 'CloseDocument')
    subscribe_to(Rhino.RhinoDoc.NewDocument, unsubscribe, 'NewDocument')
    
#print sc.sticky
#subscribe_to(Rhino.RhinoDoc.DeleteRhinoObject, set_expire_flag, 'DeleteRhinoObject')
#subscribe_to(ghenv.Component.PingDocument, expire_event, 'ping')
#subscribe_to(Rhino.RhinoDoc.CloseDocument, unsubscribe, 'CloseDocument')
#subscribe_to(Rhino.RhinoDoc.NewDocument, unsubscribe, 'NewDocument')
# ---------- end python_5 ----------

# ----
panel_2 = Panel(python_4.out)  # disabled
unregister_all = Button()  # disabled

# ---- group: change color of out pannel
python_6 = GhPythonScript(x=toggle_2)  # -> out, a; disabled
# ---------- python_6: Python ----------
import System.Drawing as sd
import Grasshopper.Kernel as kernel



# kernel.Special.GH_PanelProperties.Alignment.
# ghdoc = ghenv.Component.OnPingDocument()

if x:
    ghenv.Component.Params.Output[0].Recipients[0].Properties.Colour = sd.Color.Red
else:
    ghenv.Component.Params.Output[0].Recipients[0].Properties.Colour = sd.Color.WhiteSmoke
# ---------- end python_6 ----------

# ----
python_7 = GhPythonScript(x=button_5)  # -> out, a; disabled
# ---------- python_7: Python ----------
import Rhino
import scriptcontext as sc

"""
Fancy event handling class
"""
class test_event_handler(object):
    
    # Constructor 
    def __init__(self): 
        self.AddEvents()
      
    # Add Rhino event handlers
    def AddEvents(self):
#        ghenv.Component.AttributesChanged += self.OnAttrinuteChanged
        Rhino.Commands.Command.BeginCommand += self.OnBeginCommand
        Rhino.RhinoApp.Idle += self.onIdle
        
        print('Event handlers added')
        
    # Remove Rhino event handlers
    def RemoveEvents(self):
        Rhino.RhinoApp.Idle -= self.onIdle
#        ghenv.Component.AttributesChanged -= self.OnAttrinuteChanged       
        Rhino.Commands.Command.BeginCommand -= self.OnBeginCommand
        print('Event handlers removed')
    
    # Command.BeginCommand event handler
    def onIdle(self, sender, e):
        print 'idle'
        print e
        
    def OnAttrinuteChanged(self, sender, e):
        print 'attr changed fired'
        print e
        
        
    def OnBeginCommand(self, sender, e):
        print 'command began'
        print e
        commands = ['Save', 'SaveAs']
        if e.CommandEnglishName in commands:
            count = e.Document.Strings.Count
            for i in range(0, e.Document.Strings.Count):
                key = e.Document.Strings.GetKey(i)
                e.Document.Strings.Delete(key)
            print('Document string items purged: {0}'.format(count))

"""
Method to enable/disable the event handler
"""
def test_toggle_event_handler():
    handler_key = 'test_event_handler'
    if sc.sticky.has_key(handler_key):
        handler = sc.sticky[handler_key]
        if handler:
            # Remove the events added in the initializer
            handler.RemoveEvents()
            # Dispose of the event handler
            handler = None
            # Remove it from the sticky dictionary
            sc.sticky.Remove(handler_key)
    else:
        # Create the event handler
        handler = test_event_handler()
        # Add the event handler to the sticky dictionary so it
        # survives when the main function ends.
        sc.sticky[handler_key] = handler
        
if x:
    test_toggle_event_handler()

#print ghenv.Component.OnPingDocument()
# ---------- end python_7 ----------

# ---- group: generic reader
python_8 = GhPythonScript()  # -> out, polylines, points, text, other_geo; inputs reload_code: Boolean; disabled
# ---------- python_8: Python ----------
from Rhino.Geometry import Point3d, Point, Curve, Polyline, PolylineCurve, TextEntity
from Rhino.DocObjects import PointObject, CurveObject, TextObject
import gblock.ghhelp as ghh
import gblock.core as core

if reload_code:
    reload(ghh)
    reload(core)
    
geo, layer = ghh.Helper.get_obj_by_region(guid)

polylines = []
points = []
text = []
other_geo = []

for i in range(len(geo)):

    g = ghh.Helper.get_by_id_obj(geo[i])
    
    g.UserDictionary.Clear()
    state_name = layer[i].split('::')[-1]
    group_name = layer[i].split('::')[-2]
    g.UserDictionary.Set('state', state_name)
    g.UserDictionary.Set('group', group_name)
        
    if isinstance(g, CurveObject):
        # print 'curve'
        polylines.append(g)
        
    elif isinstance(g, PointObject):
        points.append(g)
        # print'point'
    elif isinstance(g, TextObject):
        text.append(g)
    else:
        other_geo.append(g)
# ---------- end python_8 ----------

# ---- group: reads floor diagram -> item of Floor()
python_9 = GhPythonScript()  # -> out, floors; inputs guid: list; disabled
# ---------- python_9: Python ----------
import gblock.ghhelp as ghh
import gblock.core as core

reload(ghh)
reload(core)

core.StateContainer.init_attributes()

floorsDefined = []

floorAttrAll = core.StateContainer.get_all_attr('floor')
floorAttrUser = core.StateContainer.get_all_attr('floor_user')

for gid in guid:
#    print gid
    floor = ghh.Helper.read_floor_from_frame(gid)
#    print isinstance(floor, core.Floor)
    floorsDefined.append(floor)
    print type(floor), ' ' , type(floorsDefined[-1])
    print isinstance(floor, core.Floor), ' ' , isinstance(floorsDefined[-1], core.Floor)
#    for at in floor.attrState.floorAttrUser:
#        print floor.attrState.floorAttrUser[at].now.value


floors = [f for f in floorsDefined]
# ---------- end python_9 ----------

# ----
viewer = ParamViewer(python_9.floors)  # disabled
rec_2 = DataRecorder(python_5.out, DataLimit=-10, RecordData=True)  # disabled
panel_3 = Panel(rec_2)  # disabled
list = ValueList({"floor", "floor_user"}, selected="floor_user")  # disabled
rec_3 = DataRecorder(python_7.out, DataLimit=-10, RecordData=True)  # disabled
panel_4 = Panel(rec_3)  # disabled

# ---- group: automatic recompute
python_10 = GhPythonScript(register=register_for_solution_updates_2, unregister=unregister_all)  # -> out, autoexpire_OFF; disabled
# ---------- python_10: Python ----------
import gblock.event_handling as ev
import scriptcontext as sc
import Rhino
import System

reload(ev)



if unregister:
    ev.ExpireEvent.untrack_all()
    
if register:
    
    exp_event = ev.ExpireEvent(ghenv.Component)
    exp_event.track(Rhino.RhinoApp.Idle, exp_event.expire_event, 'Rhino_Idle')
    ghenv.Component.ExpireSolution(True)
try:
    sc.sticky['component_expire'][ghenv.Component.InstanceGuid.ToString()]
    ghenv.Component.Params.Output[1].NickName = 'autoexpire: ON'
except:
    ghenv.Component.Params.Output[1].NickName = 'autoexpire: OFF'
    # ghenv.Component.ExpireSolution(True)
print 'solution computed'


# ghenv.Component.Attributes.Form.GetStyle(System.Windows.Forms.ControlStyles.StandardClick)
# ---------- end python_10 ----------

# ----
python_11 = GhPythonScript()  # -> out, a; disabled
# ---------- python_11: Python ----------
__author__ = "GUEST"
__version__ = "2022.05.20"

import rhinoscriptsyntax as rs

import System
for output in ghenv.Component.Params.Output[1].Recipients:
if output.Name == "Panel":
currFont = output.Properties.Font
font = System.Drawing.Font(currFont.Name,size)
output.Properties.Font = font
# ---------- end python_11 ----------

# ---- group: automatic recompute
python_12 = GhPythonScript(register=register_for_solution_updates_2, unregister=unregister_all)  # -> out, a; disabled
# ---------- python_12: Python ----------
import gblock.event_handling as ev
import scriptcontext as sc
import Rhino
reload(ev)



if unregister:
    ev.ExpireEvent.untrack_all()
    
if register:
    
    exp_event = ev.ExpireEvent(ghenv.Component)
    exp_event.track(Rhino.RhinoApp.Idle, exp_event.expire_event, 'Rhino_Idle')

print 'solution computed'
# ---------- end python_12 ----------

# ----
panel_5 = Panel(python_6.out)  # disabled
python_13 = GhPythonScript(setName=list)  # -> out, attributes; disabled
# ---------- python_13: Python ----------
import gblock.ghhelp as ghh
import gblock.core as core

reload(ghh)
reload(core)


core.StateContainer.init_attributes()
 
attr = core.StateContainer.get_all_attr(setName)

a = []
for name in attr:
    
    a.append(attr[name])
attributes = a
# ---------- end python_13 ----------
C = Counter(Trigger=python_5.out)  # disabled
rec_4 = DataRecorder(python_10.out, DataLimit=-10, RecordData=True)  # disabled
rec_5 = DataRecorder(python_12.out, DataLimit=-10, RecordData=True)  # disabled
template_exec__init = GhPythonScript()  # -> Out, A
panel_6 = Panel(rec_4)  # disabled
panel_7 = Panel(rec_5)  # disabled
button_6 = Button()  # disabled
python_14 = GhPythonScript(flag=button_6)  # -> out, a; disabled
# ---------- python_14: Python ----------
__author__ = "GUEST"
__version__ = "2022.05.24"

import rhinoscriptsyntax as rs
import scriptcontext as sc

if flag:
    sc.sticky['flag'] = True
# ---------- end python_14 ----------
python_15 = GhPythonScript(flag=button_6)  # -> out, a; disabled; same code as python_14
python_16 = GhPythonScript()  # -> out, a; disabled; unedited script template

# ----
# DEV TOOLS  //  pushed to RCP
# automatic component expire (recommpute)
sec = Slider(1, range=0..1)
sec_2 = Slider(1, range=0..1)

# ---- group: reset all registered events
reset_update_events = Button()
python_17 = GhPythonScript(resetUpdates=reset_update_events)
# ---------- python_17: Python ----------
import gblock.event_handling as ev
import scriptcontext as sc
import rhinoscriptsyntax as rs
reload(ev)

if resetUpdates:
#    if rs.MessageBox(
#    "you about to kill all autoupdates records\n" + 
#    "once done - to enable you would need to click components one by one\n" +
#    "proceed? ",
#    buttons=4,
#    title="OK if you insist",
#             ) == 6:
    idToReset = sc.sticky[ev.key_comp_event_obj].keys()
    print sc.sticky[ev.key_comp_event_obj].keys()
    ev.unregister_updates_all(idToReset)
# ---------- end python_17 ----------

# ----
button_7 = Button()  # disabled
python_18 = GhPythonScript(reload_dependencies=button_7)  # -> out; inputs reload_dependencies: Boolean; disabled
# ---------- python_18: Python ----------
import rhinoscriptsyntax as rs
import scriptcontext as sc

def reload_modules():
    try:
        sc.sticky['gblock.core']
        sc.sticky['gblock.core'] = reload(sc.sticky['gblock.core'])
        
        sc.sticky['gblock.ghhelp']
        sc.sticky['gblock.ghhelp'] = reload(sc.sticky['gblock.ghhelp'])
        
        sc.sticky['gblock.event_handling']
        sc.sticky['gblock.event_handling'] = reload(sc.sticky['gblock.event_handling'])
        
        sc.sticky['pythonScriptExpire']
        sc.sticky['pythonScriptExpire'] = True
        
        print 'modules reloaded'
    except:
        import gblock.core as core
        import gblock.ghhelp as ghh
        import gblock.event_handling as ev
        sc.sticky['gblock.core'] = core
        sc.sticky['gblock.ghhelp'] = ghh
        sc.sticky['gblock.event_handling'] = ev
        sc.sticky['pythonScriptExpire'] = True
        
        print 'modules imported'
    
    
if reload_dependencies:
    reload_modules()
    
    # ghenv.Component.ExpireSolution(True)
# ---------- end python_18 ----------

# ---- group: single register autoupdate button
group_update_reg = BooleanToggle(True)
group_update_reg_2 = RemoteSender(group_update_reg)

# ---- group: COPY ME
group_update_reg_3 = RemoteReceiver(group_update_reg_2)
# autoupdate & context loaded
# component template
toggle_3 = BooleanToggle(True)
python_19 = GhPythonScript(autoUpdate=group_update_reg_3)  # -> out, a
# ---------- python_19: Python ----------
# -*- coding: utf-8 -*-
"""
@author: prslvtsv
"""
import scriptcontext as sc
import gblock.gh_context.gh_context as context
reload(context)

###############################################################################
# CONTEXT CREATOR BELOW | ADDS DEV METODS TO COMPONENT 
# SEE GH_CONTEXT\CONTEXT_GENERAL.TXT FOR DETAILS
###############################################################################
#def init_callback(msg):
#    print msg
    
exec(compile(''.join(context.init()), 'init', 'exec'), locals())
###############################################################################
# ---------- end python_19 ----------

# ----
rec_6 = DataRecorder(python_18, DataLimit=-10, RecordData=True)  # disabled
panel_17 = Panel(rec_6)  # disabled
python_20 = GhPythonScript()  # -> out; disabled
# ---------- python_20: Python ----------
import scriptcontext as sc
import Grasshopper.Kernel as kernel

core = None
ghh = None 

try:
    core = sc.sticky['gblock.core']
    ghh = sc.sticky['gblock.ghhelp']
except:
    ghenv.Component.AddRuntimeMessage(kernel.GH_RuntimeMessageLevel.Error, 'Python modules not imported')
    ghenv.Component.ExpireSolution(True)

ghenv.Component.PingDocument.Event.Tracker
print core.__name__
print ghh.__name__
# ---------- end python_20 ----------
panel_18 = Panel("state")  # disabled
panel_20 = Panel(python_20)  # disabled

# ---- group: disable if not using
# INSPECTORS
live_update = BooleanToggle(True)

# ----
# sticky context inspector
list_2 = ValueList({"show_keys", "show_vals"}, selected=["show_keys", "show_vals"])
apply_filter = BooleanToggle(True)
global_out = BooleanToggle(False)
ignore = Panel("attrib_obj")
show = Panel("event")
inspector = GhPythonScript(
    enable_live=live_update,
    show=show,
    ignore=ignore,
    display_opt=list_2,
    apply_filter=apply_filter,
    show_global_out=global_out)  # -> out, sticky_content, events, event_obj; inputs show: list, ignore: list, display_opt: list
# ---------- inspector: Python ----------
import scriptcontext as sc
import Grasshopper.Kernel.GH_RuntimeMessageLevel as runtimeMessage
import ghpythonremote
import Rhino
import Grasshopper as gh

def updateWithTimer(ghEnv, msec):
    def callBack(e):
        ghEnv.Component.ExpireSolution(False)
    ghDoc = ghEnv.Component.OnPingDocument()
    ghDoc.ScheduleSolution(msec,gh.Kernel.GH_Document.GH_ScheduleDelegate(callBack))
    
try:
    sc.sticky['remotepy']
    isConnected = sc.sticky['remotepy']
    print 'remote_py:   ', isConnected
except:
    print 'remote_py:   ', isConnected
    isConnected = False

try:
    exec(sc.sticky['module_import_string'])
    print 'modules:     YES'
except:
    print 'modules:     NO'
#    ghenv.Component.AddRuntimeMessage(runtimeMessage.Error, 'failed to load modules')

sticky_content = []
events = []
event_obj = []

try:
    sc.sticky['events']
    print 'events:     ', len(sc.sticky['events'])
    for e in sc.sticky['events']:
        events.append(e)
except:
    print 'events:     NO'
    events = None

try:
    sc.sticky["component_event_obj"]
#    print 'events:     ', len(sc.sticky['events'])
    for e in sc.sticky["component_event_obj"]:
        event_obj.append(e)
except:
        events_obj = None

if not show_global_out:
    for key in sc.sticky.keys():
        if key == 'printglobal':
            continue
            
        if apply_filter:
            for f in show:
                if f in key:
                    if key not in ignore:
                        skey = key
                        sval = sc.sticky[key]
                        if 'show_keys' not in display_opt:
                            skey = '*'
                        if 'show_vals' not in display_opt:
                            sval = '*'
                        sticky_content.append("{}:{}".format(skey, sval))
        else:
            skey = key
            sval = sc.sticky[key]
            if 'show_keys' not in display_opt:
                skey = '*'
            if 'show_vals' not in display_opt:
                sval = '*'
            sticky_content.append("{}:{}".format(skey, sval))
else:
    try:
        sc.sticky['printglobal']
        for line in sc.sticky['printglobal']:
            sticky_content.append(line)
    except:
        sticky_content.append('no global output initilized')



if enable_live:
    updateWithTimer(ghenv, 1000)
# ---------- end inspector ----------
C_2 = Counter(Trigger=inspector.out)
panel_21 = Panel(inspector.sticky_content)
panel_22 = Panel(inspector.out)
panel_23 = Panel(inspector.events)
panel_24 = Panel(inspector.event_obj)

# ---- group: read geometry inside frames / get selection frames
# get all the "selection frames"
pipeline = GeometryPipeline(
    GroupByLayer=False,
    GroupByType=False,
    IncludeHidden=False,
    IncludeLocked=False,
    LayerFilter="Floors_input::frames",
    NameFilter="*",
    SublayerFiltering=True,
    TypeFilter=5)

# ----
python_21 = GhPythonScript(autoUpdate=Toggle(False))  # -> out, a
# ---------- python_21: Python ----------
# -*- coding: utf-8 -*-
"""
@author: prslvtsv
"""
import scriptcontext as sc
import gblock.gh_context.gh_context as context
reload(context)

###############################################################################
# CONTEXT CREATOR BELOW | ADDS DEV METODS TO COMPONENT 
# SEE GH_CONTEXT\CONTEXT_GENERAL.TXT FOR DETAILS
###############################################################################
exec(compile(''.join(context.init()), 'init', 'exec'), locals())
###############################################################################
# ---------- end python_21 ----------
python_22 = GhPythonScript()  # -> out, a
# ---------- python_22: Python ----------
# -*- coding: utf-8 -*-
"""
@author: prslvtsv
"""
import scriptcontext as sc
import gblock.gh_context.gh_context as context
reload(context)

###############################################################################
# CONTEXT CREATOR BELOW | ADDS DEV METODS TO COMPONENT 
# SEE GH_CONTEXT\CONTEXT_GENERAL.TXT FOR DETAILS
###############################################################################
exec(compile(''.join(context.init()), 'init', 'exec'), locals())
###############################################################################
print sc.id
# ---------- end python_22 ----------
C_3 = Counter(Trigger=python_21.a)
panel_25 = Panel(python_21.out)

# ---- group: read geometry inside frames
id = Guid(pipeline)
group_update_reg_4 = RemoteReceiver(group_update_reg_2)
read_floor = GhPythonScript(autoUpdate=group_update_reg_4, guid=id)  # -> out, tiles_geo, ref_geo, origin_pt, attr_txt, other_geo; inputs autoUpdate: Boolean
# ---------- read_floor: Python ----------
# -*- coding: utf-8 -*-
"""
@author: prslvtsv
"""
import scriptcontext as sc
import gblock.gh_context.gh_context as context
reload(context)

###############################################################################
# CONTEXT CREATOR BELOW | ADDS DEV METODS TO COMPONENT 
# SEE GH_CONTEXT\CONTEXT_GENERAL.TXT FOR DETAILS
###############################################################################
#print context.init()[4]
_verbose_init = False
try:
    exec(compile(context.init()[4], 'init', 'exec'), locals())
except:
    ghenv.Component.ExpireSolution(True)
###############################################################################

#from Rhino.Geometry import Point3d, Point, Curve, Polyline, PolylineCurve
from Rhino.DocObjects import CurveObject, TextObject, PointObject
import copy

tiles_geo  = []
ref_geo = []
attr_txt = []
other_geo = []
origin_pt = []
def read_guid_data():

    geo, layer = ghh.Helper.get_obj_by_region(guid)
    

    
    for i in range(len(geo)):
    
        g = ghh.Helper.get_by_id_obj(geo[i])
        g.UserDictionary.Clear()
        state_name = layer[i].split('::')[-1]
        group_name = layer[i].split('::')[-2]
        g.UserDictionary.Set('state', state_name)
        g.UserDictionary.Set('group', group_name)
            
        if isinstance(g, CurveObject):
           
            if group_name == 'tiles':
                tiles_geo.append(g)
            elif group_name == 'refgeo':
                ref_geo.append(g)
            else:
                print 'unsorted curve ', group_name, ' ', state_name
    
        elif isinstance(g, PointObject):
            if state_name == 'origin':
                origin_pt.append(g)
            else:
                print 'unsorted point ', group_name, ' ', state_name
            # print'point'
        elif isinstance(g, TextObject):
            if state_name == 'attrib_txt':
                for st in g.DisplayText.splitlines():
                    attr_txt.append(st)
                    
            else:
                print 'unsorted text ',  state_name
        else:
            print 'unsorted geometry ', group_name, ' ', state_name
#            other_geo.append(g)

ghenv.Component.Params.Input[1].Optional = True
if not ghenv.Component.Params.Input[1].VolatileData.IsEmpty:
    try:
        read_guid_data()
    except:
        print 'reading failed'
        ghenv.Component.ExpireSolution(True)
else:
#    ghenv.Component.AddRuntimeMessage(runtimeMessage.Warning, 'input data is missing')
    print 'no objects'
# ---------- end read_floor ----------
panel_26 = Panel(read_floor.attr_txt)
panel_27 = Panel(read_floor.out)

# ---- group: read attributes from py
group_update_reg_5 = RemoteReceiver(group_update_reg_2)
list_3 = ValueList({"floor", "floor_user"}, selected="floor_user")
python_23 = GhPythonScript(autoUpdate=group_update_reg_5, setName=list_3)  # -> out, attrib_names, attrib_dims, attrib_obj, mapping_dict
# ---------- python_23: Python ----------
# -*- coding: utf-8 -*-
"""
@author: prslvtsv
"""
import scriptcontext as sc
import gblock.gh_context.gh_context as context
reload(context)

###############################################################################
# CONTEXT CREATOR BELOW | ADDS DEV METODS TO COMPONENT 
# SEE GH_CONTEXT\CONTEXT_GENERAL.TXT FOR DETAILS
###############################################################################
exec(compile(''.join(context.init()), 'init', 'exec'), locals())
###############################################################################
import collections 
core.StateContainer.init_attributes()
 
attr_list = core.StateContainer.get_all_attr(setName).values()

names = np.array([a.name for a in attr_list])
dims = []



def map_addresses(attributes):
    mapping = collections.OrderedDict()
    for n, obj in enumerate(attributes):
        #print n
    
        name = obj.name
        mapping[name] = {}
        mapping[name]['pos'] = n
        
        for o, opt in enumerate(obj.options):
            mapping[name]['range'] = slice(None)
            mapping[name][opt.value] = o
    sc.sticky['attributes_mapping'] = mapping
    return mapping

for n in attr_list:

    n.valuenow = 0
    if n in 'distribution' or n in 'length':
        dims.append(1)
    else:
        dims.append(n.count_options())

###  sorting
dims = np.array(dims)
indx = (-dims).argsort()
#indx = [int(a) for a in range(len(dims))]


################
# manuallty push distr & length to end
dis = 3
dp = 8
len = 8
lp = 10
indx[lp] = 10
indx[dp] = 9
indx[11] = len
indx[12] = dis
indx[0] = 10
indx[10] = 11
print indx

dims = dims[indx]
names = names[indx]

attrib_names = [n for n in names.tolist()]
attrib_dims = [n for n in dims.tolist()]
attrib_obj =[ n for n in np.array(attr_list)[indx]]


mapping_dict = [map_addresses(attrib_obj)]

sc.sticky['attrib_names'] = attrib_names
sc.sticky['attrib_dims'] = attrib_dims
sc.sticky['attrib_obj'] = attr_list

#print names
#print dims
#print indx
# ---------- end python_23 ----------

# ----
python_24 = PythonScript(attr_glob=python_23.attrib_names)  # -> out, attrs, database, req_sort_idx; inputs attr_glob: list
# ---------- python_24: Python ----------
import scriptcontext as sc
import ghpythonremote
import Grasshopper.Kernel as kernel

try:
    sc.sticky['remotepy']
    isConnected = sc.sticky['remotepy']
except:
    isConnected = False

if not isConnected:
    ghenv.Component.ExpireSolution(True)
    raise Exception("no connection")


pd = sc.sticky['pandas']
xr = sc.sticky['xarray']
np = sc.sticky['numpy']
rpy = sc.sticky['rpy']
print '[CONNECTED]: ', isConnected
# ---------- end python_24 ----------
data = Data(python_23.attrib_names)
attr_glob = RemoteSender(python_23.attrib_obj)
panel_28 = Panel(python_23.attrib_names)  # disabled
button_8 = Button()  # disabled
toggle_4 = BooleanToggle(False)  # disabled
button_9 = Button()  # disabled
python_ru = GhPythonScript(attr_glob=data, rebuild_outputs=button_8, output_ru=toggle_4)  # -> out, port, names_en, port_2, sectionType, firstFloor, tailType, heightLimit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; inputs attr_glob: list, rebuild_outputs: Boolean; disabled
# ---------- python_ru: Python ----------
# -*- coding: utf-8 -*-
"""
@author: prslvtsv
"""
import scriptcontext as sc
import Grasshopper.Kernel.GH_RuntimeMessageLevel as runtimeMessage
import Grasshopper.Kernel as kernel


def updateComponent(msec):
    def callBack(e):
        ghenv.Component.ExpireSolution(False)
    ghDoc = ghenv.Component.OnPingDocument()
    ghDoc.ScheduleSolution(msec,gh.Kernel.GH_Document.GH_ScheduleDelegate(callBack))
    
try:
    sc.sticky['remotepy']
    isConnected = sc.sticky['remotepy']
except:
    isConnected = False

if not isConnected:
    updateComponent(1000)
    raise Exception("no connection")

try:
    exec(sc.sticky['module_import_string'])
except:
    ghenv.Component.AddRuntimeMessage(runtimeMessage.Error, 'failed to load modules')
    
################################################################################
################################################################################


core.StateContainer.init_attributes()


def get_attr_names():
#    al = []
#    for attr in attr_glob:
#        al.append(attr.name)
        
    return [a for a in attr_glob]
    
def get_attr_names_ru(cyrylic = False):
    al = []
    for attr in attr_glob:
        if cyrylic:
            al.append(attr.nameRU)
        else:
            al.append('ru__' + attr.name)
    return al

def registerOutputs(inattr):
    if ghenv.Component.Params.Output.Count >= inattr.Count:
        print 'already initialized'
        return False
        
    for attr in  inattr:
        param = kernel.Parameters.Param_GenericObject()
        param.NickName = attr
        param.Name = attr
        param.Access = kernel.GH_ParamAccess.list
        ghenv.Component.Params.RegisterOutputParam(param)
        ghenv.Component.Params.OnParametersChanged()
        
    return True
    
def unregisterOutputs():
    ghenv.Component.ExpireSolution(True)
    while ghenv.Component.Params.Output.Count > 1:
        
        ghenv.Component.Params.UnregisterOutputParameter(ghenv.Component.Params.Output[ghenv.Component.Params.Output.Count -1])
        

def get_attr_options(attr):
    opt = []
    for o in attr.options:
        opt.append(o.value)
    return opt

def get_attr_options_ru(attr):
    opt = []
    for o in attr.options:
        opt.append(o.valueRU)
    return opt
    
#        print ghenv.Component.Params.Output[i+1].Name, ' ' , attr.name
        
#        ghenv.Component.Params.Output[i+1].AddVolatileDataList(path,opt)
#            ghenv.Component.Params.Output[i+1].VolatileData.Append(kernel.Types.GH_String(o.value), path)
#        ghenv.Component.Params.Output[i+1].VolatileData.RemoveData(ghenv.Component.Params.Output[i+1].VolatileData[0])
#        print ghenv.Component.Params.Output[i+1].VolatileData.AllData(False)
#        ghenv.Component.Params.Output[i+1].Simplify = True
        

#        print attr.get_options_list()
        
        
if rebuild_outputs:
    unregisterOutputs()
    if output_ru:
        registerOutputs(['-------'] + ['names_en', 'names_ru']+ ['-------'] +get_attr_names() + ['-------'] + get_attr_names_ru())
        
    else:
        registerOutputs(['-------'] + ['names_en']+ ['-------'] +get_attr_names())
    ghenv.Component.ExpireSolution(True)


    


for a in sc.sticky['attrib_obj']:
    exec("%s = %s" % (a.name, get_attr_options(a)))
    if output_ru:
        runame = 'ru__' + a.name
        exec("%s = %s" % (runame, get_attr_options_ru(a)))
        
    #print get_attr_options_ru(a)[0]
    
    if output_ru:
        names_ru = get_attr_names_ru(True)
    names_en = get_attr_names()
#    
#    for nru in get_attr_names_ru():
#        names_ru.append(nru.split('__')[-1])
# ---------- end python_ru ----------
list_4 = ItemSelector(python_ru.residentialClass)  # disabled
list_5 = ItemSelector(python_ru.firstFloor)  # disabled
list_6 = ItemSelector(python_ru.buildingTech)  # disabled
list_7 = ItemSelector(python_ru.sectionType)  # disabled
list_8 = ItemSelector(python_ru.region)  # disabled
list_9 = ItemSelector(python_ru.tailType)  # disabled
list_10 = ItemSelector(python_ru.corridorWidth)  # disabled
list_11 = ItemSelector(python_ru.fireClass)  # disabled
list_12 = ItemSelector(python_ru.length)  # disabled
list_13 = ItemSelector(python_ru.heightLimit)  # disabled
list_14 = ItemSelector(python_ru.LLUplacement)  # disabled
list_15 = ItemSelector(python_ru.distribution)  # disabled
list_16 = ItemSelector(python_ru.groundFloorAccess)  # disabled
python_25 = PythonScript()  # -> out, database, shape2d, flat_db; inputs attr_glob: list; disabled
# ---------- python_25: Python ----------
import scriptcontext as sc
import ghpythonremote
import Grasshopper.Kernel as kernel

try:
    sc.sticky['remotepy']
    isConnected = sc.sticky['remotepy']
except:
    isConnected = False
    
if not isConnected:
    ghenv.Component.ExpireSolution(True)
    raise Exception("no connection")

import sys
import gblock.attrcnfg as acfg
reload(acfg)

pd = sc.sticky['pandas']
xr = sc.sticky['xarray']
np = sc.sticky['numpy']
rpy = sc.sticky['rpy']

#####################################################
#####################################################
#####################################################
#####################################################

def parse_params(param):
    #print param
    dimNames = np.array([att.name for att in param])
    dimDepth = np.array([len(att.options) for att in param])
    #print dimNames
    #print dimDepth
    
    crd = []
    for att in param:
#
#        for o in att.options:
#            print (att.name + " " + o.value + " " + str(len(att.options)))
#        print ()
        crd.append([opt.value for opt in att.options])
    coord = np.array(crd, dtype="object")
    indx = (-dimDepth).argsort()
    # print(dimDepth)
    # print(coord[indx].tolist())
    
    return dimNames, dimDepth, coord, indx
    #return dimNames[indx], dimDepth[indx], coord[indx], indx
    
    
def cartesianProduct(set_a, set_b):
    result = []
    for i in range(0, len(set_a)):
        for j in range(0, len(set_b)):

            # for handling case having cartesian
            # product first time of two sets
            if type(set_a[i]) != list:
                set_a[i] = [set_a[i]]

            # coping all the members
            # of set_a to temp
            temp = [num for num in set_a[i]]

            # add member of set_b to
            # temp to have cartesian product
            temp.append(set_b[j])
            result.append(temp)

    return result

def cartesian_py(list_a, n):
    # result of cartesian product
    # of all the sets taken two at a time
    temp = list_a[0]

    # do product of N sets
    for i in range(1, n):
        temp = cartesianProduct(temp, list_a[i])

    # print(temp)
    return temp


    
axis, dim, crd, sortidx = parse_params(attr_glob)

emptyDataStruct = np.zeros(dim, dtype=np.object)

attrs = [str(a) for a in axis]
database = emptyDataStruct
shape = [int(dim) for dim in emptyDataStruct.shape]
print emptyDataStruct.shape
# ---------- end python_25 ----------
python_26 = GhPythonScript(
    attr_glob=data,
    rebuild_inputs=button_8,
    sectionType=list_7,
    firstFloor=list_5,
    tailType=list_9,
    LLUplacement=list_14,
    corridorWidth=list_10,
    groundFloorAccess=list_16,
    buildingTech=list_6,
    fireClass=list_11,
    region=list_8,
    residentialClass=list_4)  # -> out, attrs_joined, address_sliced; inputs attr_glob: list, rebuild_inputs: Boolean; disabled
# ---------- python_26: Python ----------
import Grasshopper.Kernel as kernel
import scriptcontext as sc
import Grasshopper.Kernel.GH_RuntimeMessageLevel as runtimeMessage
import Grasshopper.Kernel as kernel


def updateComponent(msec):
    def callBack(e):
        ghenv.Component.ExpireSolution(False)
    ghDoc = ghenv.Component.OnPingDocument()
    ghDoc.ScheduleSolution(msec,gh.Kernel.GH_Document.GH_ScheduleDelegate(callBack))
    
try:
    sc.sticky['remotepy']
    isConnected = sc.sticky['remotepy']
except:
    isConnected = False

if not isConnected:
    updateComponent(1000)
    raise Exception("no connection")

try:
    exec(sc.sticky['module_import_string'])
except:
    ghenv.Component.AddRuntimeMessage(runtimeMessage.Error, 'failed to load modules')
    
################################################################################
################################################################################
core.StateContainer.init_attributes()

print attr_glob
def get_attr_names():
#    al = []
#    for attr in attr_glob:
#        al.append(attr.name)
        
    return [a for a in attr_glob]

def registerInputs(inattr):
    if ghenv.Component.Params.Input.Count >= inattr.Count:
        print 'already initialized'
        return False
        
    for attr in  inattr:
        param = kernel.Parameters.Param_String()
        param.NickName = attr
        param.Name = attr
        param.Access = kernel.GH_ParamAccess.item
        param.Optional = True
        
        ghenv.Component.Params.RegisterInputParam(param)
        ghenv.Component.Params.OnParametersChanged()
        
    return True
    
def unregisterInputs():
    
    while ghenv.Component.Params.Input.Count > 2:
        ghenv.Component.Params.UnregisterInputParameter(ghenv.Component.Params.Input[ghenv.Component.Params.Input.Count -1])
        
def map_address():
    names = get_attr_names()
    address = np.zeros((len(names))).tolist()
    
    
    for name in names:
        idx = ghenv.Component.Params.IndexOfInputParam(name)
        data = ghenv.Component.Params.Input[idx].VolatileData
        if not data.IsEmpty:
            data = data.Branches[0][0].Value
        else:
            data = 'range'
        if data == 'na' or data == 'n/a':
            data = 'range'

        i = sc.sticky['attributes_mapping'][name]['pos']
        address[i] = sc.sticky['attributes_mapping'][name][data]
        
    print address
    return address
        

if rebuild_inputs:
    unregisterInputs()
    registerInputs(get_attr_names())
    ghenv.Component.ExpireSolution(True)

#conctr = coctrncentrateInputs()
#attrs, idx = concentrateInputs()
#attrs_joined = ' | '.join(attrs)
#idx_joined = ' |  '. join([str(i) for i in idx])
address_sliced = map_address()
# print "⚫⚪⬛⬜"
# ---------- end python_26 ----------
matrix = ConstructMatrix(Rows=3, Columns=3)  # disabled
matrix_2 = DisplayMatrix(Digits=0)  # disabled
panel_29 = Panel(python_26.out)  # disabled
panel_30 = Panel(python_26.attrs_joined)  # disabled
toggle_5 = BooleanToggle(True)  # disabled
ghpython_script = GhPythonScript()  # -> out, states, flatten(add_unsorted), flatten(floorOut); inputs attr_list: list; disabled
# ---------- ghpython_script: Python ----------
import gblock.ghhelp as ghh
import gblock.core as core

reload(ghh)
reload(core)
#print type(floor)
#core.StateContainer.init_attributes()

    
optindx = []
states = []

def concentrateStates():
    unset = '•'
    value = unset
    res = []
    optindx = []
    
    for ix in range(len(attr_list)):
        aname = attr_list[ix].name
        stname = floor.attrState.floorAttrUser[aname].name
        stateval = floor.attrState.floorAttrUser[aname].now.value

        value = 0
        
        dx = ':'
        if stateval == 'n/a' or stateval == 'na' or stateval == '':
            value = '•'
            optindx.append(0)
        else:
            for idx, opt in enumerate(attr_list[ix].options):
                if opt.value == stateval:
                    optindx.append(idx)
                    #value = '{}||{}'.format(idx, opt.value)
                    value = opt.value
                    
        res.append(value)
        

    print res
    return res, optindx


stval, index = concentrateStates()
print stval, index
#for attr in attr_list:
#    name = floor.attrState.floorAttrUser[attr.name].name
#    value = floor.attrState.floorAttrUser[attr.name].now.value
#    #print name, ' ', value
#    states.append(value)
#    
#    if value == 'n/a':
#        optindx.append(':')
#    for idx, opt in enumerate(attr.options):
#        print opt.value, ' ', value
#        if value in opt.value:
#            optindx.append(idx)
##        else:
##            optindx.append(':')
                
print stval, index

add_unsorted = [index]
floorOut = floor
# ---------- end ghpython_script ----------
ghpython_script_2 = GhPythonScript()  # -> out, states, add_unsorted, floorOut; inputs attr_list: list; disabled
# ---------- ghpython_script_2: Python ----------
import gblock.ghhelp as ghh
import gblock.core as core

reload(ghh)
reload(core)
#print type(floor)
#core.StateContainer.init_attributes()

    
optindx = []
states = []

def concentrateStates():
    unset = '•'
    value = unset
    res = []
    optindx = []
    
    for attr in attr_list:
        aname = attr.name
        stname = floor.attrState.floorAttrUser[aname].name
        stateval = floor.attrState.floorAttrUser[aname].now.value
        print aname , stname
        # print stname, ' ', stateval
        value = 0

#        dx = ':'
        found = False
        if stateval == 'n/a' or stateval == 'na':
            value = '•'
            print stateval, ' dot replaised'
            #optindx.append(idx)
            optindx.append(0)
            res.append(value)
        else:
            for idx, opt in enumerate(attr.options):
                print opt.value, '#', stateval
                if opt.value == stateval:
                    optindx.append(idx)
                    #value = '{}||{}'.format(idx, opt.value)
                    value = opt.value
                    res.append(opt.value)
                    found = True
                elif not found:
                    print stateval, ' not found ', opt.value
#                    optindx.append(0)
#                    res.append('•')

    print res
    return res, optindx


stval, index = concentrateStates()

add_unsorted = [index]
floorOut = floor
# ---------- end ghpython_script_2 ----------
group_update_reg_6 = RemoteReceiver(group_update_reg_2)  # disabled
group_update_reg_7 = RemoteReceiver(group_update_reg_2)  # disabled
group_update_reg_8 = RemoteReceiver(group_update_reg_2)  # disabled

# ---- group: unpack tile instance
python_27 = GhPythonScript(autoUpdate=group_update_reg_6)  # -> out, ghGeo, state, appt; disabled
# ---------- python_27: Python ----------
# -*- coding: utf-8 -*-
"""
@author: prslvtsv
"""
import scriptcontext as sc
import gblock.gh_context.gh_context as context
reload(context)

###############################################################################
# CONTEXT CREATOR BELOW | ADDS DEV METODS TO COMPONENT 
# SEE GH_CONTEXT\CONTEXT_GENERAL.TXT FOR DETAILS
###############################################################################
exec(compile(''.join(context.init()), 'init', 'exec'), locals())
###############################################################################

if tile_instance != None and not isinstance(tile_instance, list):
    ghGeo = tile_instance.ghGeo
    state = tile_instance.state
    appt = tile_instance.appNumber
elif isinstance(tile_instance, list):
    ghGeo = [a.ghGeo for a in tile_instance]
    state = [a.state for a in tile_instance]
    appt = [a.appNumber for a in tile_instance]
else:
    ghGeo = None
    state = None
    appt = None

#print tile_instance.ghGeo
#print tile_instance.state
#print tile_instance.appNumber
# ---------- end python_27 ----------

python_28 = GhPythonScript(autoUpdate=group_update_reg_7)  # -> out, ghGeo, state, appt; disabled
# ---------- python_28: Python ----------
# -*- coding: utf-8 -*-
"""
@author: prslvtsv
"""
import scriptcontext as sc
import gblock.gh_context.gh_context as context
reload(context)

###############################################################################
# CONTEXT CREATOR BELOW | ADDS DEV METODS TO COMPONENT 
# SEE GH_CONTEXT\CONTEXT_GENERAL.TXT FOR DETAILS
###############################################################################
exec(compile(''.join(context.init()), 'init', 'exec'), locals())
###############################################################################

if tile_instance != None:
    ghGeo = tile_instance.ghGeo
    state = tile_instance.state
    appt = tile_instance.appNumber
else:
    ghGeo = None
    state = None
    appt = None

#print tile_instance.ghGeo
#print tile_instance.state
#print tile_instance.appNumber
# ---------- end python_28 ----------

# ----
attr_glob_2 = RemoteReceiver(attr_glob)  # disabled

# ---- group: generate empty data structure
python_29 = PythonScript(autoUpdate=group_update_reg_8, attr_glob=attr_glob_2)  # -> out, attrs, database, shape; inputs attr_glob: list; disabled
# ---------- python_29: Python ----------
# -*- coding: utf-8 -*-
"""
@author: prslvtsv
"""
import scriptcontext as sc
import gblock.gh_context.gh_context as context
reload(context)

###############################################################################
# CONTEXT CREATOR BELOW | ADDS DEV METODS TO COMPONENT 
# SEE GH_CONTEXT\CONTEXT_GENERAL.TXT FOR DETAILS
###############################################################################
exec(compile(''.join(context.init()), 'init', 'exec'), locals())
###############################################################################

from collections import Counter

def updateComponent(msec):
    def callBack(e):
        ghenv.Component.ExpireSolution(False)
    ghDoc = ghenv.Component.OnPingDocument()
    ghDoc.ScheduleSolution(msec,gh.Kernel.GH_Document.GH_ScheduleDelegate(callBack))
    
try:
    sc.sticky['remotepy']
    isConnected = sc.sticky['remotepy']
except:
    isConnected = False

if not isConnected:
    updateComponent(1000)
    raise Exception("no connection")

try:
    exec(sc.sticky['module_import_string'])
except:
    ghenv.Component.AddRuntimeMessage(runtimeMessage.Error, 'failed to load modules')
    
################################################################################
################################################################################


def parse_params(param):
    #print param
    dimNames = np.array([att.name for att in param])
    dimDepth = np.array([len(att.options) for att in param])
    #print dimNames
    #print dimDepth
    
    crd = []
    for att in param:
#
#        for o in att.options:
#            print (att.name + " " + o.value + " " + str(len(att.options)))
#        print ()
        crd.append([opt.value for opt in att.options])
    coord = np.array(crd, dtype="object")
    indx = (-dimDepth).argsort()
    # print(dimDepth)
    # print(coord[indx].tolist())
    
    return dimNames, dimDepth, coord, indx
    #return dimNames[indx], dimDepth[indx], coord[indx], indx
    
    
def cartesianProduct(set_a, set_b):
    result = []
    for i in range(0, len(set_a)):
        for j in range(0, len(set_b)):

            # for handling case having cartesian
            # product first time of two sets
            if type(set_a[i]) != list:
                set_a[i] = [set_a[i]]

            # coping all the members
            # of set_a to temp
            temp = [num for num in set_a[i]]

            # add member of set_b to
            # temp to have cartesian product
            temp.append(set_b[j])
            result.append(temp)

    return result

def cartesian_py(list_a, n):
    # result of cartesian product
    # of all the sets taken two at a time
    temp = list_a[0]

    # do product of N sets
    for i in range(1, n):
        temp = cartesianProduct(temp, list_a[i])

    # print(temp)
    return temp


    
axis, dim, crd, sortidx = parse_params(attr_glob)

emptyDataStruct = np.zeros(dim, dtype=np.object)

attrs = [str(a) for a in axis]
print [str(a) for a in axis]
database = emptyDataStruct
shape = [int(dim) for dim in emptyDataStruct.shape]
print emptyDataStruct.shape
# ---------- end python_29 ----------

# ----
panel_31 = Panel(python_29.out)  # disabled
python_30 = GhPythonScript(db=python_29.database, addr=python_26.address_sliced)  # -> out, slice; disabled
# ---------- python_30: Python ----------
# -*- coding: utf-8 -*-
"""
@author: prslvtsv
"""
import scriptcontext as sc
import gblock.gh_context.gh_context as context
reload(context)

###############################################################################
# CONTEXT CREATOR BELOW | ADDS DEV METODS TO COMPONENT 
# SEE GH_CONTEXT\CONTEXT_GENERAL.TXT FOR DETAILS
###############################################################################
exec(compile(''.join(context.init()), 'init', 'exec'), locals())
###############################################################################
#

sliced = db[tuple(addr)]
c = 0

filler = []
for i in sliced:
    filler.append([])
    c2 = 0
#    print i
    for j in i:
        filler[c].append([])
        f = ["{}:{}".format(c, 'min'), "{}:{}".format(c, 'max')]
#        print f
#        print c2
        c3 = 0
        for k in j:
            v = ''
            if c % 3 == 0:
                v = "{}:{}:{}".format(c, 'min', c2)
            else:
                v = "{}:{}:{}".format(c, 'max', c2)
            filler[c][c2].append(v)
            c3 +=1
        c2 += 1
    c +=1
flar =  np.array(filler)
#print flar[:, :]
#sliced = filler
#print sliced.shape
db[tuple(addr)] = flar

xbase = xr.DataArray(data=db,dims=sc.sticky['attrib_names'])
#print xbase
sel = dict(zip(sc.sticky['attrib_names'], addr))
#sel['heightLimit'] = 0
#print zip(sc.sticky['attrib_names'], addr)
#print xbase[sel]

#for ln in xbase[sel].stack(z=('length', 'heightLimit')).values:
#    print ln
vv = xbase[sel]
for ln in vv[:, 0].values:
    print ln
#with xr.set_options(display_style="text"):
#    display()

#print db.shape
#db[tuple(addr)] = [1, 2]
#print db[tuple(addr)]
#count =  int(len(s.ravel()))
#x_dir = 6
#y_dir = int(count/x_dir)

    
#print x_dir, ' ', y_dir
#print np.reshape(s, (x_dir, y_dir))
#print s.shape
# ---------- end python_30 ----------
group_update_reg_9 = RemoteReceiver(group_update_reg_2)  # disabled
panel_32 = Panel(python_30.out)  # disabled
panel_33 = Panel(python_30.slice)  # disabled

# ---- group: unpack tile instance
python_31 = GhPythonScript(autoUpdate=group_update_reg_9)  # -> out, ghGeo, state, appt; disabled; same code as python_27

# ----
data_2 = Data(python_31.ghGeo)  # disabled
mirror = Mirror(Plane=PlaneYZ(0, 0, 0))  # -> Geometry, Transform; disabled
number_slider = Slider(2, range=0..10)  # disabled
group_update_reg_10 = RemoteReceiver(group_update_reg_2)
attr_glob_3 = RemoteReceiver(attr_glob)

# ---- group: generate empty data structure
python_32 = PythonScript(autoUpdate=group_update_reg_10, attr_glob=attr_glob_3)  # -> out, attrs, database, shape; inputs attr_glob: list
# ---------- python_32: Python ----------
# -*- coding: utf-8 -*-
"""
@author: prslvtsv
"""
import scriptcontext as sc
import gblock.gh_context.gh_context as context
reload(context)

###############################################################################
# CONTEXT CREATOR BELOW | ADDS DEV METODS TO COMPONENT 
# SEE GH_CONTEXT\CONTEXT_GENERAL.TXT FOR DETAILS
###############################################################################
exec(compile(''.join(context.init()), 'init', 'exec'), locals())
###############################################################################

from collections import OrderedDict



def parse_params(param):
    #print param
    dimNames = np.array([att.name for att in param])
    dimDepth = np.array([len(att.options) for att in param])
    #print dimNames
    #print dimDepth
    
    crd = []
    for att in param:
#
#        for o in att.options:
#            print (att.name + " " + o.value + " " + str(len(att.options)))
#        print ()
        crd.append([opt.value for opt in att.options])
    coord = np.array(crd, dtype="object")
    indx = (-dimDepth).argsort()
    # print(dimDepth)
    # print(coord[indx].tolist())
    
    return dimNames, dimDepth, coord, indx
    #return dimNames[indx], dimDepth[indx], coord[indx], indx

    
axis, dim, crd, sortidx = parse_params(attr_glob)
attrs = [str(a) for a in axis]

def make_selector_at(i):
    return dict(OrderedDict(zip(attrs, [str(c[i]) for c in  crd])))
emptyDataStruct = np.zeros(dim, dtype=np.object)



database = emptyDataStruct
shape = [int(dim) for dim in emptyDataStruct.shape]

coordinates = OrderedDict(zip(attrs, [[str(c) for c in cc] for cc in crd]))
print coordinates
xrDataBase = xr.DataArray(data=emptyDataStruct, coords=dict(coordinates), dims=attrs)
#print type(make_selector_at(0)['corridorWidth'])
#print xrDataBase[0, 0, 0, 0, 0, 0, 0, 0, 0, 0, 0, 0, 0]
#xrDataBase.loc[make_selector_at(0)] = 'jsdfskljdn'
#print xrDataBase.loc[make_selector_at(0)]

database = xrDataBase
# ---------- end python_32 ----------

# ----
number_slider_2 = Slider(100, range=0..100)  # disabled
number_slider_3 = Slider(80, range=0..100)  # disabled
panel_34 = Panel(python_32.out)
existing_axis = Data(["residentialClass", "firstFloor", "tailType", "groundFloorAccess", "heightLimit", "LLUplacement", "corridorWidth", "buildingTech", "region", "fireClass", "sectionType", "length", "distribution"])  # disabled
panel_35 = Panel(existing_axis)  # disabled
index_mapping = Data(Tree({0;0}: ["base:0"], {0;1}: ["regularLiving:0"], {0;2}: ["openOpen:0"], {0;3}: ["undefined:0"], {0;4}: ["28:0", "50:1"], {0;5}: ["in:0", "out:1"]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))  # disabled
panel_36 = Panel(index_mapping)  # disabled

# ---- group: floor
floor_origin_points = Data(Tree({0;0;0;0;0;0;0;0;0;0;1;3;0}: [Point(-1037.236262, -214.3187596, 0)], {0;0;0;0;0;0;0;0;0;0;1;4;0}: [Point(-1037.236262, -214.3187596, 0)], {0;0;0;0;0;0;0;0;0;0;1;5;0}: [Point(-1037.236262, -214.3187596, 0)], {0;0;0;0;0;0;0;0;0;0;1;6;0}: [Point(-1037.236262, -214.3187596, 0)], {0;0;0;0;0;0;0;0;0;0;1;7;0}: [Point(-1037.236262, -214.3187596, 0)], {0;0;0;0;0;1;0;0;0;0;0;1;20}: [Point(-1051.649349, 17.68980984, 0)]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))  # disabled
all_tiles_crv = Data(Tree({0;0;0;0;0;0;0;0;0;0;1;3;0}: [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], {0;0;0;0;0;0;0;0;0;0;1;4;0}: [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], {0;0;0;0;0;0;0;0;0;0;1;5;0}: [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], {0;0;0;0;0;0;0;0;0;0;1;6;0}: [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], {0;0;0;0;0;0;0;0;0;0;1;7;0}: [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], {0;0;0;0;0;1;0;0;0;0;0;1;20}: [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]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))  # disabled
all_tiles_states = Data(Tree({0;0;0;0;0;0;0;0;0;0;1;3;0}: ["free", "corridor", "free", "free", "corridor", "free", "free", "corridor", "free", "free", "corridor", "free", "free", "corridor", "llu", "free", "corridor", "llu", "free", "corridor", "free", "free", "corridor", "free", "free", "corridor", "free"], {0;0;0;0;0;0;0;0;0;0;1;4;0}: ["free", "corridor", "free", "free", "corridor", "free", "free", "corridor", "free", "free", "corridor", "free", "free", "corridor", "free", "free", "corridor", "llu", "free", "corridor", "llu", "free", "corridor", "free", "free", "corridor", "free", "free", "corridor", "free"], {0;0;0;0;0;0;0;0;0;0;1;5;0}: ["free", "corridor", "free", "free", "corridor", "free", "free", "corridor", "free", "free", "corridor", "free", "free", "corridor", "free", "free", "corridor", "llu", "free", "corridor", "llu", "free", "corridor", "free", "free", "corridor", "free", "free", "corridor", "free", "free", "corridor", "free"], {0;0;0;0;0;0;0;0;0;0;1;6;0}: ["free", "corridor", "free", "free", "corridor", "free", "free", "corridor", "free", "free", "corridor", "free", "free", "corridor", "free", "free", "corridor", "free", "free", "corridor", "llu", "free", "corridor", "llu", "free", "corridor", "free", "free", "corridor", "free", "free", "corridor", "free", "free", "corridor", "free"], {0;0;0;0;0;0;0;0;0;0;1;7;0}: ["free", "corridor", "free", "free", "corridor", "free", "free", "corridor", "free", "free", "corridor", "free", "free", "corridor", "free", "free", "corridor", "free", "free", "corridor", "llu", "free", "corridor", "llu", "free", "corridor", "free", "free", "corridor", "free", "free", "corridor", "free", "free", "corridor", "free", "free", "corridor", "free"], {0;0;0;0;0;1;0;0;0;0;0;1;20}: ["free", "corridor", "custom", "free", "corridor", "custom", "free", "corridor", "custom", "fixed", "fixed", "fixed", "llu", "corridor", "llu", "corridor", "fixed", "corridor", "custom", "fixed", "corridor", "fixed"]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))  # disabled

# ----
data_3 = Data(Tree({0;0;0;0;0;0;0;0;0;0;1;3;0}: ["Grasshopper.Kernel.Types.GH_ObjectWrapper"], {0;0;0;0;0;0;0;0;0;0;1;4;0}: ["Grasshopper.Kernel.Types.GH_ObjectWrapper"], {0;0;0;0;0;0;0;0;0;0;1;5;0}: ["Grasshopper.Kernel.Types.GH_ObjectWrapper"], {0;0;0;0;0;0;0;0;0;0;1;6;0}: ["Grasshopper.Kernel.Types.GH_ObjectWrapper"], {0;0;0;0;0;0;0;0;0;0;1;7;0}: ["Grasshopper.Kernel.Types.GH_ObjectWrapper"], {0;0;0;0;0;1;0;0;0;0;0;1;20}: ["Grasshopper.Kernel.Types.GH_ObjectWrapper"]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))  # disabled
number_slider_4 = Slider(61.346, range=0..80)  # disabled
number_slider_5 = Slider(61.883, range=0..80)  # disabled
rectangle = Rectangle(Plane=PlaneXY(0, 0, 0), XSize=number_slider_5, YSize=number_slider_4, Radius=0)  # -> Rectangle, Length; disabled
pcen = PolygonCenter(Polyline=rectangle.Rectangle)  # -> CenterV, CenterE, CenterA; disabled
toggle_6 = BooleanToggle(False)  # disabled
viewer_2 = ParamViewer()  # disabled
python_33 = GhPythonScript()  # -> out, flatten(address); inputs address_attrs: list; disabled
# ---------- python_33: Python ----------
# -*- coding: utf-8 -*-
"""
@author: prslvtsv
"""
import scriptcontext as sc
import gblock.gh_context.gh_context as context
reload(context)

###############################################################################
# CONTEXT CREATOR BELOW | ADDS DEV METODS TO COMPONENT 
# SEE GH_CONTEXT\CONTEXT_GENERAL.TXT FOR DETAILS
###############################################################################
exec(compile(''.join(context.init()), 'init', 'exec'), locals())
###############################################################################

class Container:
    pass
c = Container()
c.data = dict([[a.split(':')[0], [a.split(':')[1]]] for a in address_attrs])
address = c
# ---------- end python_33 ----------
xy = XYPlane(Origin=Point(0, 0, 0))  # disabled
panel_37 = Panel("4")  # disabled
tree = CreateTree()  # disabled
number_slider_6 = Slider(80, range=0..100)  # disabled
number_slider_7 = Slider(46.85, range=0..50)  # disabled
number_slider_8 = Slider(50, range=0..50)  # disabled
dup = DuplicateData(Data=panel_37, Number=panel_37, Order=True)  # disabled
series = Series(Start=0, Step=number_slider_8, Count=dup)  # disabled
number_slider_9 = Slider(1.2, range=0..10)  # disabled
number_slider_10 = Slider(1.2, range=0..10)  # disabled
number_slider_11 = Slider(1.2, range=0..10)  # disabled

# ---- group: combine to simple floor container
python_34 = GhPythonScript()  # -> out, a; disabled; same code as python_21

# ----
match = MatchTree()  # disabled
series_2 = Series(Start=0, Step=expr("x * 1.1", number_slider_5), Count=10)  # -> graft(Series); disabled
series_3 = Series(Start=0, Step=expr("x * 1.1", number_slider_5), Count=10)  # disabled
extremums = MinMax(Number=series_3)  # -> Minimum, Maximum; disabled
multiplication = Multiplication(A=extremums.Maximum, B=1.1)  # disabled
pt = ConstructPoint(XCoordinate=series_3, YCoordinate=series_2, ZCoordinate=0)  # disabled
series_4 = Series(Start=0, Step=expr("x * 1.1", multiplication), Count=10)  # disabled
X = UnitX(Factor=series_4)  # disabled
addition = Addition()  # disabled
match_2 = MatchTree()  # disabled
move = Move(Geometry=graft(pt), Motion=X)  # -> simplify(Geometry), Transform; disabled

# ----
# remote python
run_remote_py = Button()
path_to_py27 = Panel("""C:\Users\GUEST\anaconda3\envs\py27\python.exe
C:\Anaconda\envs\py27\python.exe""")
is_running = BooleanToggle(True)
modules_to_connect = Panel("""numpy
pandas
xarray""")
list_17 = ValueList({"CRITICAL", "ERROR", "WARNING", "INFO", "DEBUG", "NOTSET"}, selected="ERROR")

# ---- group: pass trigger signal with delay
ghpython_script_3 = GhPythonScript(value_in=run_remote_py, trigger=run_remote_py, delay=sec_2)  # -> value_out; inputs trigger: Boolean
# ---------- ghpython_script_3: Python ----------
import time


if trigger:
    time.sleep(delay)
    value_out = value_in
else:
    ghenv.Component.Params.Output[0].ClearData()
# ---------- end ghpython_script_3 ----------

# ---- group: this makes it OFF every time a GH file is open. So you need to connect it yourself. bypass if want autocinnection
relay = GhPythonScript(start=run_remote_py, toggle=is_running)  # -> out, state
# ---------- relay: Python ----------
import rhinoscriptsyntax as rs
import scriptcontext as sc
import Grasshopper.Kernel as kernel
import System

# kernel.Special.GH_ButtonObjectAttributes.per

mykey = '{}_toggle'.format(ghenv.Component.InstanceGuid)

try:
    sc.sticky[mykey]
except:
    sc.sticky[mykey] = False
    if ghenv.Component.Params.Input[1].Sources[0].Value:
        ghenv.Component.Params.Input[1].Sources[0].Value = False
    print 'sticky created'

if start:
    ghenv.Component.Params.Input[1].Sources[0].Value = True
    
    sc.sticky[mykey] = True
    state = sc.sticky[mykey]
else:
    if not ghenv.Component.Params.Input[1].Sources[0].Value:
        sc.sticky[mykey] = False
        #ghenv.Component.ExpireSolution(True)
        
state = sc.sticky[mykey]
if state:
    ghenv.Component.Params.Output[0].Recipients[0].Properties.Colour = System.Drawing.Color.LawnGreen
else:
    ghenv.Component.Params.Output[0].Recipients[0].Properties.Colour = System.Drawing.Color.Red
print sc.sticky[mykey], ' now'
# ---------- end relay ----------
panel_38 = Panel(relay.out)

# ----
ghpythonremote = GHPythonRemote(location=path_to_py27, run=relay.state, modules=modules_to_connect, log_level=list_17)  # -> out, linked_modules, rpy; inputs location: list, run: Boolean, modules: list
# ---------- ghpythonremote: Python ----------
import inspect
import logging
from os import path
import sys
from time import sleep
import System

import scriptcontext
import Grasshopper.Kernel as kernel
import ghpythonremote
from ghpythonremote.connectors import GrasshopperToPythonRemote

location_adpt = None

try:
    remote_python_status
except:
    pass

for loc in location:
    if not location_adpt:
        if path.isfile(loc):
            location_adpt = loc
        
    #location_adpt
    
local_log_level = getattr(logging, log_level, logging.WARNING)
logger = logging.getLogger("ghpythonremote")
logger.setLevel(local_log_level)
ch = logging.StreamHandler()
ch.setLevel(local_log_level)
formatter = logging.Formatter("%(levelname)s: %(name)s:\n%(message)s")
ch.setFormatter(formatter)
logger.handlers = []
logger.addHandler(ch)
logger = logging.getLogger("ghpythonremote.GH_to_python")

ROOT = path.abspath(path.dirname(inspect.getfile(ghpythonremote)))
rpyc_server_py = path.join(ROOT, "pythonservice.py")

# Set connection to CLOSED if this is the first run
# and initialize set of linked modules
try:
    remote_python_status
except NameError:
    remote_python_status = "CLOSED"
    scriptcontext.sticky['remotepy'] = False
    lkd_modules = set()

# Wait for connection to connect or terminate
timer = 0
while remote_python_status == "CONNECTING" or remote_python_status == "CLOSING":
    sleep(1)
    timer += 1
    scriptcontext.sticky['remotepy'] = False
    if timer == 10:
        try:
            gh2py_manager.__exit__(*sys.exc_info())
        except Exception:
            pass
        remote_python_status = "CLOSED"
        scriptcontext.sticky['remotepy'] = False
        lkd_modules = set()
        raise RuntimeError(
            "Connection left in an inconsistent state and not returning. Reset "
            "everything."
        )
        


if run and  location_adpt:
    if not remote_python_status == "OPEN":
        remote_python_status = "CONNECTING"
        gh2py_manager = GrasshopperToPythonRemote(
            rpyc_server_py,
            location=location_adpt,
            timeout=10,
            port=None,
            log_level=log_level,
            working_dir= path.abspath(path.dirname(scriptcontext.doc.Path)),
        )
        gh2py = gh2py_manager.__enter__()
        remote_python_status = "OPEN"
        

    # Stuff that we can reach
    rpymod = gh2py.py_remote_modules  # A getter function for a named python module
    rpy = gh2py.connection  # Represents the remote instance root object
    scriptcontext.sticky["rpy"] = rpy
    scriptcontext.sticky['remotepy'] = True
    # Add modules
    for mod in modules:
        try:
            scriptcontext.sticky[mod] = rpymod(mod)
            lkd_modules.add(mod)
        except ImportError:
            gh2py_manager.__exit__(*sys.exc_info())
            raise

elif not remote_python_status == "CLOSED":
    remote_python_status = "CLOSING"
    scriptcontext.sticky['remotepy'] = False
    # Remove linked modules
    for mod in lkd_modules:
        del scriptcontext.sticky[mod]
    del scriptcontext.sticky["rpy"]
    gh2py_manager.__exit__(*sys.exc_info())
    lkd_modules = set()
    remote_python_status = "CLOSED"
    scriptcontext.sticky['remotepy'] = False

# Change variable name because ghpython resets outputs to None before each run
linked_modules = lkd_modules

logger.info("GH to python connection is {}".format(remote_python_status))

if not location_adpt:
    ghenv.Component.AddRuntimeMessage(kernel.GH_RuntimeMessageLevel.Error, 'Invalid python location')
    print 'ERROR: Проверьте путь к правильной версии Python'
    
if not remote_python_status == "OPEN":
    # ghenv.Component.AddRuntimeMessage(kernel.GH_RuntimeMessageLevel.Warning, 'Connection is not open')
    ghenv.Component.Params.Output[0].Recipients[0].Properties.Colour = System.Drawing.Color.Red
    if run:
        print 'ERROR: Connection failed, check log'
    else:
        print 'WARNING: Component is not running -> click button'
elif remote_python_status == 'OPEN':
    ghenv.Component.Params.Output[0].Recipients[0].Properties.Colour = System.Drawing.Color.LawnGreen
# ---------- end ghpythonremote ----------
python_35 = PythonScript(module_names=ghpythonremote.linked_modules)  # -> import_statem; inputs module_names: list; disabled
# ---------- python_35: Python ----------
import_statements = ["import scriptcontext as sc"]
for module_name in module_names:
    import_statements.append("{0} = sc.sticky['{0}']".format(module_name))

if len(module_names) == 0:
    import_statements = []
# ---------- end python_35 ----------
panel_39 = Panel(ghpythonremote.out)

# ---- group: check libs inside py component
reload_py_mod = Button()

# ---- group: press update registered components
fire_auto_update = Button()

# ----
# load/reload libs (gblock) + remote_py stuff to sticky context
or = GateOr(A=reload_py_mod, B=fire_auto_update)
or_2 = GateOr(A=ghpython_script_3, B=or)

# ---- group: pass trigger signal with delay
ghpython_script_4 = GhPythonScript(value_in=or_2, trigger=or_2, delay=sec)  # -> value_out; inputs trigger: Boolean; same code as ghpython_script_3

# ---- group: press update registered components (continued)
or_3 = GateOr(A=ghpython_script_4, B=fire_auto_update)
python_36 = GhPythonScript(recompute=or_3)
# ---------- python_36: Python ----------
import gblock.event_handling as ev
import scriptcontext as sc
import Rhino
reload(ev)

if recompute:
    for comp in sc.sticky['component_expire']:
        sc.sticky['component_expire'][comp] = True
# ---------- end python_36 ----------

# ---- group: check libs inside py component (continued)
python_37 = GhPythonScript(reload_dependencies=or_2)  # -> out, txt; inputs reload_dependencies: Boolean
# ---------- python_37: Python ----------
import rhinoscriptsyntax as rs
import scriptcontext as sc
import Grasshopper as gh

def updateComponent(msec):
    def callBack(e):
        ghenv.Component.ExpireSolution(False)
    ghDoc = ghenv.Component.OnPingDocument()
    ghDoc.ScheduleSolution(msec,gh.Kernel.GH_Document.GH_ScheduleDelegate(callBack))

def reload_modules():
    try:
        sc.sticky['gblock.core']
        sc.sticky['gblock.core'] = reload(sc.sticky['gblock.core'])
        
        sc.sticky['gblock.ghhelp']
        sc.sticky['gblock.ghhelp'] = reload(sc.sticky['gblock.ghhelp'])
        
        sc.sticky['gblock.event_handling']
        sc.sticky['gblock.event_handling'] = reload(sc.sticky['gblock.event_handling'])
        
        sc.sticky['gblock_init']
        sc.sticky['gblock_init'] = True
        
        print 'modules reloaded'
        
    except:
        import gblock.core as core
        import gblock.ghhelp as ghh
        import gblock.event_handling as ev
        sc.sticky['gblock.core'] = core
        sc.sticky['gblock.ghhelp'] = ghh
        sc.sticky['gblock.event_handling'] = ev
        sc.sticky['gblock_init'] = True
        
        print 'modules imported'
        
    print 'remote py running: ', isConnected

################################################################
try:
    sc.sticky['remotepy']
    isConnected = sc.sticky['remotepy']
except:
    isConnected = False

if not isConnected:
    updateComponent(1000)
    raise Exception("no connection")
    
    
try:
    sc.sticky['gblock_init']
    sc.sticky['module_import_string'] = ''

    if sc.sticky['gblock_init']:
        txt = sc.sticky['module_import_string']
#        txt += "import scriptcontext as sc" + '\n'
        txt += "import System" + '\n'
        txt += "core = sc.sticky['gblock.core']" + '\n'
        txt += "ghh = sc.sticky['gblock.ghhelp']" + '\n'
        txt += "ev = sc.sticky['gblock.event_handling']" + '\n'
        sc.sticky['module_import_string'] = txt
    try:
        sc.sticky['remotepy']
        
        if sc.sticky['remotepy']:
            txt = sc.sticky['module_import_string']
            txt += "pd = sc.sticky['pandas']" + '\n'
            txt += "xr = sc.sticky['xarray']" + '\n'
            txt += "np = sc.sticky['numpy']" + '\n'
            txt += "rpy = sc.sticky['rpy']" + '\n'
            sc.sticky['module_import_string'] = txt
    except:
        pass
except:
    reload_modules()

if reload_dependencies:
    reload_modules()
    
    # ghenv.Component.ExpireSolution(True)
# ---------- end python_37 ----------
whats_loaded_and_var_names_to_use = Panel(python_37.txt)

# ---- group: pull specific geometry from read data
list_18 = ValueList({"corridor", "custom", "fixed", "free", "llu"}, selected="corridor")
list_19 = ValueList({"corridor", "custom", "fixed", "free", "llu"}, selected=["custom", "fixed", "free", "llu"])
panel_40 = Panel("state")  # disabled
panel_41 = Panel("front")  # disabled
panel_42 = Panel("state")  # disabled
panel_43 = Panel("spine")  # disabled
panel_44 = Panel("state")  # disabled
panel_45 = Panel("state")  # disabled
floor_origin = RemoteSender(read_floor.origin_pt)  # disabled

# ---- group: pull specific geometry from read data / get geo by state user data
py = GhPythonScript(obj=read_floor.tiles_geo, user_data_key=panel_44, user_data_val=list_18)  # -> out, geo, user_data; inputs obj: list, user_data_val: list; disabled
# ---------- py: Python ----------
# -*- coding: utf-8 -*-
"""
@author: prslvtsv
"""
import scriptcontext as sc
import Grasshopper.Kernel.GH_RuntimeMessageLevel as runtimeMessage

# the rest of modules loaded to context.
# following is executed on load
#
# import System
# core = sc.sticky['gblock.core']
# ghh = sc.sticky['gblock.ghhelp']
# ev = sc.sticky['gblock.event_handling']

# get modules from context
try:
    exec(sc.sticky['module_import_string'])
except:
    ghenv.Component.AddRuntimeMessage(runtimeMessage.Error, 'failed to load modules')

################################################################################

geo = []
user_data = []

for o in obj:
    if o == None:
        geo = None
        user_data = None
    else:
        uVal = o.UserDictionary.GetString(user_data_key)
        for udv in user_data_val:
            if uVal== udv:
                geo.append( o.Geometry)
                user_data.append(uVal)
            elif not udv:
                geo.append( o.Geometry)
                user_data.append(uVal)
# ---------- end py ----------

py_2 = GhPythonScript(obj=read_floor.tiles_geo, user_data_key=panel_45, user_data_val=list_19)  # -> out, geo, user_data; inputs obj: list, user_data_val: list; disabled
# ---------- py_2: Python ----------
# -*- coding: utf-8 -*-
"""
@author: prslvtsv
"""
import scriptcontext as sc
import Grasshopper.Kernel.GH_RuntimeMessageLevel as runtimeMessage

# the rest of modules loaded to context.
# following is executed on load
#
# import System
# core = sc.sticky['gblock.core']
# ghh = sc.sticky['gblock.ghhelp']
# ev = sc.sticky['gblock.event_handling']

# get modules from context
try:
    exec(sc.sticky['module_import_string'])
except:
    ghenv.Component.AddRuntimeMessage(runtimeMessage.Error, 'failed to load modules')

################################################################################

geo = []
user_data = []

for o in obj:
    if o == None:
        geo = None
        user_data = None
    else:
        uVal = o.UserDictionary.GetString(user_data_key)
        for udv in user_data_val:
            if uVal== udv:
                geo.append(o.Geometry)
                user_data.append(uVal)
            elif not udv:
                geo.append(o.Geometry)
                user_data.append(uVal)
# ---------- end py_2 ----------

py_3 = GhPythonScript(obj=read_floor.ref_geo, user_data_key=panel_40, user_data_val=panel_41)  # -> out, geo, user_data; inputs obj: list; disabled
# ---------- py_3: Python ----------
# -*- coding: utf-8 -*-
"""
@author: prslvtsv
"""
import scriptcontext as sc
import Grasshopper.Kernel.GH_RuntimeMessageLevel as runtimeMessage

# the rest of modules loaded to context.
# following is executed on load
#
# import System
# core = sc.sticky['gblock.core']
# ghh = sc.sticky['gblock.ghhelp']
# ev = sc.sticky['gblock.event_handling']

# get modules from context
try:
    exec(sc.sticky['module_import_string'])
except:
    ghenv.Component.AddRuntimeMessage(runtimeMessage.Error, 'failed to load modules')

################################################################################

geo = []
user_data = []

for o in obj:
    if o == None:
        geo = None
        user_data = None
    else:
        uVal = o.UserDictionary.GetString(user_data_key)
        if uVal== user_data_val:
            geo.append(o.Geometry)
            user_data.append(uVal)
        elif not user_data_val:
            geo.append(o.Geometry)
            user_data.append(uVal)
# ---------- end py_3 ----------

py_4 = GhPythonScript(obj=read_floor.ref_geo, user_data_key=panel_42, user_data_val=panel_43)  # -> out, geo, user_data; inputs obj: list; disabled; same code as py_3

# ---- group: pull specific geometry from read data (continued)
floor_flatstates = RemoteSender(py_2.user_data)  # disabled
floor_flattiles = RemoteSender(py_2.geo)  # disabled
floor_corridortiles = RemoteSender(py.geo)  # disabled
floor_corridorstates = RemoteSender(py.user_data)  # disabled
floor_spine = RemoteSender(py_4.geo)  # disabled
floor_front = RemoteSender(py_3.geo)  # disabled

# ---- group: arrange read attributes
group_update_reg_11 = RemoteReceiver(group_update_reg_2)  # disabled
attr_glob_4 = RemoteReceiver(attr_glob)  # disabled

# ---- group: arrange read attributes / modify floor state val
replace_val = GhPythonScript(autoUpdate=group_update_reg_11, attr_glob=attr_glob_4, floor_read=panel_26)  # -> out, attr_out; inputs attr_glob: list, floor_read: list; disabled
# ---------- replace_val: Python ----------
# -*- coding: utf-8 -*-
"""
@author: prslvtsv
"""
import scriptcontext as sc
import gblock.gh_context.gh_context as context
import copy
reload(context)

###############################################################################
# CONTEXT CREATOR BELOW | ADDS DEV METODS TO COMPONENT 
# SEE GH_CONTEXT\CONTEXT_GENERAL.TXT FOR DETAILS
###############################################################################
_verbose_init = False
exec(compile(''.join(context.init()), 'init', 'exec'), locals())
###############################################################################



# print attr_dict

replaced = [core.att.Attribute().assign(a) for a in attr_glob]
#print replaced[0].name
try:
    for fl in floor_read[:]:
    
        name, value = fl.split(':')
        i = sc.sticky['attrib_names'].index(name)
        if name in 'groundFloorAccess':
            if value in 'n/a':
                value = 'undefined'
        replaced[i].valuenow = str(value)
#        print replaced[i].valuenow
    #replaced[sc.sticky['attrib_names'].index('distribution')]
    attr_out = replaced
    #
    #print replaced
    #print replaced.shape()
except:
    print 'BYPASSED'
    print 'no data to work with'
    attr_out = replaced
# ---------- end replace_val ----------

# ---- group: arrange read attributes (continued)
ghpython_script_5 = GhPythonScript(attr_loc=replace_val.attr_out)  # -> out, name_val; inputs attr_loc: list; disabled
# ---------- ghpython_script_5: Python ----------
# -*- coding: utf-8 -*-
"""
@author: prslvtsv
"""
import scriptcontext as sc
import gblock.gh_context.gh_context as context
reload(context)

###############################################################################
# CONTEXT CREATOR BELOW | ADDS DEV METODS TO COMPONENT 
# SEE GH_CONTEXT\CONTEXT_GENERAL.TXT FOR DETAILS
###############################################################################
autoUpdate = False
exec(compile(''.join(context.init()), 'init', 'exec'), locals())
###############################################################################

name_val = []

for a in attr_loc:
    name_val.append('{}:{}'.format(a.name, a.valuenow))
# ---------- end ghpython_script_5 ----------
panel_46 = Panel(ghpython_script_5.name_val)  # disabled

# ----
floor_attr_obj = RemoteSender(replace_val.attr_out)  # disabled
floor_read_attr = RemoteSender(ghpython_script_5.name_val)  # disabled

# ---- group: Sort Tiles at floor level
floor_flattiles_2 = RemoteReceiver(simplify(floor_flattiles))  # disabled
floor_corridortiles_2 = RemoteReceiver(simplify(floor_corridortiles))  # disabled
floor_front_2 = RemoteReceiver(simplify(floor_front))  # disabled
floor_spine_2 = RemoteReceiver(simplify(floor_spine))  # disabled
floor_front_3 = RemoteReceiver(simplify(floor_front))  # disabled
floor_spine_3 = RemoteReceiver(simplify(floor_spine))  # disabled
sorting_crv = Data(floor_spine_2)  # disabled
middle_crv = Data(floor_spine_2)  # disabled
sorting_crv_2 = Data(floor_spine_3)  # disabled
middle_crv_2 = Data(floor_spine_3)  # disabled
tilesgeo = Data(floor_corridortiles_2)  # disabled
tilesgeo_2 = Data(floor_flattiles_2)  # disabled
pcen_2 = PolygonCenter(Polyline=tilesgeo)  # -> CenterV, CenterE, CenterA; disabled
pcen_3 = PolygonCenter(Polyline=tilesgeo_2)  # -> CenterV, CenterE, CenterA; disabled
floor_corridorstates_2 = RemoteReceiver(floor_corridorstates)  # disabled
floor_flatstates_2 = RemoteReceiver(floor_flatstates)  # disabled
number_slider_12 = Slider(2, range=0..10)  # disabled
Y = UnitY(Factor=1)  # disabled
X_2 = UnitX(Factor=1)  # disabled
Y_2 = UnitY(Factor=1)  # disabled
X_3 = UnitX(Factor=1)  # disabled
addition_2 = Addition(A=X_2, B=Y)  # disabled
addition_3 = Addition(A=X_3, B=Y_2)  # disabled
swatch = ColourSwatch(SwatchColor=RGB(0, 4, 255))  # disabled
panel_47 = Panel("0.7")  # disabled
multiplication_2 = Multiplication(A=addition_2, B=0.5)  # disabled
panel_48 = Panel("0.7")  # disabled
swatch_2 = ColourSwatch(SwatchColor=RGB(0, 255, 242))  # disabled
multiplication_3 = Multiplication(A=addition_3, B=0.5)  # disabled

# ---- group: Sort Tiles at floor level / sort along face/spine
alongcrv = SortAlongCurve(Points=pcen_2.CenterV, Curve=sorting_crv)  # -> Points, Indices; disabled

alongcrv_2 = SortAlongCurve(Points=pcen_3.CenterV, Curve=sorting_crv_2)  # -> Points, Indices; disabled

# ---- group: Sort Tiles at floor level / sorted_states
item = ListItem(List=floor_corridorstates_2, Index=alongcrv.Indices, Wrap=True)  # -> simplify(Item); disabled

# ---- group: Sort Tiles at floor level / select by sorted values
item_2 = ListItem(List=tilesgeo, Index=alongcrv.Indices, Wrap=True)  # -> simplify(Item); disabled

item_3 = ListItem(List=tilesgeo_2, Index=alongcrv_2.Indices, Wrap=True)  # -> simplify(Item); disabled

# ---- group: length + distribution generator
panel_49 = Panel("""sectionType:LLG
length:max
distribution:100""")  # disabled
panel_50 = Panel("""sectionType:LLG
length:min
distribution:100""")  # disabled
panel_51 = Panel("""sectionType:LLT
length:max
distribution:100""")  # disabled
panel_52 = Panel("""sectionType:LLT
length:min
distribution:100""")  # disabled
panel_53 = Panel("""sectionType:90NL
length:max
distribution:100""")  # disabled
panel_54 = Panel("""sectionType:90NL
length:min
distribution:100""")  # disabled
panel_55 = Panel("""sectionType:90NL
length:min
distribution:0""")  # disabled
panel_56 = Panel("""sectionType:90NL
length:max
distribution:0""")  # disabled
floor_attr_obj_2 = RemoteReceiver(simplify(floor_attr_obj))  # disabled
floor_read_attr_2 = RemoteReceiver(simplify(floor_read_attr))  # disabled
floor_origin_2 = RemoteReceiver(floor_origin)  # disabled
floor_read_attr_3 = RemoteReceiver(simplify(floor_read_attr))  # disabled
floor_origin_3 = RemoteReceiver(floor_origin)  # disabled
floor_attr_obj_3 = RemoteReceiver(simplify(floor_attr_obj))  # disabled
floor_read_attr_4 = RemoteReceiver(simplify(floor_read_attr))  # disabled
floor_origin_4 = RemoteReceiver(floor_origin)  # disabled
floor_attr_obj_4 = RemoteReceiver(simplify(floor_attr_obj))  # disabled
floor_read_attr_5 = RemoteReceiver(simplify(floor_read_attr))  # disabled
floor_origin_5 = RemoteReceiver(floor_origin)  # disabled
lng = ListLength(List=floor_read_attr_2)  # disabled
lng_2 = ListLength(List=floor_read_attr_3)  # disabled
lng_3 = ListLength(List=floor_read_attr_4)  # disabled
lng_4 = ListLength(List=floor_read_attr_5)  # disabled
number_slider_13 = Slider(5, range=0..10)  # disabled
number_slider_14 = Slider(0, range=0..10)  # disabled
toggle_7 = BooleanToggle(False)  # disabled
toggle_8 = BooleanToggle(False)  # disabled
toggle_9 = BooleanToggle(True)  # disabled
toggle_10 = BooleanToggle(True)  # disabled
toggle_11 = BooleanToggle(True)  # disabled

# ---- group: length + distribution generator / section_type_sorting
split = GhPythonScript(read_attrib=floor_read_attr_2, select_branches=panel_50)  # -> out, cull_branches, attrib_out; inputs read_attrib: list, select_branches: list; disabled
# ---------- split: Python ----------
flag  = []
for sb in select_branches:
    if sb in "\n".join(read_attrib):
        flag.append(sb in "\n".join(read_attrib))
        
#select = select_branches in "\n".join(read_attrib)
#
cull_branches = len(select_branches) == len(flag)
attrib_out = read_attrib
# ---------- end split ----------

split_2 = GhPythonScript(read_attrib=floor_read_attr_2, select_branches=panel_49)  # -> out, cull_branches, attrib_out; inputs read_attrib: list, select_branches: list; disabled; same code as split

split_3 = GhPythonScript(read_attrib=floor_read_attr_3, select_branches=panel_52)  # -> out, cull_branches, attrib_out; inputs read_attrib: list, select_branches: list; disabled; same code as split

split_4 = GhPythonScript(read_attrib=floor_read_attr_3, select_branches=panel_51)  # -> out, cull_branches, attrib_out; inputs read_attrib: list, select_branches: list; disabled; same code as split

split_5 = GhPythonScript(read_attrib=floor_read_attr_4, select_branches=panel_53)  # -> out, cull_branches, attrib_out; inputs read_attrib: list, select_branches: list; disabled; same code as split

split_6 = GhPythonScript(read_attrib=floor_read_attr_4, select_branches=panel_54)  # -> out, cull_branches, attrib_out; inputs read_attrib: list, select_branches: list; disabled; same code as split

split_7 = GhPythonScript(read_attrib=floor_read_attr_5, select_branches=panel_56)  # -> out, cull_branches, attrib_out; inputs read_attrib: list, select_branches: list; disabled; same code as split

split_8 = GhPythonScript(read_attrib=floor_read_attr_5, select_branches=panel_55)  # -> out, cull_branches, attrib_out; inputs read_attrib: list, select_branches: list; disabled; same code as split

# ---- group: force key replacement for read data
group_update_reg_12 = RemoteReceiver(group_update_reg_2)  # disabled
default_keys = Panel("""residentialClass:base
region:moscow
buildingTech:monolyth
fireClass:c0""")  # disabled

# ---- group: force key replacement for read data / replace with copy pf attr
replace_val_2 = GhPythonScript(autoUpdate=group_update_reg_12, attr_loc_in=simplify(replace_val.attr_out), pairs_to_replace=simplify(default_keys))  # -> out, attr_loc_out; inputs attr_loc_in: list, pairs_to_replace: list; disabled
# ---------- replace_val_2: Python ----------
# -*- coding: utf-8 -*-
"""
@author: prslvtsv
"""
import scriptcontext as sc
import gblock.gh_context.gh_context as context
import copy
reload(context)

###############################################################################
# CONTEXT CREATOR BELOW | ADDS DEV METODS TO COMPONENT 
# SEE GH_CONTEXT\CONTEXT_GENERAL.TXT FOR DETAILS
###############################################################################
_verbose_init = False
exec(compile(''.join(context.init()), 'init', 'exec'), locals())
###############################################################################



# print attr_dict
replaced = [core.att.Attribute().assign(a) for a in attr_loc_in]
try:
    for pair in pairs_to_replace:
        print pair
        name, value = pair.split(':')
        i = sc.sticky['attrib_names'].index(name)
#        print i, ' ', value
        replaced[i].valuenow = str(value)
        print replaced[i].valuenow
#        print replaced[i].valuenow
    #replaced[sc.sticky['attrib_names'].index('distribution')]

    #
    #print replaced
    #print replaced.shape()
except:
    print 'BYPASSED'
    print 'no data to work with'
attr_loc_out = replaced
# ---------- end replace_val_2 ----------

# ---- group: force key replacement for read data (continued)
ghpython_script_6 = GhPythonScript(attr_loc=replace_val_2.attr_loc_out)  # -> out, name_val; inputs attr_loc: list; disabled; same code as ghpython_script_5
panel_57 = Panel(ghpython_script_6.name_val)  # disabled

# ---- group: Sort Tiles at floor level (continued)
item_4 = ListItem(List=pcen_2.CenterV, Index=alongcrv.Indices, Wrap=True)  # -> simplify(Item); disabled
item_5 = ListItem(List=pcen_3.CenterV, Index=alongcrv_2.Indices, Wrap=True)  # -> simplify(Item); disabled
item_6 = ListItem(List=floor_flatstates_2, Index=alongcrv_2.Indices, Wrap=True)  # -> simplify(Item); disabled
sorted_central_pt = Data(item_4)  # disabled
sorted_core_tiles = Data(item_2)  # disabled
sorted_central_pt_2 = Data(item_5)  # disabled
sorted_flat_tiles = Data(item_3)  # disabled
floor_states_core = RemoteSender(item)  # disabled
crv_cp = CurveClosestPoint(Point=sorted_central_pt_2, Curve=middle_crv_2)  # -> simplify(Point), Parameter, Distance; disabled
floor_tiles_core = RemoteSender(sorted_core_tiles)  # disabled
eval = EvaluateCurve(Curve=middle_crv_2, Parameter=crv_cp.Parameter)  # -> Point, Tangent, Angle; disabled
vec2pt = Vector2Pt(PointA=sorted_central_pt_2, PointB=eval.Point, Unitize=True)  # -> Vector, Length; disabled
rev = Reverse(Vector=vec2pt.Vector)  # disabled
amp = Amplitude(Vector=eval.Tangent, Amplitude=number_slider_12)  # disabled
amp_2 = Amplitude(Vector=rev, Amplitude=number_slider_12)  # disabled
move_2 = Move(Geometry=sorted_central_pt, Motion=multiplication_2)  # -> Geometry, Transform; disabled
move_3 = Move(Geometry=sorted_central_pt_2, Motion=multiplication_3)  # -> Geometry, Transform; disabled
ln = Line(StartPoint=crv_cp.Point, EndPoint=sorted_central_pt_2)  # disabled
move_4 = Move(Geometry=crv_cp.Point, Motion=amp_2)  # -> Geometry, Transform; disabled
move_5 = Move(Geometry=crv_cp.Point, Motion=amp)  # -> Geometry, Transform; disabled

# ---- group: Sort Tiles at floor level / logic length
lng_5 = ListLength(List=sorted_core_tiles)  # disabled

lng_6 = ListLength(List=sorted_flat_tiles)  # disabled

# ---- group: Sort Tiles at floor level / compute abs angle
abs_ang = GhPythonScript(a=eval.Tangent, b=vec2pt.Vector)  # -> angle; disabled
# ---------- abs_ang: Python ----------
# -*- coding: utf-8 -*-
"""
@author: prslvtsv
"""
import math

dot = a.X*b.X + a.Y*b.Y      # dot product
det = a.X*b.Y - a.Y*b.X      # determinant
angle = math.atan2(det, dot)  # atan2(y, x) or atan2(sin, cos)
# ---------- end abs_ang ----------

# ---- group: Sort Tiles at floor level / map outer and inner rows to core row
incurves = PointInCurves(Point=crv_cp.Point, Curves=sorted_core_tiles)  # -> Relationship, Index, Point; disabled

# ---- group: length + distribution generator (continued)
dup_2 = DuplicateData(Data=split_2.cull_branches, Number=lng, Order=True)  # disabled
dup_3 = DuplicateData(Data=split_4.cull_branches, Number=lng_2, Order=True)  # disabled
dup_4 = DuplicateData(Data=split_5.cull_branches, Number=lng_3, Order=True)  # disabled
dup_5 = DuplicateData(Data=split_7.cull_branches, Number=lng_4, Order=True)  # disabled
cull = CullPattern(List=floor_origin_2, CullPattern=split_2.cull_branches)  # -> simplify(List); disabled
cull_2 = CullPattern(List=floor_read_attr_2, CullPattern=dup_2)  # -> simplify(List); disabled
cull_3 = CullPattern(List=floor_attr_obj_2, CullPattern=dup_2)  # -> simplify(List); disabled
cull_4 = CullPattern(List=floor_origin_3, CullPattern=split_4.cull_branches)  # -> simplify(List); disabled
cull_5 = CullPattern(List=floor_read_attr_3, CullPattern=dup_3)  # -> simplify(List); disabled
cull_6 = CullPattern(List=floor_attr_obj_3, CullPattern=dup_3)  # -> simplify(List); disabled
cull_7 = CullPattern(List=floor_origin_4, CullPattern=split_5.cull_branches)  # -> simplify(List); disabled
cull_8 = CullPattern(List=floor_read_attr_4, CullPattern=dup_4)  # -> simplify(List); disabled
cull_9 = CullPattern(List=floor_origin_5, CullPattern=split_7.cull_branches)  # -> simplify(List); disabled
clean = CleanTree(RemoveNulls=False, RemoveInvalid=False, RemoveEmpty=True, Tree=cull_2)  # disabled
cull_10 = CullPattern(List=floor_read_attr_5, CullPattern=dup_5)  # -> simplify(List); disabled
cull_11 = CullPattern(List=floor_attr_obj_4, CullPattern=dup_5)  # -> simplify(List); disabled
clean_2 = CleanTree(RemoveNulls=False, RemoveInvalid=False, RemoveEmpty=True, Tree=cull_5)  # disabled
clean_3 = CleanTree(RemoveNulls=False, RemoveInvalid=False, RemoveEmpty=True, Tree=cull_6)  # disabled
clean_4 = CleanTree(RemoveNulls=False, RemoveInvalid=False, RemoveEmpty=True, Tree=cull_3)  # disabled
clean_5 = CleanTree(RemoveNulls=False, RemoveInvalid=False, RemoveEmpty=True, Tree=cull_8)  # disabled
clean_6 = CleanTree(RemoveNulls=False, RemoveInvalid=False, RemoveEmpty=True, Tree=cull_10)  # disabled
clean_7 = CleanTree(RemoveNulls=False, RemoveInvalid=False, RemoveEmpty=True, Tree=cull_11)  # disabled
ghpython_script_7 = GhPythonScript(list_str=clean)  # -> out, join_str; inputs list_str: list; disabled
# ---------- ghpython_script_7: Python ----------
join_str = "\n".join(list_str)
# ---------- end ghpython_script_7 ----------
ghpython_script_8 = GhPythonScript(list_str=clean_2)  # -> out, join_str; inputs list_str: list; disabled; same code as ghpython_script_7
ghpython_script_9 = GhPythonScript(list_str=clean_5)  # -> out, join_str; inputs list_str: list; disabled; same code as ghpython_script_7
ghpython_script_10 = GhPythonScript(list_str=clean_6)  # -> out, join_str; inputs list_str: list; disabled; same code as ghpython_script_7
data_4 = Data(cull)  # disabled
data_5 = Data(cull_4)  # disabled
data_6 = Data(cull_7)  # disabled
data_7 = Data(cull_9)  # disabled
pcwraplist = WrapList(Items=clean_4, LastSaveLocalization="neutral,N")  # disabled
pcwraplist_2 = WrapList(Items=clean_3, LastSaveLocalization="neutral,N")  # disabled
pcwraplist_3 = WrapList(Items=clean_7, LastSaveLocalization="neutral,N")  # disabled

# ---- group: force key replacement for read data
group_update_reg_13 = RemoteReceiver(group_update_reg_2)  # disabled
default_keys_2 = Panel("""heightLimit:28
corridorWidth:1700""")  # disabled

# ---- group: force key replacement for read data / replace with copy pf attr
replace_val_3 = GhPythonScript(
    autoUpdate=group_update_reg_13,
    attr_loc_in=simplify(replace_val_2.attr_loc_out),
    pairs_to_replace=simplify(default_keys_2))  # -> out, attr_loc_out; inputs attr_loc_in: list, pairs_to_replace: list; disabled; same code as replace_val_2

# ---- group: force key replacement for read data (continued)
ghpython_script_11 = GhPythonScript(attr_loc=simplify(replace_val_3.attr_loc_out))  # -> out, simplify(name_val); inputs attr_loc: list; disabled; same code as ghpython_script_5
panel_58 = Panel(ghpython_script_11.name_val)  # disabled

# ---- group: Sort Tiles at floor level (continued)
series_5 = Series(Start=0, Step=1, Count=lng_5)  # -> simplify(Series); disabled
series_6 = Series(Start=lng_5, Step=1, Count=lng_6)  # -> simplify(Series); disabled
deg = Degrees(Radians=abs_ang)  # disabled
int = Integer(deg)  # disabled
tag = TextTag3D(Location=move_3.Geometry, Text=series_6, Size=panel_48, Colour=swatch_2, Justification=5)  # disabled

# ---- group: Sort Tiles at floor level / checks if tile out/in
python_38 = GhPythonScript(angle=deg)  # -> out, pattern_outside; disabled
# ---------- python_38: Python ----------
# -*- coding: utf-8 -*-
"""
@author: prslvtsv
"""

pattern_outside = angle < 0
# ---------- end python_38 ----------

# ---- group: Sort Tiles at floor level (continued)
not = GateNot(A=python_38.pattern_outside)  # disabled
cull_12 = CullPattern(List=incurves.Index, CullPattern=python_38.pattern_outside)  # disabled
cull_13 = CullPattern(List=incurves.Index, CullPattern=not)  # disabled
cull_14 = CullPattern(List=sorted_flat_tiles, CullPattern=not)  # disabled
cull_15 = CullPattern(List=item_6, CullPattern=not)  # disabled
floor_tiles_outside_mapping = RemoteSender(cull_12)  # disabled
cull_16 = CullPattern(List=sorted_flat_tiles, CullPattern=python_38.pattern_outside)  # disabled
cull_17 = CullPattern(List=item_6, CullPattern=python_38.pattern_outside)  # disabled
floor_tiles_inside_mapping = RemoteSender(cull_13)  # disabled
floor_tiles_inside = RemoteSender(cull_14)  # disabled
floor_state_inside = RemoteSender(cull_15)  # disabled
floor_tiles_outside = RemoteSender(cull_16)  # disabled
floor_state_outside = RemoteSender(cull_17)  # disabled
merge = Merge(Data1=simplify(floor_tiles_outside_mapping), Data2=simplify(floor_tiles_inside_mapping))  # disabled

# ---- group: Sort Tiles at floor level / display info
markdim = MarkerDimension(Line=ln, Text=incurves.Index, Size=1)  # disabled
angledim = AngularDimension(Center=eval.Point, PointA=move_4.Geometry, PointB=move_5.Geometry, Reflex=False, Text=int, Size=0.3)  # disabled
tag_2 = TextTag3D(Location=move_2.Geometry, Text=series_5, Size=panel_47, Colour=swatch, Justification=5)  # disabled

# ---- group: shape tile matrix
group_update_reg_14 = RemoteReceiver(group_update_reg_2)  # disabled
floor_tiles_outside_2 = RemoteReceiver(floor_tiles_outside)  # disabled
floor_state_outside_2 = RemoteReceiver(floor_state_outside)  # disabled
floor_states_core_2 = RemoteReceiver(floor_states_core)  # disabled
floor_state_inside_2 = RemoteReceiver(floor_state_inside)  # disabled
floor_tiles_inside_2 = RemoteReceiver(floor_tiles_inside)  # disabled
floor_tiles_core_2 = RemoteReceiver(floor_tiles_core)  # disabled
floor_origin_6 = RemoteReceiver(floor_origin)  # disabled
python_39 = GhPythonScript(autoUpdate=group_update_reg_14, tile_geo=floor_tiles_core_2, tile_state=floor_states_core_2)  # -> out, tile_instance; inputs tile_geo: Curve; disabled
# ---------- python_39: Python ----------
# -*- coding: utf-8 -*-
"""
@author: prslvtsv
"""
import scriptcontext as sc
import gblock.gh_context.gh_context as context
reload(context)

###############################################################################
# CONTEXT CREATOR BELOW | ADDS DEV METODS TO COMPONENT 
# SEE GH_CONTEXT\CONTEXT_GENERAL.TXT FOR DETAILS
###############################################################################
exec(compile(''.join(context.init()), 'init', 'exec'), locals())
###############################################################################


tile_instance = core.Tile(state=tile_state, ghGeo=tile_geo)
# ---------- end python_39 ----------
floor_tiles_inside_mapping_2 = RemoteReceiver(floor_tiles_inside_mapping)  # disabled
python_40 = GhPythonScript(autoUpdate=group_update_reg_14, tile_geo=floor_tiles_inside_2, tile_state=floor_state_inside_2)  # -> out, tile_instance; inputs tile_geo: Curve; disabled; same code as python_39
floor_tiles_outside_mapping_2 = RemoteReceiver(floor_tiles_outside_mapping)  # disabled

# ---- group: shape tile matrix / gh to TILE
python_41 = GhPythonScript(autoUpdate=group_update_reg_14, tile_geo=floor_tiles_outside_2, tile_state=floor_state_outside_2)  # -> out, tile_instance; inputs tile_geo: Curve; disabled; same code as python_39

# ---- group: shape tile matrix / create tile matrix
python_42 = GhPythonScript(
    autoUpdate=group_update_reg_14,
    tiles_out=python_41.tile_instance,
    map_out=floor_tiles_outside_mapping_2,
    tiles_core=python_39.tile_instance,
    tiles_in=python_40.tile_instance,
    map_in=floor_tiles_inside_mapping_2)  # -> out, tiles_ordered_matrix_bool, tiles_ordered_matrix_shape, tiles_ordered_matrix, column_oriented_matrix, distribution_anchor_tile_idx; inputs tiles_out: list, map_out: list, tiles_core: list, tiles_in: list, map_in: list; disabled
# ---------- python_42: Python ----------
# -*- coding: utf-8 -*-
"""
@author: prslvtsv
"""
import scriptcontext as sc
import gblock.gh_context.gh_context as context
reload(context)

###############################################################################
# CONTEXT CREATOR BELOW | ADDS DEV METODS TO COMPONENT 
# SEE GH_CONTEXT\CONTEXT_GENERAL.TXT FOR DETAILS
###############################################################################
exec(compile(''.join(context.init()), 'init', 'exec'), locals())
###############################################################################

from collections import Counter

class TileMatrix:
    pass
    
tileMatrixOrdered = []
tileMatrixOrderedBool = []
tileMatrixOrderedShape = []

for i in range(0,3):
    tileMatrixOrdered.append([])
    tileMatrixOrderedBool.append([])
    tileMatrixOrderedShape.append([])
    for j in range(0, len(tiles_core)):
        tileMatrixOrdered[i].append(None)
        tileMatrixOrderedBool[i].append(0)
        tileMatrixOrderedShape[i].append(0)


out_row = [[] for c in tiles_core]
core_row = [[c.expl_matPos([1,i])] for i, c in enumerate(tiles_core)]
inner_row = [[] for c in tiles_core]

for i, to in enumerate(tiles_out):
#    print to.UserDictionary.GetString('state')
    to.matPos = [0, map_out[i]]
    out_row[map_out[i]].append(to)
    
for i, ti in enumerate(tiles_in):
    ti.matPos = [2, map_in[i]]
    inner_row[map_in[i]].append(ti)

matrix = [out_row, core_row, inner_row]

for i, r in enumerate(tileMatrixOrdered[0]):
    if len(out_row[i]) == 0:
        tileMatrixOrdered[0][i] = [None]
    else:
        tileMatrixOrdered[0][i] = out_row[i]
    if len(core_row[i]) == 0:
        tileMatrixOrdered[1][i] = [None]
    else:
        tileMatrixOrdered[1][i] = core_row[i]
        
    if len(inner_row[i]) == 0:
        tileMatrixOrdered[2][i] = [None]
    else:
        tileMatrixOrdered[2][i] = inner_row[i]
    
for i, r in enumerate(tileMatrixOrdered):
    for j, rj in enumerate(tileMatrixOrdered[i]):
        tileMatrixOrderedShape[i][j] = len(tileMatrixOrdered[i][j])
#        for rjk in rj:
#            print rjk.matPos
        if len(tileMatrixOrdered[i][j]) > 0:
            tileMatrixOrderedBool[i][j] = True
        else:
            tileMatrixOrderedBool[i][j] = False

tmo = TileMatrix()
tmo.data = tileMatrixOrdered

tmos = TileMatrix()
tmos.data = tileMatrixOrderedShape

tmob = TileMatrix()
tmob.data = tileMatrixOrderedBool


flipped_matrix = [] 

for i, iv in enumerate(tileMatrixOrdered[1]):
    column = [tileMatrixOrdered[0][i], tileMatrixOrdered[1][i], tileMatrixOrdered[2][i]]
    flipped_matrix.append(column)


corner_collapse_tile_idx = None
if Counter(map_out).most_common(1)[0][1] > 1:
    corner_collapse_tile_idx = Counter(map_out).most_common(1)[0][0]

#mid = Counter(map_in).most_common(1)[0][0]



com = TileMatrix()
com.data = flipped_matrix
column_oriented_matrix = com

tiles_ordered_matrix = tmo
tiles_ordered_matrix_shape = tmos
tiles_ordered_matrix_bool = tmob

distribution_anchor_tile_idx = corner_collapse_tile_idx
# ---------- end python_42 ----------

# ---- group: shape tile matrix / graft tree from matrix structure
graft_matrix_tree = GhPythonScript(autoUpdate=toggle_5, tileMatrix=python_42.column_oriented_matrix)  # -> out, simplify(a); inputs tileMatrix: tree; disabled
# ---------- graft_matrix_tree: Python ----------
# -*- coding: utf-8 -*-
"""
@author: prslvtsv
"""
import scriptcontext as sc
import gblock.gh_context.gh_context as context
reload(context)

###############################################################################
# CONTEXT CREATOR BELOW | ADDS DEV METODS TO COMPONENT 
# SEE GH_CONTEXT\CONTEXT_GENERAL.TXT FOR DETAILS
###############################################################################
exec(compile(''.join(context.init()), 'init', 'exec'), locals())
###############################################################################

import ghpythonlib.treehelpers as th
import Rhino

class TileSlot:
    def add(self, data):
        self.data = data
        return self


print [p.Indices for p in ghenv.Component.Params.Input[1].VolatileData.Paths]

a = []
bb = [] 
lst = th.tree_to_list(tileMatrix, None)
for j, p in enumerate(ghenv.Component.Params.Input[1].VolatileData.Paths):
    nested = []
    for i,v in enumerate(lst[j]):
        column = []
        for tileSlot in v.data:
            column.append([TileSlot().add(tt) for tt in tileSlot])
        nested.append(column)
    bb.append(nested)
    
a = th.list_to_tree(bb, True, [0,0])
# ---------- end graft_matrix_tree ----------

# ---- group: shape tile matrix (continued)
shape_unpack = GhPythonScript(y=python_42.tiles_ordered_matrix_shape)  # -> out, a; disabled
# ---------- shape_unpack: Python ----------
# -*- coding: utf-8 -*-
"""
@author: prslvtsv
"""
import scriptcontext as sc
import gblock.gh_context.gh_context as context
reload(context)

###############################################################################
# CONTEXT CREATOR BELOW | ADDS DEV METODS TO COMPONENT 
# SEE GH_CONTEXT\CONTEXT_GENERAL.TXT FOR DETAILS
###############################################################################
exec(compile(''.join(context.init()), 'init', 'exec'), locals())
###############################################################################

a = []
for i,iv in enumerate(y.data):
    for j, jv in enumerate(iv):
        a.append(jv)

print a
print y.data[0][:]
print y.data[1][:]
print y.data[2][:]
# ---------- end shape_unpack ----------
panel_59 = Panel(shape_unpack.a)  # disabled
tile_distrib_anchors = RemoteSender(python_42.distribution_anchor_tile_idx)  # disabled
tile_column_like_matrix = RemoteSender(graft_matrix_tree.a)  # disabled

# ----
floor_distrib_anchor = RemoteSender(python_42.distribution_anchor_tile_idx)  # disabled
floor_tile_matrix = RemoteSender(python_42.column_oriented_matrix)  # disabled

# ---- group: length + distribution generator (continued)
floor_tile_matrix_2 = RemoteReceiver(floor_tile_matrix)  # disabled
floor_tile_matrix_3 = RemoteReceiver(floor_tile_matrix)  # disabled
floor_tile_matrix_4 = RemoteReceiver(floor_tile_matrix)  # disabled
floor_tile_matrix_5 = RemoteReceiver(floor_tile_matrix)  # disabled
floor_distrib_anchor_2 = RemoteReceiver(floor_distrib_anchor)  # disabled
floor_tile_matrix_6 = RemoteReceiver(floor_tile_matrix)  # disabled
floor_tile_matrix_7 = RemoteReceiver(floor_tile_matrix)  # disabled
floor_distrib_anchor_3 = RemoteReceiver(floor_distrib_anchor)  # disabled
floor_tile_matrix_8 = RemoteReceiver(floor_tile_matrix)  # disabled
floor_tile_matrix_9 = RemoteReceiver(floor_tile_matrix)  # disabled
cull_18 = CullPattern(List=floor_tile_matrix_2, CullPattern=split_2.cull_branches)  # -> simplify(List); disabled
cull_19 = CullPattern(List=floor_tile_matrix_3, CullPattern=split.cull_branches)  # -> simplify(List); disabled
cull_20 = CullPattern(List=floor_tile_matrix_4, CullPattern=split_4.cull_branches)  # -> simplify(List); disabled
cull_21 = CullPattern(List=floor_tile_matrix_5, CullPattern=split_3.cull_branches)  # -> simplify(List); disabled
cull_22 = CullPattern(List=floor_tile_matrix_6, CullPattern=split_5.cull_branches)  # -> simplify(List); disabled
cull_23 = CullPattern(List=floor_distrib_anchor_2, CullPattern=split_5.cull_branches)  # -> simplify(List); disabled
cull_24 = CullPattern(List=floor_tile_matrix_9, CullPattern=split_7.cull_branches)  # -> simplify(List); disabled
cull_25 = CullPattern(List=floor_distrib_anchor_2, CullPattern=split_6.cull_branches)  # -> simplify(List); disabled
cull_26 = CullPattern(List=floor_tile_matrix_7, CullPattern=split_6.cull_branches)  # -> simplify(List); disabled
graft_matrix_tree_2 = GhPythonScript(tileMatrix=cull_18)  # -> out, simplify(a); inputs tileMatrix: tree; disabled; same code as graft_matrix_tree
graft_matrix_tree_3 = GhPythonScript(tileMatrix=cull_19)  # -> out, simplify(a); inputs tileMatrix: tree; disabled; same code as graft_matrix_tree
cull_27 = CullPattern(List=floor_distrib_anchor_3, CullPattern=split_7.cull_branches)  # -> simplify(List); disabled
cull_28 = CullPattern(List=floor_distrib_anchor_3, CullPattern=split_8.cull_branches)  # -> simplify(List); disabled
graft_matrix_tree_4 = GhPythonScript(tileMatrix=cull_20)  # -> out, simplify(a); inputs tileMatrix: tree; disabled; same code as graft_matrix_tree
cull_29 = CullPattern(List=floor_tile_matrix_8, CullPattern=split_8.cull_branches)  # -> simplify(List); disabled
graft_matrix_tree_5 = GhPythonScript(tileMatrix=cull_21)  # -> out, simplify(a); inputs tileMatrix: tree; disabled; same code as graft_matrix_tree
graft_matrix_tree_6 = GhPythonScript(tileMatrix=cull_22)  # -> out, simplify(a); inputs tileMatrix: tree; disabled; same code as graft_matrix_tree
clean_8 = CleanTree(RemoveNulls=False, RemoveInvalid=False, RemoveEmpty=True, Tree=cull_23)  # disabled
clean_9 = CleanTree(RemoveNulls=False, RemoveInvalid=False, RemoveEmpty=True, Tree=cull_25)  # disabled
graft_matrix_tree_7 = GhPythonScript(tileMatrix=cull_24)  # -> out, simplify(a); inputs tileMatrix: tree; disabled; same code as graft_matrix_tree
graft_matrix_tree_8 = GhPythonScript(tileMatrix=cull_26)  # -> out, simplify(a); inputs tileMatrix: tree; disabled; same code as graft_matrix_tree
clean_10 = CleanTree(RemoveNulls=False, RemoveInvalid=False, RemoveEmpty=True, Tree=cull_28)  # disabled
clean_11 = CleanTree(RemoveNulls=False, RemoveInvalid=False, RemoveEmpty=True, Tree=cull_27)  # disabled
graft_matrix_tree_9 = GhPythonScript(tileMatrix=cull_29)  # -> out, simplify(a); inputs tileMatrix: tree; disabled; same code as graft_matrix_tree
clean_12 = CleanTree(RemoveNulls=False, RemoveInvalid=False, RemoveEmpty=True, Tree=graft_matrix_tree_2.a)  # disabled
clean_13 = CleanTree(RemoveNulls=False, RemoveInvalid=False, RemoveEmpty=True, Tree=graft_matrix_tree_3.a)  # disabled
clean_14 = CleanTree(RemoveNulls=False, RemoveInvalid=False, RemoveEmpty=True, Tree=graft_matrix_tree_4.a)  # disabled
clean_15 = CleanTree(RemoveNulls=False, RemoveInvalid=False, RemoveEmpty=True, Tree=cull_18)  # disabled
clean_16 = CleanTree(RemoveNulls=False, RemoveInvalid=False, RemoveEmpty=True, Tree=graft_matrix_tree_5.a)  # disabled
anchor = Data(clean_8)  # disabled
clean_17 = CleanTree(RemoveNulls=False, RemoveInvalid=False, RemoveEmpty=True, Tree=graft_matrix_tree_6.a)  # disabled
anchor_2 = Data(clean_9)  # disabled
clean_18 = CleanTree(RemoveNulls=False, RemoveInvalid=False, RemoveEmpty=True, Tree=cull_20)  # disabled
viewer_3 = ParamViewer(clean_12)  # disabled
anchor_3 = Data(clean_11)  # disabled
clean_19 = CleanTree(RemoveNulls=False, RemoveInvalid=False, RemoveEmpty=True, Tree=graft_matrix_tree_7.a)  # disabled
clean_20 = CleanTree(RemoveNulls=False, RemoveInvalid=False, RemoveEmpty=True, Tree=cull_22)  # disabled
anchor_4 = Data(clean_10)  # disabled
clean_21 = CleanTree(RemoveNulls=False, RemoveInvalid=False, RemoveEmpty=True, Tree=graft_matrix_tree_8.a)  # disabled
viewer_4 = ParamViewer(clean_13)  # disabled
clean_22 = CleanTree(RemoveNulls=False, RemoveInvalid=False, RemoveEmpty=True, Tree=cull_26)  # disabled
viewer_5 = ParamViewer(clean_14)  # disabled
viewer_6 = ParamViewer(clean_16)  # disabled
clean_23 = CleanTree(RemoveNulls=False, RemoveInvalid=False, RemoveEmpty=True, Tree=cull_24)  # disabled
clean_24 = CleanTree(RemoveNulls=False, RemoveInvalid=False, RemoveEmpty=True, Tree=graft_matrix_tree_9.a)  # disabled
viewer_7 = ParamViewer(clean_17)  # disabled
clean_25 = CleanTree(RemoveNulls=False, RemoveInvalid=False, RemoveEmpty=True, Tree=cull_29)  # disabled
data_8 = Data(clean_15)  # disabled
data_9 = Data(clean_18)  # disabled
viewer_8 = ParamViewer(clean_21)  # disabled
lng_7 = ListLength(List=viewer_4)  # disabled
viewer_9 = ParamViewer(clean_19)  # disabled
lng_8 = ListLength(List=viewer_6)  # disabled
data_10 = Data(clean_20)  # disabled
viewer_10 = ParamViewer(clean_24)  # disabled
data_11 = Data(clean_22)  # disabled
data_12 = Data(clean_23)  # disabled
lng_9 = ListLength(List=viewer_8)  # disabled
data_13 = Data(clean_25)  # disabled
lng_10 = ListLength(List=viewer_10)  # disabled
lng_11 = ListLength(List=viewer_3)  # disabled
lng_12 = ListLength(List=viewer_5)  # disabled
python_43 = GhPythonScript(tile_matrix_max=data_8, max_length=lng_11, min_length=lng_7, attributes_read=ghpython_script_7.join_str)  # -> out, simplify(flatten(length_range_tiles)), attributes_generated; disabled
# ---------- python_43: Python ----------
# -*- coding: utf-8 -*-
"""
@author: prslvtsv
"""
import scriptcontext as sc
import gblock.gh_context.gh_context as context
reload(context)

###############################################################################
# CONTEXT CREATOR BELOW | ADDS DEV METODS TO COMPONENT 
# SEE GH_CONTEXT\CONTEXT_GENERAL.TXT FOR DETAILS
###############################################################################
exec(compile(''.join(context.init()), 'init', 'exec'), locals())
###############################################################################
import copy

range_tiles = []
attrs = []

def replace_attr(attr_list, key, val):
    for i,at in enumerate(attr_list):
        if key in at:
            attr_list[i] = "{}:{}".format(key,val)
    return copy.copy(attr_list)

class TileMatrix:
    pass

lt = range(min_length, max_length)
lt.reverse()
#length_range_tiles.append(copy.copy(tile_matrix_max))

working = copy.copy(tile_matrix_max)
range_tiles.append(working)
att = copy.copy(attributes_read.splitlines())

attrs.append(replace_attr(att, 'length', len(working.data)))

for size in lt:
    if size % 2 == 0:
        w = TileMatrix()
        w.data = working.data[:-1]
        working = w
        range_tiles.append(w)
        attrs.append(replace_attr(att, 'length', len(w.data)))
        print len(w.data)
        
    else:
        w = TileMatrix()
        w.data = working.data[1:]
        working = w
        range_tiles.append(w)
        attrs.append(replace_attr(att, 'length', len(w.data)))
        print len(w.data)
       
attributes_generated =  attrs
length_range_tiles = range_tiles
# ---------- end python_43 ----------
lng_13 = ListLength(List=viewer_7)  # disabled
python_44 = GhPythonScript(tile_matrix_max=data_9, max_length=lng_12, min_length=lng_8, attributes_read=ghpython_script_8.join_str)  # -> out, simplify(flatten(length_range_tiles)), attributes_generated; disabled; same code as python_43
panel_60 = Panel(lng_11)  # disabled
panel_61 = Panel(lng_7)  # disabled
lng_14 = ListLength(List=viewer_9)  # disabled
python_45 = GhPythonScript(
    tile_matrix_max=data_10,
    tile_matrix_min=data_11,
    anchor_max_idx=anchor,
    anchor_min_idx=anchor_2,
    attributes_read=ghpython_script_9.join_str)  # -> out, simplify(flatten(length_range_tiles)), attributes_generated; disabled
# ---------- python_45: Python ----------
# -*- coding: utf-8 -*-
"""
@author: prslvtsv
"""
import scriptcontext as sc
import gblock.gh_context.gh_context as context
reload(context)

###############################################################################
# CONTEXT CREATOR BELOW | ADDS DEV METODS TO COMPONENT 
# SEE GH_CONTEXT\CONTEXT_GENERAL.TXT FOR DETAILS
###############################################################################
exec(compile(''.join(context.init()), 'init', 'exec'), locals())
###############################################################################
import copy

range_tiles = []
attrs = []

def replace_attr(attr_list, key, val):
    for i,at in enumerate(attr_list):
        if key in at:
            attr_list[i] = "{}:{}".format(key,val)
    return copy.copy(attr_list)

class TileMatrix:
    pass

len_max = len(tile_matrix_max.data)
len_max_left = anchor_max_idx - 1
len_max_right = len_max - (anchor_max_idx + 1)
print len_max_left, ' ', len_max_right

len_min = len(tile_matrix_min.data)
len_min_left = anchor_min_idx - 1
len_min_right = len_min - (anchor_min_idx + 1)
print len_min_left, ' ', len_min_right

if len_max_left-len_min_left > 0 and len_max_right-len_min_right == 0:
    reduction_steps = range(len_max_left-len_min_left+1)
elif len_max_left-len_min_left > 0 and len_max_right-len_min_right > 0:
    reduction_steps = [range(len_max_left-len_min_left+1), range(-(len_max_right-len_min_right), 0)]
    
print reduction_steps
att = copy.copy(attributes_read.splitlines())

for step in reduction_steps:
    st = tile_matrix_max.data[step:]
    w = TileMatrix()
    w.data = st
    range_tiles.append(w)
    attrs.append(replace_attr(att, 'length', len(w.data)))
    print step
    print st
    print attrs[-1]
     
attributes_generated =  attrs
length_range_tiles = range_tiles
# ---------- end python_45 ----------
panel_62 = Panel(lng_12)  # disabled
panel_63 = Panel(lng_8)  # disabled
python_46 = GhPythonScript(
    tile_matrix_max=data_12,
    tile_matrix_min=data_13,
    anchor_max_idx=anchor_3,
    anchor_min_idx=anchor_4,
    attributes_read=ghpython_script_10.join_str)  # -> out, simplify(flatten(length_range_tiles)), attributes_generated; disabled
# ---------- python_46: Python ----------
# -*- coding: utf-8 -*-
"""
@author: prslvtsv
"""
import scriptcontext as sc
import gblock.gh_context.gh_context as context
reload(context)

###############################################################################
# CONTEXT CREATOR BELOW | ADDS DEV METODS TO COMPONENT 
# SEE GH_CONTEXT\CONTEXT_GENERAL.TXT FOR DETAILS
###############################################################################
exec(compile(''.join(context.init()), 'init', 'exec'), locals())
###############################################################################
import copy

range_tiles = []
attrs = []

def replace_attr(attr_list, key, val):
    for i,at in enumerate(attr_list):
        if key in at:
            attr_list[i] = "{}:{}".format(key,val)
    return copy.copy(attr_list)

class TileMatrix:
    pass

len_max = len(tile_matrix_max.data)
len_max_left = anchor_max_idx - 1
len_max_right = len_max - (anchor_max_idx + 1)
print len_max_left, ' ', len_max_right

len_min = len(tile_matrix_min.data)
len_min_left = anchor_min_idx - 1
len_min_right = len_min - (anchor_min_idx + 1)
print len_min_left, ' ', len_min_right

if len_max_left-len_min_left > 0 and len_max_right-len_min_right == 0:
    reduction_steps = range(len_max_left-len_min_left+1)
elif len_max_left-len_min_left > 0 and len_max_right-len_min_right > 0:
    reduction_steps = [range(len_max_left-len_min_left), range(-(len_max_right-len_min_right), 1)]
elif len_max_left-len_min_left == 0 and len_max_right-len_min_right > 0:
    reduction_steps = [a for a in range(-(len_max_right-len_min_right), 1)]
    reduction_steps.reverse()

print reduction_steps
att = copy.copy(attributes_read.splitlines())

for i, step in enumerate(reduction_steps):
    print i , step
    if step == 0:
        st = tile_matrix_max.data[:]
    else:
        st = tile_matrix_max.data[:step]
    w = TileMatrix()
    w.data = st
    range_tiles.append(w)
    attrs.append(replace_attr(att, 'length', len(w.data)))
    print step
    print st
    print attrs[-1]
     
attributes_generated =  attrs
length_range_tiles = range_tiles
# ---------- end python_46 ----------
panel_64 = Panel(lng_13)  # disabled
panel_65 = Panel(lng_9)  # disabled
panel_66 = Panel(lng_14)  # disabled
panel_67 = Panel(lng_10)  # disabled
item_7 = ListItem(List=viewer_3, Index=0, Wrap=True)  # disabled
dpath = DeconstructPath(Branch=item_7)  # disabled
item_8 = ListItem(List=dpath, Index=0, Wrap=True)  # disabled
panel_68 = Panel(python_43.length_range_tiles)  # disabled
item_9 = ListItem(List=viewer_5, Index=0, Wrap=True)  # disabled
dpath_2 = DeconstructPath(Branch=item_9)  # disabled
item_10 = ListItem(List=dpath_2, Index=0, Wrap=True)  # disabled
panel_69 = Panel(python_44.length_range_tiles)  # disabled
item_11 = ListItem(List=viewer_7, Index=0, Wrap=True)  # disabled
dpath_3 = DeconstructPath(Branch=item_11)  # disabled
panel_70 = Panel(python_45.length_range_tiles)  # disabled
item_12 = ListItem(List=viewer_9, Index=0, Wrap=True)  # disabled
dpath_4 = DeconstructPath(Branch=item_12)  # disabled
item_13 = ListItem(List=dpath_4, Index=0, Wrap=True)  # disabled
panel_71 = Panel(python_46.length_range_tiles)  # disabled
item_14 = ListItem(List=dpath_3, Index=0, Wrap=True)  # disabled
graft_matrix_tree_10 = GhPythonScript(tileMatrix=python_43.length_range_tiles, branch_indx=item_8, attributes_read=python_43.attributes_generated)  # -> out, tiles_out, matrix_out, attrib_out; inputs tileMatrix: tree, attributes_read: list; disabled
# ---------- graft_matrix_tree_10: Python ----------
# -*- coding: utf-8 -*-
"""
@author: prslvtsv
"""
import scriptcontext as sc
import gblock.gh_context.gh_context as context
reload(context)

###############################################################################
# CONTEXT CREATOR BELOW | ADDS DEV METODS TO COMPONENT 
# SEE GH_CONTEXT\CONTEXT_GENERAL.TXT FOR DETAILS
###############################################################################
exec(compile(''.join(context.init()), 'init', 'exec'), locals())
###############################################################################

import ghpythonlib.treehelpers as th
import Rhino

class TileSlot:
    def add(self, data):
        self.data = data
        return self


print [p.Indices for p in ghenv.Component.Params.Input[1].VolatileData.Paths]

tiles_out = []
bb = [] 
lst = th.tree_to_list(tileMatrix, None)
print lst
for j, p in enumerate(ghenv.Component.Params.Input[1].VolatileData.Paths):
    nested = []
    for i,v in enumerate(lst[j]):
        column = []
        for tileSlot in v.data:
            column.append([TileSlot().add(tt) for tt in tileSlot])
        nested.append(column)
    bb.append(nested)
    
tiles_out = th.list_to_tree(bb, True, [branch_indx])


 
attrib_out = th.list_to_tree([[a for a in at] for at in attributes_read], True, [branch_indx, 0])
matrix_out = th.list_to_tree([[ls]for ls in lst[0]], True, [branch_indx, 0])
# ---------- end graft_matrix_tree_10 ----------
graft_matrix_tree_11 = GhPythonScript(tileMatrix=python_44.length_range_tiles, branch_indx=item_10, attributes_read=python_44.attributes_generated)  # -> out, tiles_out, matrix_out, attrib_out; inputs tileMatrix: tree, attributes_read: list; disabled; same code as graft_matrix_tree_10
lng_15 = ListLength(List=python_43.length_range_tiles)  # disabled
lng_16 = ListLength(List=python_44.length_range_tiles)  # disabled
graft_matrix_tree_12 = GhPythonScript(tileMatrix=python_45.length_range_tiles, branch_indx=item_14, attributes_read=python_45.attributes_generated)  # -> out, tiles_out, attrib_out; inputs tileMatrix: tree, attributes_read: list; disabled
# ---------- graft_matrix_tree_12: Python ----------
# -*- coding: utf-8 -*-
"""
@author: prslvtsv
"""
import scriptcontext as sc
import gblock.gh_context.gh_context as context
reload(context)

###############################################################################
# CONTEXT CREATOR BELOW | ADDS DEV METODS TO COMPONENT 
# SEE GH_CONTEXT\CONTEXT_GENERAL.TXT FOR DETAILS
###############################################################################
exec(compile(''.join(context.init()), 'init', 'exec'), locals())
###############################################################################

import ghpythonlib.treehelpers as th
import Rhino

class TileSlot:
    def add(self, data):
        self.data = data
        return self


print [p.Indices for p in ghenv.Component.Params.Input[1].VolatileData.Paths]

tiles_out = []
bb = [] 
lst = th.tree_to_list(tileMatrix, None)
print lst
for j, p in enumerate(ghenv.Component.Params.Input[1].VolatileData.Paths):
    nested = []
    for i,v in enumerate(lst[j]):
        column = []
        for tileSlot in v.data:
            column.append([TileSlot().add(tt) for tt in tileSlot])
        nested.append(column)
    bb.append(nested)
    
tiles_out = th.list_to_tree(bb, True, [branch_indx])


 
attrib_out = th.list_to_tree([[a for a in at] for at in attributes_read], True, [branch_indx, 0])
# ---------- end graft_matrix_tree_12 ----------
lng_17 = ListLength(List=python_45.length_range_tiles)  # disabled
graft_matrix_tree_13 = GhPythonScript(tileMatrix=python_46.length_range_tiles, branch_indx=item_13, attributes_read=python_46.attributes_generated)  # -> out, tiles_out, attrib_out; inputs tileMatrix: tree, attributes_read: list; disabled; same code as graft_matrix_tree_12
dup_6 = DuplicateData(Data=data_4, Number=lng_15, Order=True)  # disabled
lng_18 = ListLength(List=python_46.length_range_tiles)  # disabled
dup_7 = DuplicateData(Data=data_5, Number=lng_16, Order=True)  # disabled
dup_8 = DuplicateData(Data=data_6, Number=lng_17, Order=True)  # disabled
item_15 = ListItem(List=python_45.length_range_tiles, Index=number_slider_13, Wrap=True)  # disabled
clean_26 = CleanTree(RemoveNulls=False, RemoveInvalid=False, RemoveEmpty=True, Tree=graft(dup_6))  # disabled
dup_9 = DuplicateData(Data=data_7, Number=lng_18, Order=True)  # disabled
clean_27 = CleanTree(RemoveNulls=False, RemoveInvalid=False, RemoveEmpty=True, Tree=graft(dup_7))  # disabled
item_16 = ListItem(List=python_46.length_range_tiles, Index=number_slider_14, Wrap=True)  # disabled
clean_28 = CleanTree(RemoveNulls=False, RemoveInvalid=False, RemoveEmpty=True, Tree=graft(dup_8))  # disabled
clean_29 = CleanTree(RemoveNulls=False, RemoveInvalid=False, RemoveEmpty=True, Tree=graft(dup_9))  # disabled
floor_origin_pt = Data(clean_26)  # disabled
floor_attributes = Data(graft_matrix_tree_10.attrib_out)  # disabled
tiles_matrix = Data(graft_matrix_tree_10.matrix_out)  # disabled
floor_origin_pt_2 = Data(clean_27)  # disabled
floor_attributes_2 = Data(graft_matrix_tree_11.attrib_out)  # disabled
tiles_matrix_2 = Data(graft_matrix_tree_11.matrix_out)  # disabled
floor_origin_pt_3 = Data(clean_28)  # disabled
floor_attributes_3 = Data(graft_matrix_tree_12.attrib_out)  # disabled
floor_origin_pt_4 = Data(clean_29)  # disabled
tstat = TreeStatistics(Tree=floor_attributes)  # -> Paths, Length, Count; disabled
dup_10 = DuplicateData(Data=pcwraplist, Number=tstat.Count, Order=True)  # disabled
pcunwraplist = UnwrapList(AtomList=dup_10, LastSaveLocalization="neutral,N")  # disabled
floor_attributes_4 = Data(graft_matrix_tree_13.attrib_out)  # disabled
tstat_2 = TreeStatistics(Tree=floor_attributes_2)  # -> Paths, Length, Count; disabled
dup_11 = DuplicateData(Data=pcwraplist_2, Number=tstat_2.Count, Order=True)  # disabled
pcunwraplist_2 = UnwrapList(AtomList=dup_11, LastSaveLocalization="neutral,N")  # disabled
path_mapper = PathMapper(pcunwraplist_2, source="{A;B;C;D;E}", target="{A;B;E}")  # disabled
floor_origin_pt_5 = Data(floor_origin_pt_3)  # disabled
ghpython_script_12 = GhPythonScript(x=floor_origin_pt_3)  # -> flatten(a); disabled
# ---------- ghpython_script_12: Python ----------
a = x.Geometry
# ---------- end ghpython_script_12 ----------
path_mapper_2 = PathMapper(pcunwraplist, source="{A;B;C;D;E}", target="{A;B;E}")  # disabled
item_17 = ListItem(List=ghpython_script_12, Index=0, Wrap=True)  # disabled
ghpython_script_13 = GhPythonScript(x=floor_origin_pt_4)  # -> flatten(a); disabled; same code as ghpython_script_12
item_18 = ListItem(List=ghpython_script_13, Index=0, Wrap=True)  # disabled
vec2pt_2 = Vector2Pt(PointA=item_18, PointB=item_17, Unitize=False)  # -> Vector, Length; disabled
python_47 = GhPythonScript(
    left_length_tiles=python_45.length_range_tiles,
    right_length_tiles=python_46.length_range_tiles,
    max_length=lng_13,
    move_v=vec2pt_2.Vector,
    attributes=ghpython_script_9.join_str)  # -> out, flatten(distribution_range), attributes_generated; inputs left_length_tiles: list, right_length_tiles: list, move_v: Vector3d; disabled
# ---------- python_47: Python ----------
# -*- coding: utf-8 -*-
"""
@author: prslvtsv
"""
import scriptcontext as sc
import rhinoscriptsyntax as rs
import Rhino.Geometry as rg
import gblock.gh_context.gh_context as context
import copy

reload(context)

###############################################################################
# CONTEXT CREATOR BELOW | ADDS DEV METODS TO COMPONENT 
# SEE GH_CONTEXT\CONTEXT_GENERAL.TXT FOR DETAILS
###############################################################################
exec(compile(''.join(context.init()), 'init', 'exec'), locals())
###############################################################################
def replace_attr(attr_list, key, val):
    for i,at in enumerate(attr_list):
        if key in at:
            attr_list[i] = "{}:{}".format(key,val)
    return copy.copy(attr_list)

class TileMatrix:
    pass


master_distr = TileMatrix()
master_distr.data = copy.copy(left_length_tiles[0].data)
right_section = right_length_tiles[0].data[-(len(right_length_tiles)):]
right_s = copy.copy(right_length_tiles[0].data[-(len(right_length_tiles)):])
a = []

for i, rt in enumerate(right_section):
    for j,crv in enumerate(right_section[i]):

        newpl = []
        for inx, pt in enumerate(right_section[i][j][0].ghGeo.ToPolyline()):
            newpl.append(rg.Point3d( pt.X + move_v.X, pt.Y + move_v.Y,0))
            
        t = core.Tile(
            ghGeo=rg.PolylineCurve(newpl), 
            state=copy.copy(right_section[i][j][0].state),
            app=right_section[i][j][0].appNumber
            )
        right_s[i][j][0] = t
        a.append(right_s[i][j][0].ghGeo)
#    print rt[0][0].ghGeo.Translate(rg.Vector3d(0,0,0))
    master_distr.data.append(right_s[i])

#print master_distr.data

step_range = [range(len(left_length_tiles)), range(len(right_length_tiles)+1)]
#print step_range 

attrs = []
dr = []
att = copy.copy(attributes.splitlines())

for i in step_range[0]:
    for j in step_range[1]:
        if j == 0:
            st = master_distr.data[i:]
        else:
            st = master_distr.data[i:-j]
        if len(st) > max_length:
            continue
            
        w = TileMatrix()
        w.data = st
        dr.append(w)
        at = replace_attr(att, 'length', len(w.data))
        attrs.append(replace_attr(at, 'distribution', "{}/{}".format(i, j)))
        
        
distribution_range = dr
attributes_generated =  attrs
# ---------- end python_47 ----------
lng_19 = ListLength(List=python_47.distribution_range)  # disabled
dup_12 = DuplicateData(Data=data_6, Number=lng_19, Order=True)  # disabled
graft_matrix_tree_14 = GhPythonScript(tileMatrix=python_47.distribution_range, branch_indx=item_14, attributes_read=python_47.attributes_generated)  # -> out, tiles_out, matrix_out, attrib_out; inputs tileMatrix: tree, attributes_read: list; disabled
# ---------- graft_matrix_tree_14: Python ----------
# -*- coding: utf-8 -*-
"""
@author: prslvtsv
"""
import scriptcontext as sc
import gblock.gh_context.gh_context as context
reload(context)

###############################################################################
# CONTEXT CREATOR BELOW | ADDS DEV METODS TO COMPONENT 
# SEE GH_CONTEXT\CONTEXT_GENERAL.TXT FOR DETAILS
###############################################################################
exec(compile(''.join(context.init()), 'init', 'exec'), locals())
###############################################################################

import ghpythonlib.treehelpers as th
import Rhino

class TileSlot:
    def add(self, data):
        self.data = data
        return self


print [p.Indices for p in ghenv.Component.Params.Input[1].VolatileData.Paths]

tiles_out = []
bb = [] 
lst = th.tree_to_list(tileMatrix, None)
print lst
for j, p in enumerate(ghenv.Component.Params.Input[1].VolatileData.Paths):
    nested = []
    for i,v in enumerate(lst[j]):
        column = []
        
        for tileSlot in v.data:
            column.append([TileSlot().add(tt) for tt in tileSlot])
        nested.append(column)
    bb.append(nested)
    
tiles_out = th.list_to_tree(bb, True, [branch_indx])

 
attrib_out = th.list_to_tree([[a for a in at] for at in attributes_read], True, [branch_indx, 0])
matrix_out = th.list_to_tree([[ls]for ls in lst[0]], True, [branch_indx, 0])
# ---------- end graft_matrix_tree_14 ----------
clean_30 = CleanTree(RemoveNulls=False, RemoveInvalid=False, RemoveEmpty=True, Tree=graft(dup_12))  # disabled
python_48 = GhPythonScript(autoUpdate=toggle_11, tile_instance=graft_matrix_tree_14.tiles_out)  # -> out, ghGeo, state, appt; disabled
# ---------- python_48: Python ----------
# -*- coding: utf-8 -*-
"""
@author: prslvtsv
"""
import scriptcontext as sc
import gblock.gh_context.gh_context as context
reload(context)

###############################################################################
# CONTEXT CREATOR BELOW | ADDS DEV METODS TO COMPONENT 
# SEE GH_CONTEXT\CONTEXT_GENERAL.TXT FOR DETAILS
###############################################################################
exec(compile(''.join(context.init()), 'init', 'exec'), locals())
###############################################################################

print type(tile_instance)

tile_data = tile_instance.data

if tile_data != None and not isinstance(tile_data, list):
    ghGeo = tile_data.ghGeo
    state = tile_data.state
    appt = tile_data.appNumber
     
elif isinstance(tile_data, list):
    if tile_data[0] != None:
        ghGeo = [a.ghGeo for a in tile_data]
        state = [a.state for a in tile_data]
        appt = [a.appNumber for a in tile_data]
    else:
        ghGeo = [None for a in tile_data]
        state = [None for a in tile_data]
        appt = [None for a in tile_data]
else:
    ghGeo = None
    state = None
    appt = None

#print tile_instance.ghGeo
#print tile_instance.state
#print tile_instance.appNumber
# ---------- end python_48 ----------
tiles_ghgeo = Data(python_48.ghGeo)  # disabled
tiles_state = Data(python_48.state)  # disabled
tiles_apptnumb = Data(python_48.appt)  # disabled
floor_attributes_5 = Data(graft_matrix_tree_14.attrib_out)  # disabled
tile_matrix = Data(graft_matrix_tree_14.matrix_out)  # disabled
floor_origin_pt_6 = Data(clean_30)  # disabled
tstat_3 = TreeStatistics(Tree=floor_attributes_5)  # -> Paths, Length, Count; disabled
dup_13 = DuplicateData(Data=pcwraplist_3, Number=tstat_3.Count, Order=True)  # disabled
pcunwraplist_3 = UnwrapList(AtomList=dup_13, LastSaveLocalization="neutral,N")  # disabled
path_mapper_3 = PathMapper(pcunwraplist_3, source="{A;B;C;D;E}", target="{A;B;E}")  # disabled

# ---- group: length + distribution generator / unpack tile instance
python_49 = GhPythonScript(autoUpdate=toggle_7, tile_instance=graft_matrix_tree_10.tiles_out)  # -> out, ghGeo, state, appt; disabled
# ---------- python_49: Python ----------
# -*- coding: utf-8 -*-
"""
@author: prslvtsv
"""
import scriptcontext as sc
import gblock.gh_context.gh_context as context
reload(context)

###############################################################################
# CONTEXT CREATOR BELOW | ADDS DEV METODS TO COMPONENT 
# SEE GH_CONTEXT\CONTEXT_GENERAL.TXT FOR DETAILS
###############################################################################
exec(compile(''.join(context.init()), 'init', 'exec'), locals())
###############################################################################

print type(tile_instance)

tile_data = tile_instance.data

if tile_data != None and not isinstance(tile_data, list):
    ghGeo = tile_data.ghGeo
    state = tile_data.state
    appt = tile_data.appNumber
elif isinstance(tile_data, list):
    ghGeo = [a.ghGeo for a in tile_data]
    state = [a.state for a in tile_data]
    appt = [a.appNumber for a in tile_data]
else:
    ghGeo = None
    state = None
    appt = None

#print tile_instance.ghGeo
#print tile_instance.state
#print tile_instance.appNumber
# ---------- end python_49 ----------

python_50 = GhPythonScript(autoUpdate=toggle_8, tile_instance=graft_matrix_tree_11.tiles_out)  # -> out, ghGeo, state, appt; disabled; same code as python_49

python_51 = GhPythonScript(autoUpdate=toggle_9, tile_instance=graft_matrix_tree_12.tiles_out)  # -> out, ghGeo, state, appt; disabled; same code as python_48

python_52 = GhPythonScript(autoUpdate=toggle_10, tile_instance=graft_matrix_tree_13.tiles_out)  # -> out, ghGeo, state, appt; disabled; same code as python_48

# ---- group: length + distribution generator / Origin_pt
merge_2 = Merge(Data1=floor_origin_pt, Data2=floor_origin_pt_2, Data3=floor_origin_pt_6)  # disabled

# ---- group: length + distribution generator / tiles_matrix
merge_3 = Merge(Data1=tiles_matrix, Data2=tiles_matrix_2, Data3=tile_matrix)  # disabled

# ---- group: length + distribution generator (continued)
tiles_ghgeo_2 = Data(python_49.ghGeo)  # disabled
tiles_state_2 = Data(python_49.state)  # disabled
tiles_apptnumb_2 = Data(python_49.appt)  # disabled
tiles_ghgeo_3 = Data(python_50.ghGeo)  # disabled
tiles_state_3 = Data(python_50.state)  # disabled
tiles_apptnumb_3 = Data(python_50.appt)  # disabled
tiles_ghgeo_4 = Data(python_51.ghGeo)  # disabled
tiles_state_4 = Data(python_51.state)  # disabled
tiles_apptnumb_4 = Data(python_51.appt)  # disabled
tiles_ghgeo_5 = Data(python_52.ghGeo)  # disabled
tiles_state_5 = Data(python_52.state)  # disabled
tiles_apptnumb_5 = Data(python_52.appt)  # disabled
floor_len_distr_tile_mtrx = RemoteSender(merge_3)  # disabled
floor_len_distr_orign = RemoteSender(merge_2)  # disabled

# ---- group: length + distribution generator / force key replacement for read data
group_update_reg_15 = RemoteReceiver(group_update_reg_2)  # disabled

# ---- group: length + distribution generator / force key replacement for read data / replace with copy pf attr
replace_val_4 = GhPythonScript(autoUpdate=group_update_reg_15, attr_loc_in=path_mapper_2, pairs_to_replace=floor_attributes)  # -> out, attr_loc_out; inputs attr_loc_in: list, pairs_to_replace: list; disabled; same code as replace_val_2

# ---- group: length + distribution generator / force key replacement for read data (continued)
ghpython_script_14 = GhPythonScript(attr_loc=simplify(replace_val_4.attr_loc_out))  # -> out, simplify(name_val); inputs attr_loc: list; disabled; same code as ghpython_script_5
panel_72 = Panel(ghpython_script_14.name_val)  # disabled

group_update_reg_16 = RemoteReceiver(group_update_reg_2)  # disabled

# ---- group: length + distribution generator / force key replacement for read data / replace with copy pf attr
replace_val_5 = GhPythonScript(autoUpdate=group_update_reg_16, attr_loc_in=path_mapper, pairs_to_replace=floor_attributes_2)  # -> out, attr_loc_out; inputs attr_loc_in: list, pairs_to_replace: list; disabled; same code as replace_val_2

# ---- group: length + distribution generator / force key replacement for read data (continued)
ghpython_script_15 = GhPythonScript(attr_loc=simplify(replace_val_5.attr_loc_out))  # -> out, simplify(name_val); inputs attr_loc: list; disabled; same code as ghpython_script_5
panel_73 = Panel(ghpython_script_15.name_val)  # disabled

group_update_reg_17 = RemoteReceiver(group_update_reg_2)  # disabled
default_keys_3 = Panel("""heightLimit:28
corridorWidth:1700
distribution:0/0""")  # disabled

# ---- group: length + distribution generator / force key replacement for read data / replace with copy pf attr
replace_val_6 = GhPythonScript(autoUpdate=group_update_reg_17, attr_loc_in=replace_val_4.attr_loc_out, pairs_to_replace=default_keys_3)  # -> out, attr_loc_out; inputs attr_loc_in: list, pairs_to_replace: list; disabled; same code as replace_val_2

# ---- group: length + distribution generator / force key replacement for read data (continued)
ghpython_script_16 = GhPythonScript(attr_loc=simplify(replace_val_6.attr_loc_out))  # -> out, simplify(name_val); inputs attr_loc: list; disabled; same code as ghpython_script_5
panel_74 = Panel(ghpython_script_16.name_val)  # disabled

group_update_reg_18 = RemoteReceiver(group_update_reg_2)  # disabled
default_keys_4 = Panel("""heightLimit:28
corridorWidth:1700
distribution:0/0""")  # disabled

# ---- group: length + distribution generator / force key replacement for read data / replace with copy pf attr
replace_val_7 = GhPythonScript(autoUpdate=group_update_reg_18, attr_loc_in=replace_val_5.attr_loc_out, pairs_to_replace=default_keys_4)  # -> out, attr_loc_out; inputs attr_loc_in: list, pairs_to_replace: list; disabled; same code as replace_val_2

# ---- group: length + distribution generator / force key replacement for read data (continued)
ghpython_script_17 = GhPythonScript(attr_loc=simplify(replace_val_7.attr_loc_out))  # -> out, simplify(name_val); inputs attr_loc: list; disabled; same code as ghpython_script_5
panel_75 = Panel(ghpython_script_17.name_val)  # disabled

# ---- group: length + distribution generator (continued)
floor_attributes_6 = Data(replace_val_6.attr_loc_out)  # disabled
floor_attributes_7 = Data(replace_val_7.attr_loc_out)  # disabled

# ---- group: length + distribution generator / force key replacement for read data
group_update_reg_19 = RemoteReceiver(group_update_reg_2)  # disabled

# ---- group: length + distribution generator / force key replacement for read data / replace with copy pf attr
replace_val_8 = GhPythonScript(autoUpdate=group_update_reg_19, attr_loc_in=path_mapper_3, pairs_to_replace=floor_attributes_5)  # -> out, attr_loc_out; inputs attr_loc_in: list, pairs_to_replace: list; disabled; same code as replace_val_2

# ---- group: length + distribution generator / force key replacement for read data (continued)
ghpython_script_18 = GhPythonScript(attr_loc=simplify(replace_val_8.attr_loc_out))  # -> out, simplify(name_val); inputs attr_loc: list; disabled; same code as ghpython_script_5
panel_76 = Panel(ghpython_script_18.name_val)  # disabled

group_update_reg_20 = RemoteReceiver(group_update_reg_2)  # disabled
default_keys_5 = Panel("""heightLimit:28
corridorWidth:1700""")  # disabled

# ---- group: length + distribution generator / force key replacement for read data / replace with copy pf attr
replace_val_9 = GhPythonScript(autoUpdate=group_update_reg_20, attr_loc_in=replace_val_8.attr_loc_out, pairs_to_replace=default_keys_5)  # -> out, attr_loc_out; inputs attr_loc_in: list, pairs_to_replace: list; disabled; same code as replace_val_2

# ---- group: length + distribution generator / force key replacement for read data (continued)
ghpython_script_19 = GhPythonScript(attr_loc=simplify(replace_val_9.attr_loc_out))  # -> out, simplify(name_val); inputs attr_loc: list; disabled; same code as ghpython_script_5
panel_77 = Panel(ghpython_script_19.name_val)  # disabled

# ---- group: length + distribution generator (continued)
floor_attributes_8 = Data(replace_val_9.attr_loc_out)  # disabled

# ---- group: length + distribution generator / attributes_objects
merge_4 = Merge(Data1=floor_attributes_6, Data2=floor_attributes_7, Data3=floor_attributes_8)  # disabled

# ---- group: length + distribution generator (continued)
floor_len_distr_attrib_obj = RemoteSender(merge_4)  # disabled

# ---- group: some adjustments after generation
floor_len_distr_attrib_obj_2 = RemoteReceiver(floor_len_distr_attrib_obj)  # disabled
floor_len_distr_tile_mtrx_2 = RemoteReceiver(floor_len_distr_tile_mtrx)  # disabled
floor_len_distr_orign_2 = RemoteReceiver(floor_len_distr_orign)  # disabled

# ---- group: some adjustments after generation / update tiles index after generation
python_53 = GhPythonScript(tileMatrix_in=floor_len_distr_tile_mtrx_2)  # -> out, tileMatrix_out; disabled
# ---------- python_53: Python ----------
# -*- coding: utf-8 -*-
"""
@author: prslvtsv
"""
import scriptcontext as sc
import gblock.gh_context.gh_context as context
reload(context)

###############################################################################
# CONTEXT CREATOR BELOW | ADDS DEV METODS TO COMPONENT 
# SEE GH_CONTEXT\CONTEXT_GENERAL.TXT FOR DETAILS
###############################################################################
exec(compile(''.join(context.init()), 'init', 'exec'), locals())
###############################################################################

tileMatrix = tileMatrix_in

for ci, col in enumerate(tileMatrix.data):
#    print col
    for ri, row in enumerate(tileMatrix.data[ci]):
        for ti, tpos in enumerate(tileMatrix.data[ci][ri]):
            if tpos != None:
                tileMatrix.data[ci][ri][ti].matPos = [ri, ci]

for ci, col in enumerate(tileMatrix.data):
    print col


tileMatrix_out = tileMatrix
# ---------- end python_53 ----------

# ----
floor_len_distr_attrib_obj_3 = RemoteReceiver(floor_len_distr_attrib_obj)  # disabled
floor_len_distr_tile_mtrx_3 = RemoteReceiver(floor_len_distr_tile_mtrx)  # disabled
floor_len_distr_orign_3 = RemoteReceiver(floor_len_distr_orign)  # disabled

python_54 = GhPythonScript(tile_matrix=floor_len_distr_tile_mtrx_3)  # -> out, a; disabled
# ---------- python_54: Python ----------
# -*- coding: utf-8 -*-
"""
@author: prslvtsv
"""
import scriptcontext as sc
import gblock.gh_context.gh_context as context
reload(context)

matrix_data = tile_matrix.data
tile_data = []
for mat_column in matrix_data:
    for mat_row in mat_column:
        tile_data.append([m for m in mat_row])
        
a = tile_data
# ---------- end python_54 ----------
ghpython_script_20 = GhPythonScript(x=floor_len_distr_orign_3)  # -> a; disabled; same code as ghpython_script_12
python_55 = GhPythonScript(tiles=floor_len_distr_tile_mtrx_3, origin=floor_len_distr_orign_3)  # -> out, flatten(floor); inputs attributes: list; disabled
# ---------- python_55: Python ----------
# -*- coding: utf-8 -*-
"""
@author: prslvtsv
"""
import scriptcontext as sc
import gblock.gh_context.gh_context as context
reload(context)

###############################################################################
# CONTEXT CREATOR BELOW | ADDS DEV METODS TO COMPONENT 
# SEE GH_CONTEXT\CONTEXT_GENERAL.TXT FOR DETAILS
###############################################################################
exec(compile(''.join(context.init()), 'init', 'exec'), locals())
###############################################################################

fl = core.Floor()
fl.geo['tiles'] = tiles.data
fl.geo['origin'] = origin
fl.attribList = attributes
print fl
floor = fl
# ---------- end python_55 ----------

# ---- group: unpack_tile_matrix
python_56 = GhPythonScript(autoUpdate=toggle_6, tile_data=python_54.a)  # -> out, ghGeo, state, appt; disabled
# ---------- python_56: Python ----------
# -*- coding: utf-8 -*-
"""
@author: prslvtsv
"""
import scriptcontext as sc
import gblock.gh_context.gh_context as context
reload(context)

###############################################################################
# CONTEXT CREATOR BELOW | ADDS DEV METODS TO COMPONENT 
# SEE GH_CONTEXT\CONTEXT_GENERAL.TXT FOR DETAILS
###############################################################################
exec(compile(''.join(context.init()), 'init', 'exec'), locals())
###############################################################################
#
#print type(tile_matrix)



if tile_data != None and not isinstance(tile_data, list):
    ghGeo = tile_data.ghGeo
    state = tile_data.state
    appt = tile_data.appNumber
elif isinstance(tile_data, list):
    if tile_data[0] != None:
        ghGeo = [a.ghGeo for a in tile_data]
        state = [a.state for a in tile_data]
        appt = [a.appNumber for a in tile_data]
    else:
        ghGeo = [None for a in tile_data]
        state = [None for a in tile_data]
        appt = [None for a in tile_data]
else:
    ghGeo = None
    state = None
    appt = None

#print tile_instance.ghGeo
#print tile_instance.state
#print tile_instance.appNumber
# ---------- end python_56 ----------

# ----
tiles_ghgeo_6 = Data(python_56.ghGeo)  # disabled
tiles_state_6 = Data(python_56.state)  # disabled
tiles_apptnumb_6 = Data(python_56.appt)  # disabled
data_14 = Data(flatten(python_55.out))  # disabled
trim = TrimTree(Tree=tiles_ghgeo_6, Depth=1)  # disabled
trim_2 = TrimTree(Tree=tiles_state_6, Depth=1)  # disabled
trim_3 = TrimTree(Tree=trim, Depth=1)  # disabled
group = Group(Objects=trim)  # -> flatten(Group); disabled
group_2 = Group(Objects=trim_3)  # disabled
python_57 = GhPythonScript(address=python_33.address, data_to_place=data_14)  # -> out, base_out; inputs address: list, data_to_place: list; disabled
# ---------- python_57: Python ----------
# -*- coding: utf-8 -*-
"""
@author: prslvtsv
"""
import scriptcontext as sc
import gblock.gh_context.gh_context as context
reload(context)

###############################################################################
# CONTEXT CREATOR BELOW | ADDS DEV METODS TO COMPONENT 
# SEE GH_CONTEXT\CONTEXT_GENERAL.TXT FOR DETAILS
###############################################################################
exec(compile(''.join(context.init()), 'init', 'exec'), locals())
###############################################################################
working = database

for i, addr in enumerate(address):

    shape = [1 for a in range(len(addr.data.keys()))]
    sel = tuple([0 for a in range(len(addr.data.keys()))])
    dm = addr.data.keys()
    coord = addr.data
    print coord
    dt = np.ones(shape, dtype=np.object)
    dt[sel] = data_to_place[i]
    item = xr.DataArray(data=dt, dims=dm, coords=coord)    
    working = xr.combine_by_coords([working, item])

base_out = working
# ---------- end python_57 ----------
trim_4 = TrimTree(Tree=group_2, Depth=1)  # disabled
orient = Orient(Geometry=group, Source=ghpython_script_20, Target=xy)  # -> Geometry, Transform; disabled
lng_20 = ListLength(List=flatten(group))  # disabled
python_58 = GhPythonScript(y=python_57.base_out)  # -> out, a; disabled
# ---------- python_58: Python ----------
# -*- coding: utf-8 -*-
"""
@author: prslvtsv
"""
import scriptcontext as sc
import gblock.gh_context.gh_context as context
reload(context)

###############################################################################
# CONTEXT CREATOR BELOW | ADDS DEV METODS TO COMPONENT 
# SEE GH_CONTEXT\CONTEXT_GENERAL.TXT FOR DETAILS
###############################################################################
exec(compile(''.join(context.init()), 'init', 'exec'), locals())
###############################################################################

a = y[0, 0, 0, 0, 0, 0, 0, 0, :, 0, :, 0, 0]
# ---------- end python_58 ----------
division = Division(A=lng_20, B=panel_37)  # disabled
geo = Geometry(orient.Geometry)  # disabled
partition = PartitionList(List=group, Size=panel_37)  # -> simplify(Chunks); disabled
series_7 = Series(Start=0, Step=number_slider_7, Count=division)  # disabled
python_59 = GhPythonScript(y=python_57.base_out, x=python_33.address)  # -> out, a; disabled
# ---------- python_59: Python ----------
# -*- coding: utf-8 -*-
"""
@author: prslvtsv
"""
import scriptcontext as sc
import gblock.gh_context.gh_context as context
reload(context)

###############################################################################
# CONTEXT CREATOR BELOW | ADDS DEV METODS TO COMPONENT 
# SEE GH_CONTEXT\CONTEXT_GENERAL.TXT FOR DETAILS
###############################################################################
exec(compile(''.join(context.init()), 'init', 'exec'), locals())
###############################################################################
ard = [[k, v[0]] for k,v in x.data.items()]
#print ard
print y.loc[dict(ard)]
# ---------- end python_59 ----------
panel_78 = Panel(python_59.out)  # disabled
center = Center(Geometric=partition)  # -> simplify(Center), Dimension; disabled
pt_2 = ConstructPoint(XCoordinate=graft(series_7), YCoordinate=series, ZCoordinate=0)  # -> simplify(Point); disabled
orient_2 = Orient(Geometry=partition, Source=center.Center, Target=pt_2)  # -> Geometry, Transform; disabled

# ---- group: some adjustments after generation / force key replacement for read data
default_keys_6 = Panel("""residentialClass:base
region:moscow
buildingTech:monolyth
fireClass:c0""")  # disabled
group_update_reg_21 = RemoteReceiver(group_update_reg_2)  # disabled

# ---- group: some adjustments after generation / force key replacement for read data / replace with copy pf attr
replace_val_10 = GhPythonScript(
    autoUpdate=group_update_reg_21,
    attr_loc_in=simplify(floor_len_distr_attrib_obj_2),
    pairs_to_replace=simplify(default_keys_6))  # -> out, attr_loc_out; inputs attr_loc_in: list, pairs_to_replace: list; disabled; same code as replace_val_2

# ---- group: some adjustments after generation / force key replacement for read data (continued)
ghpython_script_21 = GhPythonScript(attr_loc=replace_val_10.attr_loc_out)  # -> out, name_val; inputs attr_loc: list; disabled; same code as ghpython_script_5
panel_79 = Panel(ghpython_script_21.name_val)  # disabled

# ---- group: some adjustments after generation
ghpython_script_22 = GhPythonScript(x=floor_len_distr_orign_2)  # -> a; disabled; same code as ghpython_script_12
path_mapper_4 = PathMapper(python_53.tileMatrix_out, source="{A;B;C}", target="{A;C}")  # disabled
join_str = GhPythonScript(x=panel_79)  # -> a; inputs x: list; disabled
# ---------- join_str: Python ----------
print type(x[0])
a = "\n".join(x)
# ---------- end join_str ----------
path_mapper_5 = PathMapper(ghpython_script_22, source="{A;B;C}", target="{A;C}")  # disabled
path_mapper_6 = PathMapper(join_str, source="{A;B;C;D}", target="{A;B}")  # disabled

# ---- group: some adjustments after generation / result - length + distr
floor_ld_origin_point3d = RemoteSender(path_mapper_5)  # disabled
floor_ld_tile_matrix = RemoteSender(path_mapper_4)  # disabled
floor_ld_attr_joined_str = RemoteSender(path_mapper_6)  # disabled

# ----
floor_ld_attr_obj = RemoteSender(replace_val_10.attr_loc_out)  # disabled

# ---- group: result - length + distr
floor_ld_origin_point3d_2 = RemoteReceiver(floor_ld_origin_point3d)  # disabled
floor_ld_attr_joined_str_2 = RemoteReceiver(floor_ld_attr_joined_str)  # disabled
floor_ld_tile_matrix_2 = RemoteReceiver(floor_ld_tile_matrix)  # disabled

# ----
floor_ld_attr_obj_2 = RemoteReceiver(floor_ld_attr_obj)  # disabled
floor_ld_tile_matrix_3 = RemoteReceiver(floor_ld_tile_matrix)  # disabled
floor_ld_attr_joined_str_3 = RemoteReceiver(floor_ld_attr_joined_str)  # disabled
floor_ld_origin_point3d_3 = RemoteReceiver(floor_ld_origin_point3d)  # disabled
data_15 = Data(floor_ld_tile_matrix_3)  # disabled
data_16 = Data(floor_ld_attr_joined_str_3)  # disabled
data_17 = Data(floor_ld_attr_obj_2)  # disabled
data_18 = Data(floor_ld_origin_point3d_3)  # disabled

# ---- group: general_group
O = GhPythonScript(x=data_17)  # -> out, a; inputs x: list; disabled
# ---------- O: Python ----------
a = [x]
# ---------- end O ----------

# ----
dup_14 = DuplicateData(Data=data_16, Number=number_slider, Order=True)  # disabled
dup_15 = DuplicateData(Data=O.a, Number=number_slider, Order=True)  # disabled
dup_16 = DuplicateData(Data=data_15, Number=number_slider, Order=True)  # disabled
dup_17 = DuplicateData(Data=data_18, Number=number_slider, Order=True)  # disabled
item_19 = ListItem(List=dup_16, Index=1, Wrap=True)  # -> simplify(Item); disabled
item_20 = ListItem(List=dup_17, Index=1, Wrap=True)  # -> simplify(Item); disabled
item_21 = ListItem(List=dup_15, Index=1, Wrap=True)  # disabled
item_22 = ListItem(List=dup_14, Index=1, Wrap=True)  # -> simplify(Item); disabled

# ---- group: general_ungroup
X_4 = GhPythonScript(x=item_21)  # -> out, simplify(a); disabled
# ---------- X_4: Python ----------
a = [i for i in x]
# ---------- end X_4 ----------

# ----
merge_5 = Merge(Data1=data_15, Data2=item_19)  # disabled
merge_6 = Merge(Data1=data_18, Data2=item_20)  # disabled

# ---- group: force key replacement for read data
default_keys_7 = Panel("heightLimit:50")  # disabled
group_update_reg_22 = RemoteReceiver(group_update_reg_2)  # disabled

# ---- group: force key replacement for read data / replace with copy pf attr
replace_val_11 = GhPythonScript(autoUpdate=group_update_reg_22, attr_loc_in=simplify(X_4.a), pairs_to_replace=simplify(default_keys_7))  # -> out, attr_loc_out; inputs attr_loc_in: list, pairs_to_replace: list; disabled; same code as replace_val_2

# ---- group: force key replacement for read data (continued)
ghpython_script_23 = GhPythonScript(attr_loc=replace_val_11.attr_loc_out)  # -> out, name_val; inputs attr_loc: list; disabled; same code as ghpython_script_5
panel_80 = Panel(ghpython_script_23.name_val)  # disabled

# ----
O_2 = GhPythonScript(x=replace_val_11.attr_loc_out)  # -> out, a; inputs x: list; disabled; same code as O
join_str_2 = GhPythonScript(x=panel_80)  # -> simplify(a); inputs x: list; disabled; same code as join_str
merge_7 = Merge(Data1=O.a, Data2=O_2.a)  # disabled
merge_8 = Merge(Data1=data_16, Data2=join_str_2)  # disabled
X_5 = GhPythonScript(x=merge_7)  # -> out, simplify(a); disabled; same code as X_4

# ---- group: result - length + distr
floor_50_origin_point3d = RemoteSender(merge_6)  # disabled
floor_50_tile_matrix = RemoteSender(merge_5)  # disabled
floor_50_attr_joined_str = RemoteSender(merge_8)  # disabled

# ----
floor_50_origin_point3d_2 = RemoteReceiver(floor_50_origin_point3d)  # disabled
floor_50_tile_matrix_2 = RemoteReceiver(floor_50_tile_matrix)  # disabled
floor_50_attr_joined_str_2 = RemoteReceiver(floor_50_attr_joined_str)  # disabled

fin_floor_attr_joined_str = RemoteSender(floor_50_attr_joined_str_2)  # disabled
fin_floor_tile_matrix = RemoteSender(floor_50_tile_matrix_2)  # disabled
fin_floor_origin_point3d = RemoteSender(floor_50_origin_point3d_2)  # disabled

data_19 = Data(fin_floor_attr_joined_str)  # disabled
ghpython_script_24 = GhPythonScript(x=data_19)  # -> a; disabled
# ---------- ghpython_script_24: Python ----------
a = x.splitlines()
# ---------- end ghpython_script_24 ----------

# ---- group: this sends data for attribute inspector
values_to_spreadsheet = RemoteSender(ghpython_script_24)  # disabled
headers_to_spreadsheet = RemoteSender(data_19)  # disabled

# ----
# attributes inspector (existing floors)
headers_to_spreadsheet_2 = RemoteReceiver(headers_to_spreadsheet)
values_to_spreadsheet_2 = RemoteReceiver(values_to_spreadsheet)
python_60 = GhPythonScript(attributes=values_to_spreadsheet_2)  # -> out, simplify(values)
# ---------- python_60: Python ----------
values = attributes.split(':')[1]
# ---------- end python_60 ----------
item_23 = ListItem(List=flatten(headers_to_spreadsheet_2), Index=0, Wrap=True)
tstat_4 = TreeStatistics(Tree=python_60.values)  # -> Paths, Length, Count
python_61 = GhPythonScript(attributes=item_23)  # -> out, headers
# ---------- python_61: Python ----------
headers = [a.split(":")[0] for a in attributes.splitlines()]
# ---------- end python_61 ----------
path_mapper_7 = PathMapper(python_60.values, source="{A;B;C}", target="{path_index}")
item_24 = ListItem(List=python_60.values, Index=10, Wrap=True)  # -> flatten(Item)
flip = FlipMatrix(Data=path_mapper_7)
unique_floors = Panel(tstat_4.Count)

item_25 = ListItem(List=python_60.values, Index=0, Wrap=True)  # -> flatten(Item)
_1 = RemoteSender(item_25)
_2 = RemoteSender(item_24)
attr_names_all = RemoteSender(python_61.headers)

# ---- group: SPREADSHEET RIGHT CLICK ME
datagrid = CreateDataGrid(DataGridHeaders=python_61.headers, ValueTree=flip)

# ----
_1_2 = RemoteReceiver(_1)
_2_2 = RemoteReceiver(_2)

# ---- group: variations by sect type
pie = PieChart(_1_2)

# ---- group: variations by length
pie_2 = PieChart(_2_2)

# ----
attr_names_all_2 = RemoteReceiver(attr_names_all)  # disabled
headers_to_spreadsheet_3 = RemoteReceiver(headers_to_spreadsheet)  # disabled
data_20 = Data(attr_names_all_2)  # disabled

# ---- group: complicated three growing + sorting
python_62 = GhPythonScript(attributes_existing=flatten(headers_to_spreadsheet_3), dimensions_along=data_20)  # -> out, filter_dict, filter_indexes, key_tree, none_tree, zero_tree; inputs attributes_existing: list, dimensions_along: list; disabled
# ---------- python_62: Python ----------
# -*- coding: utf-8 -*-
"""
@author: prslvtsv
"""
import scriptcontext as sc
import gblock.gh_context.gh_context as context
reload(context)

###############################################################################
# CONTEXT CREATOR BELOW | ADDS DEV METODS TO COMPONENT 
# SEE GH_CONTEXT\CONTEXT_GENERAL.TXT FOR DETAILS
###############################################################################
exec(compile(''.join(context.init()), 'init', 'exec'), locals())
###############################################################################

import ghpythonlib.treehelpers as th
from  collections import OrderedDict as oddict
from operator import itemgetter

shape = []
val_shape = oddict()
dimensionValues = oddict()

for dim in dimensions_along:
    dimensionValues[dim] = []

for att in  attributes_existing:
    at = dict([a.split(':') for a in att.splitlines()])
    for dim in dimensions_along:
        dimensionValues[dim].append(at[dim])

for k,v in dimensionValues.items():
    if k in 'length':
        dim_keys = dict([[a,int(a)] for a in v])
#    elif k in 'distribution':
#        dim_keys = dict([a.split('/') for a in v])
    else:
        dim_keys = dict([[a,a] for a in v])
        
    dim_keys = oddict(sorted(dim_keys.items(), key=itemgetter(1)))
    print dim_keys
#    if k in 'length':
#        dim_keys = oddict(reversed(list(dim_keys.items())))
    dim_shape = oddict()
    for dk in dim_keys.keys():
        dim_shape[dk] = v.count(dk)
    val_shape[k] = dim_shape
    
shape = [len(v.values()) for v in val_shape.values()]
print shape

#for k, v in val_shape.items():
#    val_shape[k] = oddict(sorted(v.items(), key=itemgetter(1)))
#print val_shape

# magic happens here 
# recursive nesting
def nest_down(lst, lvl, empty):
#    print lst[lvl]
    if lvl+1 >= len(lst):
        if not empty:
            return [[k for vv in range(v)] for k, v in lst[lvl].items()]
        else:
            return [[None for vv in range(v)] for k, v in lst[lvl].items()]
    return [nest_down(lst, lvl+1,empty) for l in range(len(lst[lvl]))]

def nest_down_zeros(lst, lvl, empty):
#    print lst[lvl]
    if lvl+1 >= len(lst):
        return [[0 for vv in range(v)] for k, v in lst[lvl].items()]
    return [nest_down_zeros(lst, lvl+1,empty) for l in range(len(lst[lvl]))]

#print val_shape.values()
nestedKey =  nest_down(val_shape.values(), 0, False)
nestedNone = nest_down(val_shape.values(), 0, True)
nestedZeros = nest_down_zeros(val_shape.values(), 0, True)
#print nestedZeros
#print np.array(nestedNone).shape
#print val_shape

mapping = []
mapping_dict = oddict()
for vs in val_shape.values():
    mapping.append(['{}:{}'.format(k,i) for i, k in enumerate(vs.keys())])
    for i, k in enumerate(vs.keys()):
        mapping_dict[k]=i

#def p(a):
#    print a
#[p(vsk)for vsk, vsv in val_shape.items()]
key_tree = th.list_to_tree(nestedKey, True)
none_tree = th.list_to_tree(nestedNone, True)
zero_tree = th.list_to_tree(nestedZeros, True)

filter_indexes = th.list_to_tree(mapping, True)
filter_dict = [mapping_dict]
# ---------- end python_62 ----------

# ----
panel_81 = Panel(data_20)  # disabled
none_three_full = RemoteSender(python_62.none_tree)  # disabled
zero_three_full = RemoteSender(python_62.zero_tree)  # disabled
mapping_filter = RemoteSender(python_62.filter_dict)  # disabled
tstat_5 = TreeStatistics(Tree=python_62.filter_indexes)  # -> Paths, Length, Count; disabled
fin_floor_tile_matrix_2 = RemoteReceiver(fin_floor_tile_matrix)  # disabled
mapping_filter_2 = RemoteReceiver(mapping_filter)  # disabled
fin_floor_attr_joined_str_2 = RemoteReceiver(fin_floor_attr_joined_str)  # disabled
mapping_filter_3 = RemoteReceiver(mapping_filter)  # disabled
attr_names_all_3 = RemoteReceiver(attr_names_all)  # disabled
fin_floor_attr_joined_str_3 = RemoteReceiver(fin_floor_attr_joined_str)  # disabled
attr_names_all_4 = RemoteReceiver(attr_names_all)  # disabled
fin_floor_origin_point3d_2 = RemoteReceiver(fin_floor_origin_point3d)  # disabled
item_26 = ListItem(List=tstat_5.Paths, Index=-1, Wrap=True)  # disabled
panel_82 = Panel(python_62.filter_indexes)  # disabled
branch = TreeBranch(Tree=python_62.filter_indexes, Path=item_26, MaintainPaths=True)  # disabled
python_63 = GhPythonScript(y=branch)  # -> out, distr_shape; inputs y: list; disabled
# ---------- python_63: Python ----------
# -*- coding: utf-8 -*-
"""
@author: prslvtsv
"""
import scriptcontext as sc
import gblock.gh_context.gh_context as context
reload(context)

###############################################################################
# CONTEXT CREATOR BELOW | ADDS DEV METODS TO COMPONENT 
# SEE GH_CONTEXT\CONTEXT_GENERAL.TXT FOR DETAILS
###############################################################################
exec(compile(''.join(context.init()), 'init', 'exec'), locals())
###############################################################################
from  collections import OrderedDict as oddict

keys = oddict([[v.split('/')[0],v.split('/')[1]]  for v in y]).keys()
lst = [v.split('/')[0]  for v in y]
shape = []

for k in keys:
    shape.append(lst.count(k))
print keys, lst
print shape

distr_shape = shape
# ---------- end python_63 ----------
mapping_filter_4 = RemoteReceiver(mapping_filter)  # disabled
fin_floor_attr_joined_str_4 = RemoteReceiver(fin_floor_attr_joined_str)  # disabled
attr_names_all_5 = RemoteReceiver(attr_names_all)  # disabled
fin_floor_origin_point3d_3 = RemoteReceiver(fin_floor_origin_point3d)  # disabled
part_shape = RemoteSender(python_63.distr_shape)  # disabled
data_21 = Data(graft(fin_floor_tile_matrix_2))  # disabled
data_22 = Data(graft(fin_floor_origin_point3d_2))  # disabled
python_64 = GhPythonScript(x=mapping_filter_4)  # -> out, a; disabled
# ---------- python_64: Python ----------
def p(r):
    print r

[p([k, v]) for k,v in x.items()]
# ---------- end python_64 ----------

# ---- group: generate replace path for incoming data structure(use attrib list as alighment)
python_65 = GhPythonScript(mapping_filter=mapping_filter_2, attributes_in=fin_floor_attr_joined_str_2, data_in=data_21, group_by=attr_names_all_3)  # -> out, replace_mask, generated_path; inputs attributes_in: tree, data_in: tree, group_by: list; disabled
# ---------- python_65: Python ----------
# -*- coding: utf-8 -*-
"""
@author: prslvtsv
"""
import scriptcontext as sc
import gblock.gh_context.gh_context as context
reload(context)

###############################################################################
# CONTEXT CREATOR BELOW | ADDS DEV METODS TO COMPONENT 
# SEE GH_CONTEXT\CONTEXT_GENERAL.TXT FOR DETAILS
###############################################################################
exec(compile(''.join(context.init()), 'init', 'exec'), locals())
###############################################################################

import ghpythonlib.treehelpers as th
from  collections import OrderedDict as oddict
from operator import itemgetter

attr = th.tree_to_list(attributes_in, None)
data = th.tree_to_list(data_in, None)
path_mapper = mapping_filter

path = []
mask = []
for i, at in enumerate(attr):
    
    if at != None:
        for j, v in enumerate(at):
            for ii, iv in enumerate(v):
                path_dict = dict([[d.split(":")[0],d.split(":")[1]] for d in iv.splitlines()])
                map =[path_mapper[path_dict[gr]] for gr in group_by]
                pp = gh.Kernel.Data.GH_Path()
                print map
                for m in map:
                    pp = pp.AppendElement(int(m))
                path.append(pp)
                ms = "{"+"{};{};{}".format(i, j, ii)+"}"
                mask.append(ms)
#    else:
#        path.append(None)
replace_mask = mask
generated_path = path
# ---------- end python_65 ----------

python_66 = GhPythonScript(mapping_filter=mapping_filter_3, attributes_in=fin_floor_attr_joined_str_3, data_in=data_22, group_by=attr_names_all_4)  # -> out, replace_mask, generated_path; inputs attributes_in: tree, data_in: tree, group_by: list; disabled; same code as python_65

# ----
data_23 = Data(graft(fin_floor_attr_joined_str_4))  # disabled
floor_50_attr_obj = RemoteSender(X_5.a)  # disabled
panel_83 = Panel(python_64.out)  # disabled

# ---- group: generate replace path for incoming data structure(use attrib list as alighment)
python_67 = GhPythonScript(mapping_filter=mapping_filter_4, attributes_in=fin_floor_attr_joined_str_4, data_in=data_23, group_by=attr_names_all_5)  # -> out, replace_mask, generated_path; inputs attributes_in: tree, data_in: tree, group_by: list; disabled
# ---------- python_67: Python ----------
# -*- coding: utf-8 -*-
"""
@author: prslvtsv
"""
import scriptcontext as sc
import gblock.gh_context.gh_context as context
reload(context)

###############################################################################
# CONTEXT CREATOR BELOW | ADDS DEV METODS TO COMPONENT 
# SEE GH_CONTEXT\CONTEXT_GENERAL.TXT FOR DETAILS
###############################################################################
exec(compile(''.join(context.init()), 'init', 'exec'), locals())
###############################################################################

import ghpythonlib.treehelpers as th
from  collections import OrderedDict as oddict
from operator import itemgetter

attr = th.tree_to_list(attributes_in, None)
data = th.tree_to_list(data_in, None)
path_mapper = mapping_filter

path = []
mask = []
for i, at in enumerate(attr):
    
    if at != None:
        for j, v in enumerate(at):
            for ii, iv in enumerate(v):
                path_dict = dict([[d.split(":")[0],d.split(":")[1]] for d in iv.splitlines()])
                 
                map =[path_mapper[path_dict[gr]] for gr in group_by]
                pp = gh.Kernel.Data.GH_Path()
                print map
                for m in map:
                    pp = pp.AppendElement(int(m))
                path.append(pp)
                ms = "{"+"{};{};{}".format(i, j, ii)+"}"
                mask.append(ms)
#    else:
#        path.append(None)
replace_mask = mask
generated_path = path
# ---------- end python_67 ----------

# ----
path = DataPath(python_65.generated_path)  # disabled
path_2 = DataPath(python_66.generated_path)  # disabled
values_to_spreadsheet_3 = RemoteReceiver(values_to_spreadsheet)  # disabled

# ---- group: remap path
replace = ReplacePaths(Data=simplify(data_21), Search=python_65.replace_mask, Replace=path)  # disabled

# ----
data_24 = Data(simplify(replace))  # disabled
python_68 = GhPythonScript(tileMatrix_in=data_24)  # -> out, tiles_crv_flat, tiles_states_flat, tiles_mtx_idx_flat, tiles_app_num_flat; disabled
# ---------- python_68: Python ----------
# -*- coding: utf-8 -*-
"""
@author: prslvtsv
"""
import scriptcontext as sc
import gblock.gh_context.gh_context as context
reload(context)

###############################################################################
# CONTEXT CREATOR BELOW | ADDS DEV METODS TO COMPONENT 
# SEE GH_CONTEXT\CONTEXT_GENERAL.TXT FOR DETAILS
###############################################################################
exec(compile(''.join(context.init()), 'init', 'exec'), locals())
###############################################################################

tileMatrix = tileMatrix_in
tiles_crv_flat = []
tiles_states_flat = []
tiles_mtx_idx_flat = []
tiles_app_num_flat = []

for ci, col in enumerate(tileMatrix.data):
#    print col
    for ri, row in enumerate(tileMatrix.data[ci]):
        for ti, tpos in enumerate(tileMatrix.data[ci][ri]):
            if tpos != None:
                tiles_crv_flat.append(tpos.ghGeo)
#                print tpos.state
                tiles_states_flat.append(tpos.state)
#                print tpos.matPos
                tiles_mtx_idx_flat.append("{}:{}".format(tpos.matPos[0], tpos.matPos[1]))
                tiles_app_num_flat.append(tpos.appNumber)
            else:
                tiles_crv_flat.append(None)
                tiles_states_flat.append(None)
                tiles_mtx_idx_flat.append(None)
                tiles_app_num_flat.append(None)
#                tileMatrix.data[ci][ri][ti].matPos = [ri, ci]
# ---------- end python_68 ----------

# ---- group: remap path
replace_2 = ReplacePaths(Data=simplify(data_22), Search=python_66.replace_mask, Replace=path_2)  # disabled

# ----
data_25 = Data(simplify(replace_2))  # disabled
trim_5 = TrimTree(Tree=data_25, Depth=1)  # disabled
trim_6 = TrimTree(Tree=trim_5, Depth=1)  # disabled
tstat_6 = TreeStatistics(Tree=trim_6)  # -> Paths, Length, Count; disabled
lng_21 = ListLength(List=trim_5)  # disabled
dpath_5 = DeconstructPath(Branch=tstat_6.Paths)  # -> simplify(Indices); disabled
lng_22 = ListLength(List=trim_6)  # disabled
trim_7 = TrimTree(Tree=lng_21, Depth=1)  # disabled
lng_23 = ListLength(List=dpath_5)  # disabled
lng_24 = ListLength(List=trim_7)  # disabled
multiplication_4 = Multiplication(A=lng_22, B=number_slider_3)  # disabled
multiplication_5 = Multiplication(A=trim_7, B=number_slider_3)  # disabled
series_8 = Series(Start=0, Step=number_slider_3, Count=lng_23)  # disabled
multiplication_6 = Multiplication(A=lng_23, B=series_8)  # disabled
panel_85 = Panel(lng_22)  # disabled
panel_86 = Panel(lng_23)  # disabled
series_9 = Series(Start=0, Step=number_slider_3, Count=lng_22)  # disabled
series_10 = Series(Start=0, Step=number_slider_2, Count=lng_24)  # -> simplify(Series); disabled
tstat_7 = TreeStatistics(Tree=series_9)  # -> Paths, Length, Count; disabled
addition_4 = Addition(B=multiplication_6)  # disabled
lng_25 = ListLength(List=tstat_7.Paths)  # disabled
trim_8 = TrimTree(Tree=series_10, Depth=1)  # -> flatten(Tree); disabled
X_6 = UnitX(Factor=multiplication_6)  # disabled
series_11 = Series(Start=0, Step=number_slider_3, Count=lng_25)  # disabled
pt_3 = ConstructPoint(XCoordinate=series_9, YCoordinate=series_8, ZCoordinate=0)  # disabled
path_3 = DataPath(python_67.generated_path)  # disabled
pt_4 = ConstructPoint(XCoordinate=series_9, YCoordinate=graft(series_11), ZCoordinate=0)  # disabled

# ---- group: remap path
replace_3 = ReplacePaths(Data=simplify(data_23), Search=python_67.replace_mask, Replace=path_3)  # disabled

# ----
simplify = SimplifyTree(Tree=replace, Front=False)  # disabled
viewer_11 = ParamViewer(replace_3)  # disabled

# ---- group: explode tile matrix & tile object
python_69 = GhPythonScript(tileMatrix_in=replace)  # -> out, tiles_crv_flat, tiles_states_flat, tiles_mtx_idx_flat, tiles_app_num_flat; disabled; same code as python_68

# ----
viewer_12 = ParamViewer(simplify)  # disabled
data_26 = Data(simplify(replace_3))  # disabled
trim_9 = TrimTree(Tree=replace_3, Depth=2)  # -> simplify(Tree); disabled
trim_10 = TrimTree(Tree=replace_3, Depth=1)  # disabled
viewer_13 = ParamViewer(data_26)  # disabled
trim_11 = TrimTree(Tree=data_26, Depth=1)  # disabled
lng_26 = ListLength(List=trim_10)  # -> flatten(Length); disabled
group_3 = Group(Objects=python_69.tiles_crv_flat)  # -> simplify(Group); disabled
dpath_6 = DeconstructPath(Branch=viewer_11)  # disabled
flip_2 = FlipMatrix(Data=dpath_6)  # disabled
dpath_7 = DeconstructPath(Branch=viewer_13)  # disabled
data_27 = Data(pt_4)  # disabled
trim_12 = TrimTree(Tree=group_3, Depth=1)  # disabled
flip_3 = FlipMatrix(Data=dpath_7)  # disabled
trim_13 = TrimTree(Tree=python_69.tiles_states_flat, Depth=1)  # disabled
trim_14 = TrimTree(Tree=trim_12, Depth=1)  # disabled
center_2 = Center(Geometric=trim_14)  # -> Center, Dimension; disabled
orient_3 = Orient(Geometry=trim_14, Source=center_2.Center, Target=data_27)  # -> Geometry, Transform; disabled
zero_three_full_2 = RemoteReceiver(zero_three_full)  # disabled
none_three_full_2 = RemoteReceiver(none_three_full)  # disabled
data_28 = Data(replace_2)  # disabled
part_shape_2 = RemoteReceiver(part_shape)  # disabled
match_3 = MatchTree(Tree=python_69.tiles_crv_flat, Guide=replace)  # disabled
group_4 = Group(Objects=match_3)  # disabled
simplify_2 = SimplifyTree(Tree=zero_three_full_2, Front=False)  # disabled
group_5 = Group(Objects=[group_4, replace_2])  # disabled
center_3 = Center(Geometric=group_5)  # -> Center, Dimension; disabled
orient_4 = Orient(Geometry=rectangle.Rectangle, Source=pcen.CenterV, Target=center_3.Center)  # -> Geometry, Transform; disabled
end = EndPoints(Curve=orient_4.Geometry)  # -> Start, End; disabled
lbc_point = Data(end.Start)  # disabled
frames = Data(orient_4.Geometry)  # disabled
viewer_14 = ParamViewer(match_3)  # disabled
match_4 = MatchTree(Tree=lbc_point, Guide=replace)  # disabled
trim_15 = TrimTree(Tree=simplify_2, Depth=1)  # disabled
partition_2 = PartitionList(List=trim_15, Size=part_shape_2)  # disabled
match_5 = MatchTree(Tree=frames, Guide=replace)  # disabled
part_shape_3 = RemoteReceiver(part_shape)  # disabled
chars = Characters(Text=viewer_14)  # -> Result, Unicode; disabled
tstat_8 = TreeStatistics(Tree=simplify_2)  # -> Paths, Length, Count; disabled
group_6 = Group(Objects=[group_5, match_5, match_4])  # disabled
data_29 = Data(group_6)  # disabled
simplify_3 = SimplifyTree(Tree=data_29, Front=False)  # disabled
trim_16 = TrimTree(Tree=simplify_3, Depth=1)  # disabled
viewer_15 = ParamViewer(simplify_3)  # disabled
partition_3 = PartitionList(List=trim_16, Size=part_shape_3)  # -> graft(Chunks); disabled
txt = Text(tstat_8.Paths)  # disabled
tstat_9 = TreeStatistics(Tree=simplify_2)  # -> Paths, Length, Count; disabled
simplify_4 = SimplifyTree(Tree=group_6, Front=False)  # disabled

# ---- group: get shape
python_70 = GhPythonScript(three_in=simplify_2)  # -> out, shape, dim_length; inputs three_in: tree; disabled
# ---------- python_70: Python ----------
# -*- coding: utf-8 -*-
"""
@author: prslvtsv
"""
import scriptcontext as sc
import gblock.gh_context.gh_context as context
reload(context)

###############################################################################
# CONTEXT CREATOR BELOW | ADDS DEV METODS TO COMPONENT 
# SEE GH_CONTEXT\CONTEXT_GENERAL.TXT FOR DETAILS
###############################################################################
exec(compile(''.join(context.init()), 'init', 'exec'), locals())
###############################################################################

import ghpythonlib.treehelpers as th

arr = th.tree_to_list(three_in)

# Fast way of sending data for numpy array creation
remote_range = ghpythonremote.deliver(rpy, arr)
array = np.array(remote_range)
shape = array.shape
dim_length =  len(array.shape)
# This is much slower
#b = np.array(range(1000))

# Get the array back as a local IronPython list
#list = ghpythonremote.obtain(array.tolist())
# ---------- end python_70 ----------

# ----
lng_27 = ListLength(List=partition_3)  # -> flatten(Length); disabled
tstat_10 = TreeStatistics(Tree=partition_3)  # -> Paths, Length, Count; disabled
tstat_11 = TreeStatistics(Tree=simplify_2)  # -> Paths, Length, Count; disabled
tstat_12 = TreeStatistics(Tree=simplify_2)  # -> Paths, Length, Count; disabled
viewer_16 = ParamViewer(simplify_2)  # disabled
dpath_8 = DeconstructPath(Branch=tstat_9.Paths)  # -> simplify(Indices); disabled
txt_2 = Text(tstat_10.Paths)  # disabled
panel_87 = Panel(python_70.shape)  # disabled
flip_4 = FlipMatrix(Data=dpath_8)  # disabled
tstat_13 = TreeStatistics(Tree=simplify_4)  # -> Paths, Length, Count; disabled
dpath_9 = DeconstructPath(Branch=tstat_11.Paths)  # disabled
python_71 = GhPythonScript(x=txt, y=txt_2)  # -> out, a; inputs y: list; disabled
# ---------- python_71: Python ----------
a = x in y
# ---------- end python_71 ----------
extremums_2 = MinMax(Number=flip_4)  # -> Minimum, Maximum; disabled
trim_17 = TrimTree(Tree=dpath_9, Depth=1)  # disabled
addition_5 = Addition(A=extremums_2.Maximum, B=1)  # -> flatten(Result); disabled
cull_30 = CullPattern(List=tstat_8.Paths, CullPattern=python_71.a)  # -> flatten(List); disabled
panel_88 = Panel(dpath_9)  # disabled
panel_89 = Panel(addition_5)  # disabled
panel_90 = Panel(lng_27)  # disabled
python_72 = GhPythonScript(table_shape=panel_89, x=number_slider_6)  # -> out, a, x_crd, y_crd; inputs table_shape: list; disabled
# ---------- python_72: Python ----------
# -*- coding: utf-8 -*-
"""
@author: prslvtsv
"""
import scriptcontext as sc
import gblock.gh_context.gh_context as context
reload(context)

###############################################################################
# CONTEXT CREATOR BELOW | ADDS DEV METODS TO COMPONENT 
# SEE GH_CONTEXT\CONTEXT_GENERAL.TXT FOR DETAILS
###############################################################################
exec(compile(''.join(context.init()), 'init', 'exec'), locals())
###############################################################################
import ghpythonlib.treehelpers as th
b = [range(int(v)) for v in table_shape]

b = [[v*x for v in vv] for vv in b]
a = th.list_to_tree(b, True)
xx = b[-1]
yy = b[-2]

#yincr = (len(yy) * x)*1.2
#xincr = (len(xx) * x)*1.2

#print yincr, xincr
yt = []
for i in xx:
    yt.append(yy)

xt = []
for i in yy:
    xt.append(xx)
    
x_crd = th.list_to_tree(xt)
y_crd = th.list_to_tree(yt)
# ---------- end python_72 ----------
cull_i = CullIndex(List=panel_89, Indices=[-1, -2], Wrap=True)  # disabled
txt_3 = Text(tstat_13.Paths)  # disabled
flip_5 = FlipMatrix(Data=python_72.y_crd)  # disabled
dispatch = Dispatch(List=cull_i, DispatchPattern=[True, True, False, False])  # -> ListA, ListB; disabled
pt_5 = ConstructPoint(XCoordinate=python_72.x_crd, YCoordinate=flip_5, ZCoordinate=0)  # -> simplify(Point); disabled
bbox = BoundingBox(Content=flatten(pt_5), Plane=PlaneXY(0, 0, 0), UnionBox=True)  # -> Box, Box_2; disabled
dim = Dimensions(Surface=bbox.Box)  # -> UDimension, VDimension; disabled
ma = MassAddition(Input=dispatch.ListA)  # -> Result, PartialResults; disabled
multiplication_7 = Multiplication(A=dim.UDimension, B=number_slider_9)  # disabled
multiplication_8 = Multiplication(A=dim.VDimension, B=number_slider_10)  # disabled
ma_2 = MassAddition(Input=dispatch.ListB)  # -> Result, PartialResults; disabled
lng_28 = ListLength(List=dispatch.ListA)  # disabled
python_73 = GhPythonScript(other_axis=panel_87, x_crd_in=python_72.x_crd, y_crd_in=flip_5, x_off=dim.UDimension, y_off=dim.VDimension)  # -> out, pt_out, x_crd, y_crd; inputs other_axis: list, x_crd_in: tree, y_crd_in: tree; disabled
# ---------- python_73: Python ----------
# -*- coding: utf-8 -*-
"""
@author: prslvtsv
"""
import scriptcontext as sc
import gblock.gh_context.gh_context as context
reload(context)

###############################################################################
# CONTEXT CREATOR BELOW | ADDS DEV METODS TO COMPONENT 
# SEE GH_CONTEXT\CONTEXT_GENERAL.TXT FOR DETAILS
###############################################################################
exec(compile(''.join(context.init()), 'init', 'exec'), locals())
###############################################################################
import ghpythonlib.treehelpers as th

axis = other_axis[:-2]
x_crd_in_lst = th.tree_to_list(x_crd_in)
y_crd_in_lst = th.tree_to_list(y_crd_in)

print len(x_crd_in_lst), len(y_crd_in_lst)
xd = []
yd = []
for i, ax in enumerate(axis):
    if i % 2 == 0:
        xd.append(ax)
    else:
        yd.append(ax)
        
print xd, yd

x_ax = []
y_ax = []

for i, ix in enumerate(xd):
    for xx in range(int(ix)):
        x_ax.append([[xcc + xx*(x_off*1.1)*(i+1) for xcc in xc] for xc in x_crd_in_lst])
x_crd = th.list_to_tree(x_ax)

for iy in yd:
    for yy in range(int(iy)):
        x_ax_l = []
        for xa in x_ax:
            x_ax_l.append([[ycc + yy*y_off for ycc in yc] for yc in y_crd_in_lst])
y_crd = th.list_to_tree(y_ax)
#x_crd = th.list_to_tree(xt)
#y_crd = th.list_to_tree(yt)
# ---------- end python_73 ----------
series_12 = Series(Start=0, Step=multiplication_8, Count=dispatch.ListB)  # disabled
series_13 = Series(Start=0, Step=multiplication_7, Count=ma.Result)  # disabled
series_14 = Series(Start=1, Step=1, Count=lng_28)  # disabled
group_7 = Group(Objects=pt_5)  # -> flatten(Group); disabled
X_7 = UnitX(Factor=series_13)  # -> graft(UnitVector); disabled
multiplication_9 = Multiplication(A=graft(series_12), B=series_14)  # disabled
Y_3 = UnitY(Factor=multiplication_9)  # -> flatten(UnitVector); disabled
group_8 = Group(Objects=group_7)  # disabled
multiplication_10 = Multiplication(A=multiplication_9, B=number_slider_11)  # disabled
dup_18 = DuplicateData(Data=group_8, Number=dispatch.ListA, Order=True)  # -> graft(Data); disabled
move_6 = Move(Geometry=dup_18, Motion=X_7)  # -> Geometry, Transform; disabled
pt_6 = ConstructPoint(XCoordinate=python_73.x_crd, YCoordinate=python_73.y_crd, ZCoordinate=0)  # disabled
simplify_5 = SimplifyTree(Tree=dup_18, Front=False)  # disabled
move_7 = Move(Geometry=move_6.Geometry, Motion=Y_3)  # -> Geometry, Transform; disabled
ungroup = Ungroup(Group=move_7.Geometry)  # disabled
ungroup_2 = Ungroup(Group=ungroup)  # -> graft(Objects); disabled
data_30 = Data(simplify(ungroup_2))  # disabled
tstat_14 = TreeStatistics(Tree=data_30)  # -> Paths, Length, Count; disabled
compare = PathCompare(Path=tstat_13.Paths, Mask=tstat_14.Paths)  # disabled
txt_4 = Text(tstat_14.Paths)  # disabled
python_74 = GhPythonScript(x=txt_4, y=txt_3)  # -> out, a; inputs y: list; disabled; same code as python_71
pie_3 = PieChart(python_74.a)  # disabled
cull_31 = CullPattern(List=tstat_14.Paths, CullPattern=python_74.a)  # disabled
branch_2 = TreeBranch(Tree=data_30, Path=cull_31, MaintainPaths=True)  # disabled

# ---- group: PATH
headers_to_spreadsheet_4 = RemoteReceiver(headers_to_spreadsheet)  # disabled
grow_three_axis = Panel("""sectionType
length
distribution""")  # disabled
fin_floor_origin_point3d_4 = RemoteReceiver(fin_floor_origin_point3d)  # disabled
fin_floor_attr_joined_str_5 = RemoteReceiver(fin_floor_attr_joined_str)  # disabled

# ---- group: PATH / complicated three growing + sorting
python_75 = GhPythonScript(attributes_existing=flatten(headers_to_spreadsheet_4), dimensions_along=grow_three_axis)  # -> out, filter_dict, filter_indexes, simplify(key_tree), simplify(none_tree); inputs attributes_existing: list, dimensions_along: list; disabled
# ---------- python_75: Python ----------
# -*- coding: utf-8 -*-
"""
@author: prslvtsv
"""
import scriptcontext as sc
import gblock.gh_context.gh_context as context
reload(context)

###############################################################################
# CONTEXT CREATOR BELOW | ADDS DEV METODS TO COMPONENT 
# SEE GH_CONTEXT\CONTEXT_GENERAL.TXT FOR DETAILS
###############################################################################
exec(compile(''.join(context.init()), 'init', 'exec'), locals())
###############################################################################

import ghpythonlib.treehelpers as th
from  collections import OrderedDict as oddict
from operator import itemgetter

shape = []
val_shape = oddict()
dimensionValues = oddict()

for dim in dimensions_along:
    dimensionValues[dim] = []

for att in  attributes_existing:
    at = dict([a.split(':') for a in att.splitlines()])
    for dim in dimensions_along:
        dimensionValues[dim].append(at[dim])

for k,v in dimensionValues.items():
    
    dim_keys = dict([[a,a] for a in v])
    dim_keys = oddict(sorted(dim_keys.items(), key=itemgetter(1)))
    if k in 'length':
        dim_keys = oddict(reversed(list(dim_keys.items())))
    dim_shape = oddict()
    for dk in dim_keys.keys():
        dim_shape[dk] = v.count(dk)
    val_shape[k] = dim_shape
    
shape = [len(v.values()) for v in val_shape.values()]


#for k, v in val_shape.items():
#    val_shape[k] = oddict(sorted(v.items(), key=itemgetter(1)))
#print val_shape

# magic happens here 
# recursive nesting
def nest_down(lst, lvl, empty):
#    print lst[lvl]
    if lvl+1 >= len(lst):
        if not empty:
            return [[k for vv in range(v)] for k, v in lst[lvl].items()]
        else:
            return [[None for vv in range(v)] for k, v in lst[lvl].items()]
    return [nest_down(lst, lvl+1,empty) for l in range(len(lst[lvl]))]


print val_shape.values()
nestedKey =  nest_down(val_shape.values(), 0, False)
nestedNone = nest_down(val_shape.values(), 0, True)
#print val_shape

mapping = []
mapping_dict = {}
for vs in val_shape.values():
    mapping.append(['{}:{}'.format(k,i) for i, k in enumerate(vs.keys())])
    for i, k in enumerate(vs.keys()):
        mapping_dict[k]=i

#def p(a):
#    print a
#[p(vsk)for vsk, vsv in val_shape.items()]
key_tree = th.list_to_tree(nestedKey, True)
none_tree = th.list_to_tree(nestedNone, True)
filter_indexes = th.list_to_tree(mapping, True)
filter_dict = [mapping_dict]
# ---------- end python_75 ----------

# ---- group: PATH / generate replace path for incoming data structure(use attrib list as alighment)
python_76 = GhPythonScript(
    mapping_filter=python_75.filter_dict,
    attributes_in=fin_floor_attr_joined_str_5,
    data_in=fin_floor_origin_point3d_4,
    group_by=grow_three_axis)  # -> out, replace_mask, generated_path; inputs attributes_in: tree, data_in: tree, group_by: list; disabled
# ---------- python_76: Python ----------
# -*- coding: utf-8 -*-
"""
@author: prslvtsv
"""
import scriptcontext as sc
import gblock.gh_context.gh_context as context
reload(context)

###############################################################################
# CONTEXT CREATOR BELOW | ADDS DEV METODS TO COMPONENT 
# SEE GH_CONTEXT\CONTEXT_GENERAL.TXT FOR DETAILS
###############################################################################
exec(compile(''.join(context.init()), 'init', 'exec'), locals())
###############################################################################

import ghpythonlib.treehelpers as th
from  collections import OrderedDict as oddict
from operator import itemgetter

attr = th.tree_to_list(attributes_in, None)
data = th.tree_to_list(data_in, None)
path_mapper = mapping_filter

path = []
mask = []
for i, at in enumerate(attr):
    if at != None:
        for j, v in enumerate(at):
            path_dict = dict([[d.split(":")[0],d.split(":")[1]] for d in v[0].splitlines()])
            map =[path_mapper[path_dict[gr]] for gr in group_by]
            pp = gh.Kernel.Data.GH_Path()
            for m in map:
                pp = pp.AppendElement(int(m))
            path.append(pp)
            ms = "{"+"{};{}".format(i, j)+"}"
            mask.append(ms)
#    else:
#        path.append(None)
replace_mask = mask
generated_path = path
# ---------- end python_76 ----------

# ---- group: PATH (continued)
path_4 = DataPath(python_76.generated_path)  # disabled
new_sorted_path = RemoteSender(graft(path_4))  # disabled
path_replace_mask = RemoteSender(python_76.replace_mask)  # disabled
empty_data_three = RemoteSender(python_75.none_tree)  # disabled

# ----
dup_19 = DuplicateData(Data=new_sorted_path, Number=2, Order=True)  # -> flatten(Data); disabled
