# Grasshopper definition appt_test_4.gh (Grasshopper 1.0.7)
# Copyright: prslvtsv
# plug-ins: Telepathy

# ---- group: PARAMETERS
# C:\Windows\System32\WindowsPowerShell\v1.0\powershell.exe -ExecutionPolicy ByPass -NoExit -Command "& 'C:\ProgramData\Anaconda3\shell\condabin\conda-hook.ps1' ; conda activate 'C:\ProgramData\Anaconda3' "
panel = Panel("\"C:\\ProgramData\\Anaconda3\\shell\\condabin\\conda-hook.ps1; conda activate C:\\ProgramData\\Anaconda3\\envs\\exc43;\"")
solver_file = Panel("C:\Users\GUEST\Documents\CODE\aective\sectiondev\appartments_solver\gh_solver.py")
solver_file_2 = Panel("C:\Users\GUEST\Documents\CODE\aective\sectiondev\appartments_solver\gh_solver_conditional.py")
shell_executable = RemoteSender("C:\Windows\System32\WindowsPowerShell\v1.0\powershell.exe")
solver_conditional_script = RemoteSender(solver_file_2)
conda_activate = RemoteSender(panel)
solver_script = RemoteSender(solver_file)

# ----
pipeline = GeometryPipeline(
    GroupByLayer=False,
    GroupByType=False,
    IncludeHidden=False,
    IncludeLocked=False,
    LayerFilter="floor_matrix::points",
    NameFilter="*",
    SublayerFiltering=True,
    TypeFilter=1)
pipeline_2 = GeometryPipeline(
    GroupByLayer=False,
    GroupByType=False,
    IncludeHidden=False,
    IncludeLocked=False,
    LayerFilter="apartments::possible",
    NameFilter="*",
    SublayerFiltering=True,
    TypeFilter=1)
pgroups = PointGroups(Points=pipeline_2, Distance=Slider(2.5, range=0..10))  # -> Groups, Indices
pgroups_2 = PointGroups(Points=pipeline, Distance=Slider(2.5, range=0..10))  # -> Groups, Indices

# ---- group: convert points to indexes
indx = GhPythonScript(points=pgroups_2.Groups)  # -> out, indexes, xy; inputs points: list of Point3d
# ---------- indx: Python ----------
import gh_components_script.gh_points2matrix as p2m
reload(p2m)

indexes = p2m.points2matrix_ij(points)
xy = p2m.points2matrix_xy(points)
# ---------- end indx ----------

# ----
vec = VectorXYZ(XComponent=0, YComponent="0.2", ZComponent=0)  # -> Vector, Length

# ---- group: DISPLAY / display mat indexes
disp = Disp_3(xy=indx.xy, T=indx.indexes)

# ---- group: convert points to indexes
indx_2 = GhPythonScript(points=pgroups.Groups)  # -> out, indexes, xy; inputs points: list of Point3d; same code as indx

# ----
x_y = GhPythonScript(xy=indx_2.xy)  # -> x, y; inputs xy: list; same code as x_y
pt = ConstructPoint(XCoordinate=x_y.x, YCoordinate=x_y.y, ZCoordinate=0)
move = Move(Geometry=pt, Motion=vec.Vector)  # -> Geometry, Transform
cluster = Cluster(p=pt)

# ---- group: display indexing
tag = TextTag(Location=move.Geometry, Text=indx_2.indexes, Colour=ColourSwatch(SwatchColor=RGB(0, 0, 0)))

# ---- group: DISPLAY / display cells tiles
disp_2 = Disp(geo_to_viz=disp)

# ---- group: create from indexes
python = GhPythonScript(indexes=indx.indexes)  # -> out, matrix, cells; inputs indexes: list
# ---------- python: Python ----------
# -*- coding: utf-8 -*-
"""
@author: prslvtsv
"""
###############################################################
#import ghdev.devcon as dev
#reload(dev)
#
#dev.init_dev_tools(locals(),  config=dev_options, verbose=True)
###############################################################
import gblock.elements.matrix as mtx
reload(mtx)


matrix = mtx.SpacialMatrix.create_from_indexes(indexes, data="cell")
cells = matrix.active_indexes()
# ---------- end python ----------

# ---- group: DISPLAY / display point groups
disp_3 = Disp_2(data=pgroups_2.Groups)

# ---- group: display cells tiles
disp_4 = Disp(geo_to_viz=cluster)

# ---- group: display point groups
disp_5 = Disp_2(data=pgroups.Groups)

# ---- group: create from indexes
python_2 = GhPythonScript(indexes=indx_2.indexes)  # -> out, matrix, cells; inputs indexes: list; same code as python

# ----
python_3 = GhPythonScript(matrix=python.matrix)  # -> out, representation, cells_indx
# ---------- python_3: Python ----------
# -*- coding: utf-8 -*-
"""
@author: prslvtsv
"""
###############################################################
#import ghdev.devcon as dev
#reload(dev)
#
#dev.init_dev_tools(locals(),  config=dev_options, verbose=True)
###############################################################
import gblock.elements.matrix as mtx
reload(mtx)


representation = matrix.__repr__()
cells_indx = matrix.active_indexes()
# ---------- end python_3 ----------
python_4 = GhPythonScript(matrix=python_2.matrix)  # -> out, representation, cells_indx; same code as python_3
panel_2 = Panel(python_4.cells_indx)
panel_3 = Panel(python_4.representation)
panel_4 = Panel(python_3.representation)
tstat = TreeStatistics(Tree=python_4.cells_indx)  # -> Paths, Length, Count
item = ListItem(List=tstat.Paths, Index=-1, Wrap=True)
branch = TreeBranch(Tree=python_4.cells_indx, Path=item, MaintainPaths=True)
ghpython_script = GhPythonScript(tiles=branch)  # -> flatten(formated); inputs tiles: list
# ---------- ghpython_script: Python ----------
# -*- coding: utf-8 -*-
"""
@author: prslvtsv
"""
###############################################################
#import ghdev.devcon as dev
#reload(dev)
#
#dev.init_dev_tools(locals(),  config=dev_options, verbose=True)
###############################################################
#

formated = ":".join(["{},{}".format(x, y) for (x,y) in tiles] )
print formated
# ---------- end ghpython_script ----------

# ---- group: appartments templates
appt_23_o = RemoteReceiver()
appt_23_p = RemoteReceiver()
appt_12_i = RemoteReceiver()
appt_13_i = RemoteReceiver()
appt_23_j = RemoteReceiver()
appt_33_j = RemoteReceiver()

# ----
ghpython_script_2 = GhPythonScript(tiles=ghpython_script)  # -> formated; inputs tiles: list
# ---------- ghpython_script_2: Python ----------
# -*- coding: utf-8 -*-
"""
@author: prslvtsv
"""
###############################################################
#import ghdev.devcon as dev
#reload(dev)
#
#dev.init_dev_tools(locals(),  config=dev_options, verbose=True)
###############################################################


formated = "..".join(tiles)
# ---------- end ghpython_script_2 ----------
python_5 = GhPythonScript(matrix=python.matrix)  # -> shape, remove_idx, remove_idx_str
# ---------- python_5: Python ----------
act = set(matrix.active_indexes())
mat = set(matrix.indexes())

shape = matrix.shape()
remove_idx = list(mat-act)
remove_idx_str =  ":".join(["{},{}".format(x, y) for (x,y) in remove_idx])
if len(remove_idx_str) == 0:
    remove_idx_str = "None"
#(si, sj) = matrix.shape()
#print si*sj
#print matrix.count_active()
#print si*sj - len((mat - act))
# ---------- end python_5 ----------
solver_conditional_script_2 = RemoteReceiver(solver_conditional_script)
python_6 = GhPythonScript(filler=ghpython_script_2)  # -> out, tileset
# ---------- python_6: Python ----------
# -*- coding: utf-8 -*-
"""
@author: prslvtsv
"""
###############################################################
#import ghdev.devcon as dev
#reload(dev)
#
#dev.init_dev_tools(locals(),  config=dev_options, verbose=True)
###############################################################

tileset = ""
if mandatory != None:
    tileset += "-m {} ".format(mandatory)
if optional != None:
    tileset += "-o {} ".format(optional)
if filler != None:
    tileset += "-f {} ".format(filler)
# ---------- end python_6 ----------
ghpython_script_3 = GhPythonScript(tiles=[appt_23_o, appt_23_j])  # -> formated; inputs tiles: list
# ---------- ghpython_script_3: Python ----------
# -*- coding: utf-8 -*-
"""
@author: prslvtsv
"""
###############################################################
#import ghdev.devcon as dev
#reload(dev)
#
#dev.init_dev_tools(locals(),  config=dev_options, verbose=True)
###############################################################

formated = "..".join(tiles)
# ---------- end ghpython_script_3 ----------
ghpython_script_4 = GhPythonScript(tiles=[appt_12_i, appt_13_i])  # -> formated; inputs tiles: list; same code as ghpython_script_3
ghpython_script_5 = GhPythonScript(tiles=appt_13_i)  # -> formated; inputs tiles: list; same code as ghpython_script_3
python_7 = GhPythonScript(mandatory=ghpython_script_3, filler=ghpython_script_4)  # -> out, tileset; same code as python_6
solver_conditional_script_3 = RemoteReceiver(solver_conditional_script)
python_8 = GhPythonScript(
    solver=solver_conditional_script_2,
    combinations=Toggle(True),
    board_size=python_5.shape,
    board_remove=python_5.remove_idx_str,
    tile_set=python_6.tileset)  # -> out, cmd_str; inputs board_size: list
# ---------- python_8: Python ----------
# -*- coding: utf-8 -*-
"""
@author: prslvtsv
"""
###############################################################
#import ghdev.devcon as dev
#reload(dev)
#
#dev.init_dev_tools(locals(),  config=dev_options, verbose=True)
###############################################################

xs = board_size[0]
ys = board_size[1]
#if len(board_remove) == 0:
#    board_remove = 

if combinations:
    cmd_str = "python {} -md combination -s {} {} -r {} {}".format(solver, xs, ys, board_remove, tile_set)
else:
    cmd_str = "python {} -s {} {} -r {} {}".format(solver, xs, ys, board_remove, tile_set)
# ---------- end python_8 ----------
board_remove_cells = RemoteReceiver()
shell_executable_2 = RemoteReceiver(shell_executable)
conda_activate_2 = RemoteReceiver(conda_activate)
board_size = RemoteReceiver()
shell_executable_3 = RemoteReceiver(shell_executable)
conda_activate_3 = RemoteReceiver(conda_activate)
python_9 = GhPythonScript(
    solver=solver_conditional_script_2,
    combinations=Toggle(False),
    board_size=python_5.shape,
    board_remove=python_5.remove_idx_str,
    tile_set=python_6.tileset)  # -> out, cmd_str; inputs board_size: list; same code as python_8
python_10 = GhPythonScript(solver=solver_conditional_script_3, board_size=board_size, board_remove=board_remove_cells, tile_set=python_7.tileset)  # -> out, cmd_str
# ---------- python_10: Python ----------
# -*- coding: utf-8 -*-
"""
@author: prslvtsv
"""
###############################################################
#import ghdev.devcon as dev
#reload(dev)
#
#dev.init_dev_tools(locals(),  config=dev_options, verbose=True)
###############################################################

xs = board_size.split(",")[0]
ys = board_size.split(",")[1]

cmd_str = "python {} -s {} {} -r {} {}".format(solver, xs, ys, board_remove, tile_set)
# ---------- end python_10 ----------
panel_5 = Panel(python_10.cmd_str)  # disabled

# ---- group: ONLY FOR COMBINATIONS
python_11 = GhPythonScript(terminal=shell_executable_3, conda_activate=conda_activate_3, payload=python_8.cmd_str)  # -> out, result
# ---------- python_11: Python ----------
# -*- coding: utf-8 -*-
"""
@author: prslvtsv
"""
###############################################################
#import ghdev.devcon as dev
#reload(dev)
#
#dev.init_dev_tools(locals(),  config=dev_options, verbose=True)
###############################################################

import subprocess as sub


def execute_in_shell(cmd):
    
    process = sub.Popen(cmd, executable=terminal, stdin=sub.PIPE, stdout=sub.PIPE, stderr=sub.PIPE, shell=True)
    stdout, stderr = process.communicate()
#    print stdout
    return stdout


cmd = "; ".join([conda_activate, payload])
ex = execute_in_shell(cmd).split('\n')
print ex
combinations = "[" + ", ".join(ex[:-1]) + "]"
c = combinations.replace("\r", "")
print c 
exec("result = {}".format(c))
# ---------- end python_11 ----------

# ----
python_12 = GhPythonScript(terminal=shell_executable_3, conda_activate=conda_activate_3, payload=python_9.cmd_str)  # -> out, result
# ---------- python_12: Python ----------
# -*- coding: utf-8 -*-
"""
@author: prslvtsv
"""
###############################################################
#import ghdev.devcon as dev
#reload(dev)
#
#dev.init_dev_tools(locals(),  config=dev_options, verbose=True)
###############################################################

import subprocess as sub


def execute_in_shell(cmd):
    
    process = sub.Popen(cmd, executable=terminal, stdin=sub.PIPE, stdout=sub.PIPE, stderr=sub.PIPE, shell=True)
    stdout, stderr = process.communicate()
    print stdout
    return stdout


cmd = "; ".join([conda_activate, payload])
result = execute_in_shell(cmd).split('\n')
# ---------- end python_12 ----------
python_13 = GhPythonScript(terminal=shell_executable_2, conda_activate=conda_activate_2, payload=python_10.cmd_str)  # -> out, result; same code as python_12

# ---- group: index global
ghpython_script_6 = GhPythonScript(x=python_11.result)  # -> a
# ---------- ghpython_script_6: Python ----------
a = x
# ---------- end ghpython_script_6 ----------

# ----
panel_6 = Panel(ghpython_script_6)
python_14 = GhPythonScript(result_in=python_12.result)  # -> out, board, tiling; inputs result_in: list
# ---------- python_14: Python ----------
# -*- coding: utf-8 -*-
"""
@author: prslvtsv
"""
###############################################################
#import ghdev.devcon as dev
#reload(dev)
#
#dev.init_dev_tools(locals(),  config=dev_options, verbose=True)
###############################################################

print type(result_in[0])
exec("board = {}".format(result_in[0].strip())) 
exec("tiling = {}".format(result_in[1].strip())) 
#board = result_in[0]
#tiling = result_in[1]
# ---------- end python_14 ----------

# ---- group: create from indexes
python_15 = GhPythonScript(indexes=ghpython_script_6)  # -> out, matrix, cells; inputs indexes: list; same code as python

# ----
number_slider = Slider(5.324, range=0..10)
panel_7 = Panel(python_13.result)  # disabled
python_16 = GhPythonScript(result_in=python_13.result)  # -> out, board, tiling; inputs result_in: list; disabled; same code as python_14

# ---- group: parse tiling
python_17 = GhPythonScript(cells=python_14.tiling)  # -> out, x, y
# ---------- python_17: Python ----------
# -*- coding: utf-8 -*-
"""
@author: prslvtsv
"""
###############################################################
#import ghdev.devcon as dev
#reload(dev)
#
#dev.init_dev_tools(locals(),  config=dev_options, verbose=True)
###############################################################

x= []
y = []

print cells
srt = sorted(cells)
print srt
for c in srt:
    
    x.append(c[0])
    y.append(c[1])
# ---------- end python_17 ----------

# ---- group: parse board
python_18 = GhPythonScript(cells=python_14.board)  # -> out, x, y; inputs cells: list
# ---------- python_18: Python ----------
# -*- coding: utf-8 -*-
"""
@author: prslvtsv
"""
###############################################################
#import ghdev.devcon as dev
#reload(dev)
#
#dev.init_dev_tools(locals(),  config=dev_options, verbose=True)
###############################################################

x= []
y = []

srt = sorted(cells)
print srt
for c in srt:
    
    x.append(c[0])
    y.append(c[1])
# ---------- end python_18 ----------

# ----
tstat_2 = TreeStatistics(Tree=python_15.matrix)  # -> Paths, Length, Count
panel_8 = Panel(python_15.out)

# ---- group: parse tiling
python_19 = GhPythonScript(cells=python_16.tiling)  # -> out, x, y; disabled; same code as python_17

# ---- group: parse board
python_20 = GhPythonScript(cells=python_16.board)  # -> out, x, y; inputs cells: list; disabled; same code as python_18

# ----
Y = UnitY(Factor=Slider(0, range=-10..0))
X = UnitX(Factor=Slider(-7.399, range=-10..0))
number_slider_2 = Slider(5, range=0..10)

# ---- group: generate geometry
tiling = Tiling(index_x=python_17.x, index_y=python_17.y)  # -> cell_srf, cell_rect, cell_pt

tiling_2 = Tiling(index_x=python_18.x, index_y=python_18.y)  # -> cell_srf, cell_rect, cell_pt

# ----
sqrt = GhPythonScript(x=tstat_2.Count)  # -> a
# ---------- sqrt: Python ----------
import math
a = int(round(math.sqrt(x)))
# ---------- end sqrt ----------
python_21 = GhPythonScript(matrix=python_15.matrix)  # -> out, representation, cells_indx, glob_idx
# ---------- python_21: Python ----------
# -*- coding: utf-8 -*-
"""
@author: prslvtsv
"""
###############################################################
#import ghdev.devcon as dev
#reload(dev)
#
#dev.init_dev_tools(locals(),  config=dev_options, verbose=True)
###############################################################
import gblock.elements.matrix as mtx
reload(mtx)


representation = matrix.__repr__()
cells_indx = matrix.active_indexes()
glob_idx = matrix.active_indexes(glob=True)
# ---------- end python_21 ----------
partition = PartitionList(List=simplify(flatten(python_15.matrix)), Size=sqrt)
addition = Addition(A=X, B=Y)

# ---- group: generate geometry
tiling_3 = Tiling(index_x=python_19.x, index_y=python_19.y)  # -> cell_srf, cell_rect, cell_pt; disabled

# ----
bbox = BoundingBox(Content=flatten(tiling_3.cell_pt), Plane=PlaneXY(0, 0, 0), UnionBox=True)  # -> Box, Box_2; disabled

# ---- group: generate geometry
tiling_4 = Tiling(index_x=python_20.x, index_y=python_20.y)  # -> cell_srf, cell_rect, cell_pt; disabled

# ----
dim = Dimensions(Surface=bbox.Box)  # -> UDimension, VDimension; disabled
move_2 = Move(Geometry=tiling.cell_rect, Motion=addition)  # -> Geometry, Transform
tstat_3 = TreeStatistics(Tree=partition)  # -> Paths, Length, Count
multiplication = Multiplication(A=dim.UDimension, B=2)  # disabled
X_2 = UnitX(Factor=multiplication)  # disabled
move_3 = Move(Geometry=tiling_3.cell_rect, Motion=X_2)  # -> Geometry, Transform; disabled

# ---- group: custom display
display = Display(geo_to_viz=move_2.Geometry)

display_2 = Display(geo_to_viz=tiling_2.cell_rect)

# ----
panel_9 = Panel(python_21.representation)
series = Series(Start=number_slider_2, Step=number_slider, Count=tstat_3.Count)  # -> graft(Series)
series_2 = Series(Start=number_slider_2, Step=number_slider, Count=tstat_3.Length)

# ---- group: custom display
display_3 = Display(geo_to_viz=move_3.Geometry)  # disabled

display_4 = Display(geo_to_viz=tiling_4.cell_rect)  # disabled

# ----
python_22 = GhPythonScript(matrix=partition)  # -> out, representation, cells_indx; same code as python_3
pt_2 = ConstructPoint(XCoordinate=series_2, YCoordinate=series, ZCoordinate=0)
sqrt_2 = GhPythonScript(m=python_22.cells_indx)  # -> x, y
# ---------- sqrt_2: Python ----------
x = m[0]
y = m[1]
# ---------- end sqrt_2 ----------
data = Data(python_21.glob_idx)
pt_3 = ConstructPoint(XCoordinate=sqrt_2.x, YCoordinate=sqrt_2.y, ZCoordinate=0)
group = Group(Objects=pt_3)
xy = XYPlane(Origin=Point(0, 0, 0))
trim = TrimTree(Tree=group, Depth=1)
orient = Orient(Geometry=trim, Source=xy, Target=pt_2)  # -> flatten(Geometry), Transform
ungroup = Ungroup(Group=orient.Geometry)  # -> flatten(Objects)
pgroups_3 = PointGroups(Points=ungroup, Distance=Slider(2.5, range=0..10))  # -> Groups, Indices

# ---- group: convert points to indexes
indx_3 = GhPythonScript(points=pgroups_3.Groups)  # -> out, indexes, xy; inputs points: list of Point3d; same code as indx

# ----
x_y_2 = GhPythonScript(xy=indx_3.xy)  # -> x, y; inputs xy: list; same code as x_y
pt_4 = ConstructPoint(XCoordinate=x_y_2.x, YCoordinate=x_y_2.y, ZCoordinate=0)
vec_2 = VectorXYZ(XComponent=0, YComponent="0.2", ZComponent=0)  # -> Vector, Length
move_4 = Move(Geometry=pt_4, Motion=vec_2.Vector)  # -> Geometry, Transform
cluster_2 = Cluster(p=pt_4)

# ---- group: display indexing
tag_2 = TextTag(Location=move_4.Geometry, Text=data, Colour=ColourSwatch(SwatchColor=RGB(0, 0, 0)))

# ---- group: display point groups
disp_6 = Disp_2(data=pgroups_3.Groups)

# ---- group: display cells tiles
disp_7 = Disp(geo_to_viz=cluster_2)

# ==== cluster Tiling
index_y = ClusterInput()  # index Y
index_x = ClusterInput()  # index X
data = Data(Slider(1, range=0..1))
Y = Data(index_y)
X = Data(index_x)
ghpython_script = GhPythonScript(x=X, c=data)  # -> a
# ---------- ghpython_script: Python ----------
# -*- coding: utf-8 -*-
"""
@author: prslvtsv
"""
###############################################################
#import ghdev.devcon as dev
#reload(dev)
#
#dev.init_dev_tools(locals(),  config=dev_options, verbose=True)
###############################################################


a = x*c
# ---------- end ghpython_script ----------
ghpython_script_2 = GhPythonScript(x=Y, c=data)  # -> a; same code as ghpython_script
ghpython_script_3 = GhPythonScript(x=X, c=data)  # -> a
# ---------- ghpython_script_3: Python ----------
# -*- coding: utf-8 -*-
"""
@author: prslvtsv
"""
###############################################################
#import ghdev.devcon as dev
#reload(dev)
#
#dev.init_dev_tools(locals(),  config=dev_options, verbose=True)
###############################################################


a = x*c + c
# ---------- end ghpython_script_3 ----------
ghpython_script_4 = GhPythonScript(x=Y, c=data)  # -> a; same code as ghpython_script_3
pt = ConstructPoint(XCoordinate=ghpython_script, YCoordinate=ghpython_script_2, ZCoordinate=0)
pt_2 = ConstructPoint(XCoordinate=ghpython_script_3, YCoordinate=ghpython_script_4, ZCoordinate=0)
rec_2pt = Rectangle2Pt(Plane=PlaneXY(0, 0, 0), PointA=pt, PointB=pt_2, Radius=0)  # -> Rectangle, Length
pcen = PolygonCenter(Polyline=rec_2pt.Rectangle)  # -> CenterV, CenterE, CenterA
boundary = BoundarySurfaces(Edges=rec_2pt.Rectangle)
cell_srf = ClusterOutput(boundary)  # cell_srf
cell_rect = ClusterOutput(rec_2pt.Rectangle)  # cell_rect
cell_pt = ClusterOutput(pcen.CenterV)  # cell_pt

# ==== cluster Display
geo_to_viz = ClusterInput()
data = Data(geo_to_viz)
color = Color(data_in=data)
runion = RegionUnion(Curves=data)
boundary = BoundarySurfaces(Edges=runion)
addition = Addition(A=color, B=ColourSwatch(SwatchColor=RGB(150, 150, 150)))
preview = CustomPreview(Geometry=simplify(boundary), Material=simplify(color))
previewlw = CustomPreviewLineweights(
    Geometry=simplify(runion),
    Shader=simplify(ColourSwatch(SwatchColor=RGBA(0, 0, 0, 212))),
    Thickness=Slider(2, range=0..10),
    Absolute=False)
previewlw_2 = CustomPreviewLineweights(Geometry=simplify(data), Shader=simplify(addition), Thickness=Slider(0, range=0..10), Absolute=False)
previewmat = CustomPreviewMaterials(Geometry=boundary, DiffuseColor=color, Transparency=Slider(0.197, range=0..1))
createhatch = CreateHatch(Bake=False, Curves=runion, HatchPatternName="Hatch1", HatchScale=0.8, HatchRotation=45)  # -> HatchGeometry, HatchObjects
number_slider = Slider(0.625, range=0..1)
preview_2 = CustomPreview(Geometry=simplify(createhatch.HatchGeometry), Material=simplify(color))

# ==== cluster Disp
geo_to_viz = ClusterInput()
data = Data(geo_to_viz)
color = Color(data_in=data)
runion = RegionUnion(Curves=data)
boundary = BoundarySurfaces(Edges=runion)
addition = Addition(A=color, B=ColourSwatch(SwatchColor=RGB(150, 150, 150)))
preview = CustomPreview(Geometry=simplify(boundary), Material=simplify(color))
previewlw = CustomPreviewLineweights(
    Geometry=simplify(runion),
    Shader=simplify(ColourSwatch(SwatchColor=RGBA(0, 0, 0, 212))),
    Thickness=Slider(2, range=0..10),
    Absolute=False)
previewlw_2 = CustomPreviewLineweights(Geometry=simplify(data), Shader=simplify(addition), Thickness=Slider(1.7, range=0..10), Absolute=False)
previewmat = CustomPreviewMaterials(Geometry=boundary, DiffuseColor=color, Transparency=Slider(0.211, range=0..1))
createhatch = CreateHatch(Bake=False, Curves=runion, HatchPatternName="Hatch1", HatchScale=0.8, HatchRotation=45)  # -> HatchGeometry, HatchObjects
number_slider = Slider(0.625, range=0..1)
preview_2 = CustomPreview(Geometry=simplify(createhatch.HatchGeometry), Material=simplify(color))

# ==== cluster Disp_2
data = ClusterInput()

# ---- group: display point groups
data_2 = Data(data)
tstat = TreeStatistics(Tree=data_2)  # -> Paths, Length, Count
txt = Text(tstat.Length)
txt_2 = Text(tstat.Paths)
pt = ConstructPoint(XCoordinate="0.2", YCoordinate="0.1", ZCoordinate="0.2")
concat = Concatenate(FragmentA=txt_2, FragmentB=txt)
cpreview = PreviewClasses(Geometry=data_2, Name=concat, Position=pt, Size=12, Seed=123)

# ==== cluster Disp_3
xy = ClusterInput()
x_y = GhPythonScript(xy=xy)  # -> x, y; inputs xy: list
# ---------- x_y: Python ----------
x = [a[0] for a in xy]
y = [a[1] for a in xy]
# ---------- end x_y ----------
pt = ConstructPoint(XCoordinate=x_y.x, YCoordinate=x_y.y, ZCoordinate=0)
vec = VectorXYZ(XComponent=0, YComponent="0.2", ZComponent=0)  # -> Vector, Length
move = Move(Geometry=pt, Motion=vec.Vector)  # -> Geometry, Transform
T = ClusterInput()
cluster = Cluster(p=pt)

# ---- group: display indexing
tag = TextTag(Location=move.Geometry, Text=T, Colour=ColourSwatch(SwatchColor=RGB(0, 0, 0)))

# ----
R = ClusterOutput(cluster)

# ==== cluster Color
data_in = ClusterInput()  # data_in
dom = ConstructDomain(DomainStart=Slider(0.168, range=0..1), DomainEnd=Slider(0.922, range=0..1))
tstat = TreeStatistics(Tree=data_in)  # -> Paths, Length, Count
bbox = BoundingBox(Content=data_in, Plane=PlaneXY(0, 0, 0), UnionBox=True)  # -> Box, Box_2
extremums = MinMax(Number=tstat.Length)  # -> Minimum, Maximum
range = Range(Domain=dom, Steps=expr("x-1", tstat.Length))
dim = Dimensions(Surface=bbox.Box)  # -> UDimension, VDimension
area = Area(Geometry=bbox.Box)  # -> Area, Centroid
pcshuffle = Shuffle(List=range, Seed=Slider(1, range=0..1), LastSaveLocalization="neutral,N")
extremums_2 = MinMax(Number=flatten(dim.UDimension))  # -> Minimum, Maximum
wheel = ColourWheel(
    extremums_2.Maximum,
    ColourGrips_Style=10,
    ColourGrips_Grip=[5.115610268, 3.821325235, 1.989214472, 5.130807126],
    ColourGrips_Lum=[0.1, 1],
    ColourGrips_Range=[0.5123760279, 0.5123760279, 0.5123760279, 0.5123760279],
    ColourGrips_Sat=[0.2, 1])
addition = Addition(A=dim.UDimension, B=area.Area)
hsv = ColourHSV(Alpha=1, Hue=pcshuffle, Saturation=1, Value=1)
subtraction = Subtraction(A=dim.UDimension, B=extremums_2.Minimum)
hsl = ColourHSL(Alpha=0.7, Hue=pcshuffle, Saturation=1, Luminance=Slider(0.247, range=0..1))
data = Data(graft(wheel))
data_2 = Data(simplify(graft(hsv)))
item = ListItem(List=hsv, Index=subtraction, Wrap=True)  # -> simplify(Item)
panel = Panel(dim.UDimension)
addition_2 = Addition(A=data_2, B=item)
division = Division(A=addition_2, B=2)
panel_2 = Panel(division)
color_out = ClusterOutput(item)  # color_out

# ==== cluster Cluster
p = ClusterInput()  # p
pdecon = Deconstruct(Point=p)  # -> XComponent, YComponent, ZComponent
data = Data(Slider(1, range=0..1))
number_slider = Slider(2, range=0..10)
ghpython_script = GhPythonScript(x=pdecon.XComponent, c=data)  # -> a; same code as ghpython_script_3
ghpython_script_2 = GhPythonScript(x=pdecon.YComponent, c=data)  # -> a; same code as ghpython_script
ghpython_script_3 = GhPythonScript(x=pdecon.XComponent, c=data)  # -> a; same code as ghpython_script
addition = Addition(A=ghpython_script_3, B=ghpython_script)
ghpython_script_4 = GhPythonScript(x=pdecon.YComponent, c=data)  # -> a; same code as ghpython_script_3
addition_2 = Addition(A=ghpython_script_2, B=ghpython_script_4)
subtraction = Subtraction(A=ghpython_script_2, B=ghpython_script_4)
subtraction_2 = Subtraction(A=ghpython_script_3, B=ghpython_script)
pt = ConstructPoint(XCoordinate=ghpython_script_3, YCoordinate=ghpython_script_2, ZCoordinate=0)
pt_2 = ConstructPoint(XCoordinate=ghpython_script, YCoordinate=ghpython_script_4, ZCoordinate=0)
division = Division(A=subtraction_2, B=number_slider)
division_2 = Division(A=subtraction, B=number_slider)
rec_2pt = Rectangle2Pt(Plane=PlaneXY(0, 0, 0), PointA=pt, PointB=pt_2, Radius=0)  # -> Rectangle, Length
vec = VectorXYZ(XComponent=division, YComponent=division_2, ZComponent=0)  # -> Vector, Length
move = Move(Geometry=rec_2pt.Rectangle, Motion=vec.Vector)  # -> Geometry, Transform
pcen = PolygonCenter(Polyline=move.Geometry)  # -> CenterV, CenterE, CenterA
boundary = BoundarySurfaces(Edges=move.Geometry)
G = ClusterOutput(move.Geometry)
